# Grasshopper definition 0314_construct_component.gh (Grasshopper 1.0.8)

profileoutside = ProfileOutside()
overlaygeo = OverlayGeo()
overlaygeolayernames = OverlayGeoLayerNames()
name = Name()
differentiator = Differentiator()
packingdeviation = PackingDeviation()
basepoint = BasePoint()
sizer = Sizer()
preintegrationregions = PreIntegrationRegions()
preintegrationregionpoints = PreIntegrationRegionPoints()
newwidth = NewWidth()
newheight = NewHeight()
componentregionoffset = ComponentRegionOffset()
constructcomponent = CSharpScript(
    Name=name,
    Differentiator=differentiator,
    ProfileOutside=profileoutside,
    PackingDeviation=packingdeviation,
    OverlayGeo=overlaygeo,
    OverlayGeoLayerNames=overlaygeolayernames,
    BasePoint=basepoint,
    Sizer=sizer,
    PreIntegrationRegions=preintegrationregions,
    PreIntegrationRegionPoints=preintegrationregionpoints,
    NewWidth=newwidth,
    NewHeight=newheight,
    ComponentRegionOffset=componentregionoffset,
    Reference="C:\_WORKSPACE\REPO\RHINO-CNC\CABINETS\CABINETS.UTIL\BIN\DEBUG\Cabinets.Util.dll")  # -> out, Component; inputs Name: String, Differentiator: String, ProfileOutside: Curve, PackingDeviation: Polyline, OverlayGeo: list of GeometryBase, OverlayGeoLayerNames: list of String, BasePoint: Point3d, Sizer: Polyline, PreIntegrationRegions: list of Curve, PreIntegrationRegionPoints: list of Point3d, NewWidth: Double, NewHeight: Double, ComponentRegionOffset: Double
# ---------- constructcomponent: C# ----------
    if (ProfileOutside == null && (OverlayGeo == null || OverlayGeo.Count() == 0))
    {
      return;
    }
    var tol = RhinoDoc.ActiveDoc.ModelAbsoluteTolerance;

    var packingPolyline = (PackingDeviation == null) ? null : new PolylineCurve(PackingDeviation);
    var hasOverlayGeo = (OverlayGeo != null && OverlayGeo.Count > 0 && OverlayGeo.First() != null);
    var overlayGeo = hasOverlayGeo ? OverlayGeo : null;
    var overlayGeoLayerNames = hasOverlayGeo ? OverlayGeoLayerNames : null;

    Component c = null;
    if (Sizer != null && PreIntegrationRegions != null && PreIntegrationRegions.Count > 0
      && PreIntegrationRegionPoints != null && PreIntegrationRegionPoints.Count > 0)
    {
      c = new Component(Name, Differentiator, BasePoint, tol,
        Sizer, PreIntegrationRegionPoints, PreIntegrationRegions, ProfileOutside, overlayGeo,
        overlayGeoLayerNames, packingPolyline, ComponentRegionOffset);
      c.Resize(NewWidth, NewHeight);
    }
    else
    {
      c = new Component(Name, Differentiator, BasePoint, tol, ProfileOutside, overlayGeo, overlayGeoLayerNames,
        packingPolyline, ComponentRegionOffset);
    }
    Component = c;
# ---------- end constructcomponent ----------
panel = Panel(constructcomponent.out)
component = Component(constructcomponent.Component)
