# Grasshopper definition 240424test.gh (Grasshopper 1.0.8)

A = Number()
C = Number()
B = Number()
A_2 = Number(A)
C_2 = Number(C)
B_2 = Number(B)
addition = Addition(A=A_2, B=B_2)
subtraction = Subtraction(A=B_2, B=C_2)
multiplication = Multiplication(A=addition, B=subtraction)
division = Division(A=addition, B=subtraction)
Y = Number(division)
X = Number(multiplication)
X_2 = Number(X)
Y_2 = Number(Y)
