# Grasshopper definition basic_kitchenette_model.gh (Grasshopper 1.0.7)

length = Number()
depth = Number()
settings = Text()
config = Text()
length_2 = GetNumber(
    Slider(2000, range=1500..2500),
    AtLeast=1,
    AtMost=1,
    Maximum=1.797693135e+308,
    Minimum=-1.797693135e+308,
    TreeAccess=False)
depth_2 = GetNumber(Slider(600, range=300..900), AtLeast=1, AtMost=1, Maximum=1.797693135e+308, Minimum=-1.797693135e+308, TreeAccess=False)
length_3 = Number(length)
depth_3 = Number(depth)
length_4 = Number(length_2)
settings_2 = Text(settings)
config_2 = Text(config)
null = NullItem(Item=depth_3)  # -> NullFlags, InvalidFlags, Description
null_2 = NullItem(Item=length_3)  # -> NullFlags, InvalidFlags, Description
depth_4 = Number(depth_2)
filter = StreamFilter(Gate=null.NullFlags, Stream0=depth_3, Stream1=depth_4)
filter_2 = StreamFilter(Gate=null_2.NullFlags, Stream0=length_3, Stream1=length_4)

# ---- group: Disassembled 3D
_1 = Brep(flatten(Tree({0}: [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], {1}: [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], {2}: [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], {3}: [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], {4}: [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], {5}: [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]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)))
_2 = Brep(flatten(Tree({0}: [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], {1}: [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], {2}: [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], {3}: [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], {4}: [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], {5}: [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]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)))
_3 = Brep(flatten(Tree({0}: [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], {1}: [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], {2}: [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], {3}: [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], {4}: [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], {5}: [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]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)))

# ----
transform = Transform(flatten(Tree({0}: [{TransformCount=1, Name="Generic", m00=0, m01=0, m02=1, m03=0, m10=1, m11=0, m12=0, m13=0, m20=0, m21=1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}], {1}: [{TransformCount=1, Name="Generic", m00=1, m01=0, m02=0, m03=-612, m10=0, m11=1, m12=0, m13=-3200, m20=0, m21=0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}], {2}: [{TransformCount=1, Name="Generic", m00=0, m01=0, m02=-1, m03=600, m10=-1, m11=0, m12=0, m13=1860, m20=0, m21=1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}], {3}: [{TransformCount=1, Name="Generic", m00=1, m01=0, m02=0, m03=-612, m10=0, m11=-1, m12=0, m13=6260, m20=0, m21=0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}], {4}: [{TransformCount=1, Name="Generic", m00=1, m01=0, m02=0, m03=18, m10=0, m11=1, m12=0, m13=-6290, m20=0, m21=0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}], {5}: [{TransformCount=1, Name="Generic", m00=1, m01=0, m02=0, m03=-594, m10=0, m11=1, m12=0, m13=-6290, m20=0, m21=0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}]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)))
transform_2 = Transform(flatten(Tree({0}: [{TransformCount=1, Name="Generic", m00=0, m01=0, m02=1, m03=0, m10=1, m11=0, m12=0, m13=0, m20=0, m21=1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}], {1}: [{TransformCount=1, Name="Generic", m00=1, m01=0, m02=0, m03=-762, m10=0, m11=1, m12=0, m13=-3200, m20=0, m21=0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}], {2}: [{TransformCount=1, Name="Generic", m00=0, m01=0, m02=-1, m03=600, m10=-1, m11=0, m12=0, m13=2160, m20=0, m21=1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}], {3}: [{TransformCount=1, Name="Generic", m00=1, m01=0, m02=0, m03=-762, m10=0, m11=-1, m12=0, m13=6560, m20=0, m21=0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}], {4}: [{TransformCount=1, Name="Generic", m00=1, m01=0, m02=0, m03=18, m10=0, m11=1, m12=0, m13=-6590, m20=0, m21=0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}], {5}: [{TransformCount=1, Name="Generic", m00=1, m01=0, m02=0, m03=-594, m10=0, m11=1, m12=0, m13=-6590, m20=0, m21=0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}]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)))
transform_3 = Transform(flatten(Tree({0}: [{TransformCount=1, Name="Generic", m00=0, m01=0, m02=1, m03=0, m10=1, m11=0, m12=0, m13=0, m20=0, m21=1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}], {1}: [{TransformCount=1, Name="Generic", m00=1, m01=0, m02=0, m03=-762, m10=0, m11=1, m12=0, m13=-3200, m20=0, m21=0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}], {2}: [{TransformCount=1, Name="Generic", m00=0, m01=0, m02=-1, m03=525, m10=-1, m11=0, m12=0, m13=2085, m20=0, m21=1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}], {3}: [{TransformCount=1, Name="Generic", m00=1, m01=0, m02=0, m03=-762, m10=0, m11=-1, m12=0, m13=6560, m20=0, m21=0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}], {4}: [{TransformCount=1, Name="Generic", m00=1, m01=0, m02=0, m03=18, m10=0, m11=1, m12=0, m13=-6590, m20=0, m21=0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}], {5}: [{TransformCount=1, Name="Generic", m00=1, m01=0, m02=0, m03=-519, m10=0, m11=1, m12=0, m13=-6590, m20=0, m21=0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}]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)))

_3_2 = Brep(flatten(Tree({0}: [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], {1}: [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], {2}: [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], {3}: [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], {4}: [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], {5}: [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]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)))
_2_2 = Brep(flatten(Tree({0}: [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], {1}: [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], {2}: [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], {3}: [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], {4}: [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], {5}: [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]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)))
_1_2 = Brep(flatten(Tree({0}: [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], {1}: [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], {2}: [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], {3}: [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], {4}: [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], {5}: [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]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)))

c_script = CSharpScript(
    Depth=filter,
    Length=filter_2,
    Set1=_1_2,
    Set2=_2_2,
    Set3=_3_2,
    Tx1=transform,
    Tx2=transform_2,
    Tx3=transform_3,
    Flat1=_1,
    Flat2=_2,
    Flat3=_3)  # -> out, Disassembled, Tx, Assembled; inputs Depth: Double, Length: Double, Set1: list of Brep, Set2: list of Brep, Set3: list of Brep, Tx1: list, Tx2: list, Tx3: list, Flat1: list, Flat2: list, Flat3: list
# ---------- c_script: C# ----------
    if (Depth > 650 && Length > 1900 && Length < 2100)
    {
      Print("Two");
      Assembled = Set2;
      Tx = Tx2;
      Disassembled = Flat2;
    }
    else if (Depth > 650 && Length < 1900)
    {
      Print("Three");
      Assembled = Set3;
      Tx = Tx3;
      Disassembled = Flat3;
    }
    else
    {
      Print("One");
      Assembled = Set1;
      Tx = Tx1;
      Disassembled = Flat1;
    }
# ---------- end c_script ----------
disassembled = Disassembled(c_script.Disassembled)
assembled = Assembled(c_script.Assembled)
tx = Tx(c_script.Tx)
