# Grasshopper definition console_table.gh (Grasshopper 1.0.7)

# ---- group: 3D model parameters
experimental_middle_section = BooleanToggle(False)
panel = Panel("""0.67
0.33""")
panel_2 = Panel("""300
406""")
panel_3 = Panel("""236.73
411.741""")
panel_4 = Panel("""65
67""")
multiplication = Multiplication(A="48", B="3")
drawerslidemidlineelevations = Number(panel_3)
fronttrolleypushershapedeviationparallel = Number(Slider(283, range=0..800))  # "FrontTrolleyPusherShapeDeviationParallelDistance"
fronttrolleypushershapedeviationperpdist = Number(Slider(0, range=0..400))  # "FrontTrolleyPusherShapeDeviationPerpDistance"
cluster = Cluster(numstuds=multiplication, theoretical=Toggle(True))
backtrolleypushershapedeviationparalleld = Number(Slider(157, range=0..800))  # "BackTrolleyPusherShapeDeviationParallelDistance"
fronttrolleydrawerslidelength = Number("300")
backtrolleydrawerslidelength = Number("406")
backtrolleypushershapedeviationperpdista = Number(Slider(86, range=0..400))  # "BackTrolleyPusherShapeDeviationPerpDistance"
slidelengths = Number(panel_2)
supportbeamheights = Number(panel_4)
fingergap = Number(Slider(15, range=0..50))
wheelheight = Number(Slider(50, range=20..100))
supportbeamsnormalisedxsalongl = Number(panel)
experimental_middle_section_2 = Boolean(experimental_middle_section)
platformmaterialthickness = Number(Slider(12, range=10..30))
armpivotholediameter = Number(Slider(10, range=3..30))
armmaterialthickness = Number(Slider(18, range=10..30))
shelflength = Number(cluster)
max = Maximum(A=fronttrolleydrawerslidelength, B=backtrolleydrawerslidelength)
min = Minimum(A=Slider(250, range=0..500), B=fronttrolleydrawerslidelength)

# ----
number_slider = Slider(50, range=20..80)
cluster_2 = Cluster(numstuds="48", theoretical=Toggle(True))
expression = Expression(aw=number_slider, t=armmaterialthickness, fg=fingergap, sl=max, w=cluster_2, Expression="w-(sl-aw-fg-(t+fg)-aw/2)")
expression_2 = Expression(aw=number_slider, t=armmaterialthickness, fg=fingergap, Expression="t + fg + aw/2")
division = Division(A=number_slider, B="2")
number_slider_2 = Slider(25, range=0..100)
addition = Addition(A=cluster_2, B=cluster_2, C=min)
pt = ConstructPoint(XCoordinate=0, YCoordinate=0, ZCoordinate=0)
# Adjustment to account for angle.  Remember to check the gap between the rear arm and the rear-most vertical U stabiliser (but just the horizontal part of that)
addition_2 = Addition(A=expression_2, B=Slider(-15, range=-100..0))
k_add_front = Number(expression)
subtraction = Subtraction(A=addition, B=division)
subtraction_2 = Subtraction(A=backtrolleydrawerslidelength, B=division)

# ----
# Currently the trolley
# offset start/end are how far the centre linse are away from the wall (x=0)
# Currently the diffs are vertical distances from the relative L points
backtrolley_bottom_vertical_diff = Number(Slider(-60, range=-400..200))
fronttrolley_offset_end = Number(subtraction)
fronttrolley_offset_start = Number(subtraction_2)
floor_wall_corner_point = Point(pt)
shelf_vertical_clearance = Number(Slider(33.5, range=0..200))
arm_floor_clearance = Number(Slider(10, range=0..100))
fronttrolley_top_diff = Number(Slider(-8.3, range=-300..200))
shelf_width = Number(cluster_2)
arm_start_degrees = Number(Slider(-2, range=-25..25))
arm_width = Number(number_slider)
k_add_front_2 = Number(Slider(137.1, range=0..200))
arm_gap = Number(Slider(15, range=5..50))
k_add_back = Number(addition_2)

backtrolley_offset_start = Number(division)
backtrolley_offset_end = Number(division)
rad = Radians(Degrees=arm_start_degrees)
backtrolley_bottom_diff = Number(backtrolley_bottom_vertical_diff)
fronttrolley_top_diff_2 = Number(fronttrolley_top_diff)
division_2 = Division(A=shelf_vertical_clearance, B="2")
multiplication_2 = Multiplication(A=backtrolley_bottom_vertical_diff, B=-1)
# This assumes the arms rotate from top towards the RIGHT.
# 
# Angles in inputs are relative to VERTICAL.
# 
# Also these inputs are don't refer to the centre points or lines; they refer to the measurements based on edges of physical pieces.  e.g. the minimum arm height is not the height of the arm's extreme rotation point but the lower edge of the physical arm (with its width etc).
number_slider_3 = Slider(100, range=0..100)
abs = Absolute(Value=rad)
shelf_width_2 = Number(shelf_width)
k_add_back_2 = Number(k_add_back)
middle_l_to_top_l_drop_down = Number(division_2)
k_add_back_3 = Number(k_add_back_2)
subtraction_3 = Subtraction(A=shelf_width_2, B=backtrolley_offset_start)
k_add_front_3 = Number(k_add_front_2)
merge = Merge(Data1=fronttrolley_top_diff_2, Data2=multiplication_2)
shelf_width_3 = Number(shelf_width)
k_add_front_4 = Number(k_add_front_2)
k_add_back_4 = Number(k_add_back_2)
g_gamma = Number(abs)
arm_width_2 = Number(arm_width)
subtraction_4 = Subtraction(A=fronttrolley_offset_start, B=k_add_back_3)
subtraction_5 = Subtraction(A=subtraction_3, B=k_add_front_3)
multiplication_3 = Multiplication(A=shelf_width_2, B="2")
subtraction_6 = Subtraction(A=fronttrolley_offset_end, B=shelf_width_2)
cluster_3 = Cluster_2(
    s=shelf_width_3,
    h=middle_l_to_top_l_drop_down,
    g=g_gamma,
    w=arm_width_2,
    ag=arm_gap,
    ac=arm_floor_clearance,
    ka_back=k_add_back_4,
    ka_front=k_add_front_4)  # -> A, R, K, J, l_height, l_width, topshelf_height, middleshelf_height, bottomshelf_height
merge_2 = Merge(Data1=subtraction_4, Data2=subtraction_5)
k_add_front_5 = Number(k_add_front_2)
k_add_back_5 = Number(k_add_back_2)
subtraction_7 = Subtraction(A=multiplication_3, B=backtrolley_offset_end)
num = Number(arm_gap)
rotation = GetNumber(number_slider_3, AtLeast=1, AtMost=1, Maximum=1.797693135e+308, Minimum=-1.797693135e+308, TreeAccess=False)
floor_wall_corner_point_2 = Point(floor_wall_corner_point)
subtraction_8 = Subtraction(A=subtraction_6, B=k_add_back_5)
subtraction_9 = Subtraction(A=subtraction_7, B=k_add_front_5)
arm_angle_x_component = Number(cluster_3.K)
middle_l_to_top_l_drop_down_2 = Number(middle_l_to_top_l_drop_down)
deg = Degrees(Radians=cluster_3.A)
merge_3 = Merge(Data1=subtraction_8, Data2=subtraction_9)
arm_final_angle = Number(cluster_3.A)
arm_final_angle_alpha = Number(arm_final_angle)
arm_length = Number(cluster_3.R)
arm_angle_x_component_2 = Number(cluster_3.K)
arm_angle_x_component_k = Number(arm_angle_x_component_2)
middle_to_top_rotation_vertical = Number(cluster_3.J)
l_height = Number(cluster_3.l_height)
l_width = Number(cluster_3.l_width)
top_shelf_height = Number(cluster_3.topshelf_height)
table_height = Number(cluster_3.middleshelf_height)
bottom_shelf_height = Number(cluster_3.bottomshelf_height)
g_gamma_2 = Number(g_gamma)
table_height_2 = Number(table_height)
pdecon = Deconstruct(Point=floor_wall_corner_point_2)  # -> XComponent, YComponent, ZComponent
cluster_4 = Cluster_3(x1=merge_2, x2=merge_3, d_tr=merge, k=arm_angle_x_component, a=arm_final_angle_alpha, g=g_gamma_2)  # -> armlength, pusherlength
subtraction_10 = Subtraction(A=table_height_2, B=middle_l_to_top_l_drop_down_2)
addition_3 = Addition(A=pdecon.XComponent, B=arm_angle_x_component_k)
addition_4 = Addition(A=deg, B="90")
k_add_back_6 = Number(k_add_back)
pt_2 = ConstructPoint(XCoordinate=addition_3, YCoordinate=subtraction_10, ZCoordinate=0)
vec = VectorXYZ(XComponent=k_add_back_6, YComponent=0, ZComponent=0)  # -> Vector, Length
arm_angle_x_component_k_2 = Number(arm_angle_x_component_2)
k_add_back_7 = Number(k_add_back_2)
addition_5 = Addition(A=vec.Vector, B=pt_2)
item = ListItem(List=cluster_4.armlength, Index=0, Wrap=True)  # -> Item, Item1
item_2 = ListItem(List=cluster_4.pusherlength, Index=0, Wrap=True)  # -> Item, Item1
multiplication_4 = Multiplication(A=arm_angle_x_component_k_2, B="2")
pdecon_2 = Deconstruct(Point=addition_5)  # -> XComponent, YComponent, ZComponent
l_width_2 = Number(l_width)
l_height_2 = Number(l_height)
l_width_3 = Number(l_width)
arm_angle_x_component_k_3 = Number(arm_angle_x_component_2)
middle_l_to_top_l_drop_down_3 = Number(middle_l_to_top_l_drop_down)
top_shelf_height_2 = Number(top_shelf_height)
multiplication_5 = Multiplication(A=middle_l_to_top_l_drop_down_2, B="2")
bottom_shelf_height_2 = Number(bottom_shelf_height)
addition_6 = Addition(A=k_add_back_7, B=arm_angle_x_component_k_2)
addition_7 = Addition(A=k_add_back_7, B=multiplication_4)
arm_length_2 = Number(arm_length)
table_height_3 = Number(table_height)
backtrolley_bottom_diff_2 = Number(backtrolley_bottom_diff)
fronttrolley_top_diff_3 = Number(fronttrolley_top_diff_2)
addition_8 = Addition(A=l_width_3, B=pdecon_2.XComponent)
subtraction_11 = Subtraction(A=pdecon_2.YComponent, B=l_height_2)
floor_wall_corner_point_3 = Point(floor_wall_corner_point)
shelf_width_4 = Number(shelf_width)
arm_start_degrees_2 = Number(arm_start_degrees)
arm_width_3 = Number(arm_width)
pt_3 = ConstructPoint(XCoordinate=addition_8, YCoordinate=subtraction_11, ZCoordinate=0)
middle_platform_vertical_offset = Number(middle_l_to_top_l_drop_down_3)

fronttrolley_arm_length = Number(item.Item)
fronttrolley_pusher_length = Number(item_2.Item)
backtrolley_arm_length = Number(item.Item1)
backtrolley_pusher_length = Number(item_2.Item1)
floor_wall_corner_point_4 = Point(floor_wall_corner_point_3)
fronttrolley_top_diff_4 = Number(fronttrolley_top_diff_3)
backtrolley_bottom_diff_3 = Number(backtrolley_bottom_diff_2)
arm_start_degrees_3 = Number(arm_start_degrees_2)
bottom_shelf_height_3 = Number(bottom_shelf_height_2)
middle_l_left_point = Point(addition_5)
arm_end_degrees = Number(addition_4)
shelf_width_5 = Number(shelf_width_4)
middle_l_right_point = Point(pt_3)
l_points_height = Number(l_height_2)
arm_width_4 = Number(arm_width_3)
xoffsetpershelf = Number(arm_angle_x_component_k_3)
l_points_width = Number(l_width_2)
top_shelf_height_3 = Number(top_shelf_height_2)
arm_length_3 = Number(arm_length_2)

bottom_platform_x_offset = Number(addition_7)
top_platform_vertical_offset = Number(multiplication_5)
middle_platform_x_offset = Number(addition_6)
top_platform_x_offset = Number(k_add_back_7)
middle_shelf_height = Number(table_height_3)
arm_gap_2 = Number(num)
entwine = Entwine(Branch00=rotation, Branch01="0", Branch02="100", FlattenInputs=True)  # -> simplify(Result)

# ----
# These offsets include both k and k_add
# This script is run twice, for front and back trolleys
floor_wall_corner_point_5 = Point(floor_wall_corner_point_4)
slidelengths_2 = Number(slidelengths)
fronttrolleypushershapedeviationparallel_2 = Number(fronttrolleypushershapedeviationparallel)  # "FrontTrolleyPusherShapeDeviationParallelDistance"
fronttrolleypushershapedeviationperpdist_2 = Number(fronttrolleypushershapedeviationperpdist)  # "FrontTrolleyPusherShapeDeviationPerpDistance"
middle_l_left_point_2 = Point(middle_l_left_point)
middle_l_right_point_2 = Point(middle_l_right_point)
fronttrolley_arm_length_2 = Number(fronttrolley_arm_length)
backtrolley_arm_length_2 = Number(backtrolley_arm_length)
fronttrolley_top_diff_5 = Number(fronttrolley_top_diff_4)
backtrolley_bottom_diff_4 = Number(backtrolley_bottom_diff_3)
fronttrolley_pusher_length_2 = Number(fronttrolley_pusher_length)
backtrolley_pusher_length_2 = Number(backtrolley_pusher_length)
backtrolleypushershapedeviationparalleld_2 = Number(backtrolleypushershapedeviationparalleld)  # "BackTrolleyPusherShapeDeviationParallelDistance"
backtrolleypushershapedeviationperpdista_2 = Number(backtrolleypushershapedeviationperpdista)  # "BackTrolleyPusherShapeDeviationPerpDistance"
top_platform_x_offset_2 = Number(top_platform_x_offset)
middle_platform_x_offset_2 = Number(middle_platform_x_offset)
bottom_platform_x_offset_2 = Number(bottom_platform_x_offset)
l_points_height_2 = Number(l_points_height)
top_platform_offset = Number(top_platform_vertical_offset)
middle_platform_vertical_offset_2 = Number(middle_l_to_top_l_drop_down)
rotationpercentage = Number(entwine)
arm_start_degrees_4 = Number(arm_start_degrees_3)
arm_end_degrees_2 = Number(arm_end_degrees)
arm_length_4 = Number(arm_length_3)
l_points_width_2 = Number(l_points_width)
shelf_width_6 = Number(shelf_width_5)
wheelheight_2 = Number(wheelheight)
arm_width_5 = Number(arm_width_4)
bottom_platform_vertical_offset = Number("0")
create_ls_rotating_arms = CSharpScript(
    RotationPercentage=rotationpercentage,
    ArmStartDegrees=arm_start_degrees_4,
    ArmEndDegrees=arm_end_degrees_2,
    ArmLength=arm_length_4,
    LPointsHeight=l_points_height_2,
    LPointsWidth=l_points_width_2,
    MiddleLPointLeft=middle_l_left_point_2,
    MiddleLPointRight=middle_l_right_point_2)  # -> out, TopL, MiddleL, BottomL, RotatingArmLeft, RotatingArmRight, CurrentAngleRadians, RotationAxisLeft, RotationAxisRight; inputs RotationPercentage: Double, ArmStartDegrees: Double, ArmEndDegrees: Double, ArmLength: Double, LPointsHeight: Double, LPointsWidth: Double, MiddleLPointLeft: Point3d, MiddleLPointRight: Point3d
# ---------- create_ls_rotating_arms: C# ----------
    double degrees = ArmStartDegrees + (ArmEndDegrees - ArmStartDegrees) / 100 * RotationPercentage;
    double radians = degrees * Math.PI / 180;
    Vector3d vInitialMiddlePointToEdge = new Vector3d(0, ArmLength, 0);
    Vector3d vLeftToRightForL_X = new Vector3d(MiddleLPointRight.X - MiddleLPointLeft.X, 0, 0);
    Vector3d vLeftToRightForL = new Vector3d(MiddleLPointRight.X - MiddleLPointLeft.X, MiddleLPointRight.Y - MiddleLPointLeft.Y, 0);

    LineCurve armLeft = new LineCurve(MiddleLPointLeft + vInitialMiddlePointToEdge, MiddleLPointLeft - vInitialMiddlePointToEdge);
    armLeft.Rotate(radians, Vector3d.ZAxis * -1, MiddleLPointLeft);
    LineCurve armRight = new LineCurve(MiddleLPointRight + vInitialMiddlePointToEdge, MiddleLPointRight - vInitialMiddlePointToEdge);
    armRight.Rotate(radians, Vector3d.ZAxis * -1, MiddleLPointRight);

    TopL = new PolylineCurve(new List<Point3d> { armLeft.PointAtStart, armLeft.PointAtStart + vLeftToRightForL_X, armLeft.PointAtStart + vLeftToRightForL });
    MiddleL = new PolylineCurve(new List<Point3d> { MiddleLPointLeft, MiddleLPointLeft + vLeftToRightForL_X, MiddleLPointLeft + vLeftToRightForL });
    BottomL = new PolylineCurve(new List<Point3d> { armLeft.PointAtEnd, armLeft.PointAtEnd + vLeftToRightForL_X, armLeft.PointAtEnd + vLeftToRightForL });

    RotatingArmLeft = armLeft;
    RotatingArmRight = armRight;
    CurrentAngleRadians = radians;
    RotationAxisLeft = new Line(MiddleLPointLeft, MiddleLPointLeft + Vector3d.ZAxis * -1);
    RotationAxisRight = new Line(MiddleLPointRight, MiddleLPointRight + Vector3d.ZAxis * -1);
# ---------- end create_ls_rotating_arms ----------
merge_4 = Merge(Data1=top_platform_x_offset_2, Data2=middle_platform_x_offset_2, Data3=bottom_platform_x_offset_2)
merge_5 = Merge(Data1=top_platform_offset, Data2=middle_platform_vertical_offset_2, Data3=bottom_platform_vertical_offset)
panel_5 = Panel("""1
-1""")
platform_width = Number(shelf_width_6)
merge_6 = Merge(Data1=create_ls_rotating_arms.RotationAxisLeft, Data2=create_ls_rotating_arms.RotationAxisRight)
merge_7 = Merge(Data1=middle_l_left_point_2, Data2=middle_l_right_point_2)
merge_8 = Merge(Data1=fronttrolley_arm_length_2, Data2=backtrolley_arm_length_2)
merge_9 = Merge(Data1=fronttrolley_top_diff_5, Data2=backtrolley_bottom_diff_4)
merge_10 = Merge(Data1=fronttrolley_pusher_length_2, Data2=backtrolley_pusher_length_2)
merge_11 = Merge(Data1=fronttrolleypushershapedeviationparallel_2, Data2=backtrolleypushershapedeviationparalleld_2)
merge_12 = Merge(Data1=fronttrolleypushershapedeviationperpdist_2, Data2=backtrolleypushershapedeviationperpdista_2)
division_3 = Division(A=arm_width_5, B="2")
bottom_l = Curve(create_ls_rotating_arms.BottomL)
mid_l = Curve(create_ls_rotating_arms.MiddleL)
top_l = Curve(create_ls_rotating_arms.TopL)
Y = UnitY(Factor=division_3)
merge_13 = Merge(Data1=top_l, Data2=mid_l, Data3=bottom_l)
merge_14 = Merge(Data1=create_ls_rotating_arms.RotatingArmLeft, Data2=create_ls_rotating_arms.RotatingArmRight)
create_trolley_lines = CSharpScript(
    CurrentAngleRadians=create_ls_rotating_arms.CurrentAngleRadians,
    RotationAxis=merge_6,
    MiddleLPoint=merge_7,
    LengthAlongArmToPusher=merge_8,
    TopDiff=merge_9,
    PusherLength=merge_10,
    DeviationParallelDistance=merge_11,
    DeviationPerpDistance=merge_12,
    Direction=panel_5,
    FloorWallCornerPoint=floor_wall_corner_point_5,
    WheelHeight=wheelheight_2)  # -> out, TrolleyPusher, TrolleyVertical, Test; inputs CurrentAngleRadians: Double, RotationAxis: Line, MiddleLPoint: Point3d, LengthAlongArmToPusher: Double, TopDiff: Double, PusherLength: Double, DeviationParallelDistance: Double, DeviationPerpDistance: Double, Direction: Int32, FloorWallCornerPoint: Point3d, WheelHeight: Double
# ---------- create_trolley_lines: C# ----------
    Point3d leftPtL = MiddleLPoint;
    int dir = Direction / Math.Abs(Direction);

    LineCurve centreToPusherStart = new LineCurve(leftPtL, leftPtL + Vector3d.YAxis * LengthAlongArmToPusher * dir);
    centreToPusherStart.Rotate(CurrentAngleRadians, RotationAxis.Direction, leftPtL);

    double lowY = WheelHeight;

    //    int longestSlideIndex = SlideLengths.IndexOf(SlideLengths.Max());
    //    int shortestSlideIndex = (longestSlideIndex == 0) ? 1 : 0;
    //    bool widerSlideBelow = (DrawerSlideMidLineElevations[longestSlideIndex] < DrawerSlideMidLineElevations[shortestSlideIndex]);
    //
    //    if (widerSlideBelow)
    //    {
    //      lowY = DrawerSlideMidLineElevations[longestSlideIndex] + ArmWidth / 2 + FingerGap;
    //    }

    double pusherEndY = leftPtL.Y + TopDiff;
    Line horizontalLineForIntersection = new Line(Pt(leftPtL.X, pusherEndY), Pt(centreToPusherStart.PointAtEnd.X + PusherLength * dir, pusherEndY));
    Circle circleForIntersection = new Circle(Plane.WorldXY, centreToPusherStart.PointAtEnd, PusherLength);
    Point3d[] horizontalLineForIntersectionEndPts = (new [] { horizontalLineForIntersection.From, horizontalLineForIntersection.To }).OrderBy(p => p.X).ToArray();

    Point3d intPt1, intPt2;
    double t1, t2;
    Rhino.Geometry.Intersect.Intersection.LineCircle(horizontalLineForIntersection, circleForIntersection, out t1, out intPt1, out t2, out intPt2);
    Point3d pusherVerticalPivotPoint;

    if (intPt1 != null && intPt2 == null) pusherVerticalPivotPoint = intPt1;
    else if (intPt1 == null && intPt2 != null) pusherVerticalPivotPoint = intPt2;
    else
    {
      var eligible = (new [] { intPt1, intPt2 })
        .Where(p => p.X >= horizontalLineForIntersectionEndPts[0].X && p.X <= horizontalLineForIntersectionEndPts[1].X).ToList();

      pusherVerticalPivotPoint = (dir == 1) ? eligible.First() : eligible.Last();
    }

    Line pusherLine = new Line(centreToPusherStart.PointAtEnd, pusherVerticalPivotPoint);
    Vector3d vPusher = new Vector3d(pusherLine.Direction);
    vPusher.Unitize();
    Vector3d vPusherPerp = new Vector3d(-vPusher.Y, vPusher.X, 0);

    Point3d[] pusherPts = new Point3d[] {
      centreToPusherStart.PointAtEnd,
      centreToPusherStart.PointAtEnd + vPusher * DeviationParallelDistance + vPusherPerp * DeviationPerpDistance,
      pusherVerticalPivotPoint
      };

    TrolleyPusher = new PolylineCurve(pusherPts);
    TrolleyVertical = new LineCurve(pusherVerticalPivotPoint, Pt(pusherVerticalPivotPoint.X, lowY));

    Test = new List<object>() { horizontalLineForIntersection, circleForIntersection };
# ---------- create_trolley_lines: C# additional code ----------
  private Point3d Pt(double x, double y)
  {
    return new Point3d(x, y, 0);
  }
# ---------- end create_trolley_lines ----------
create_shelf_platform = CSharpScript(xOffset=merge_4, Width=platform_width, Height=merge_5, L=merge_13)  # -> out, Platform, PlatformRiser; inputs xOffset: Double, Width: Double, Height: Double, L: Curve
# ---------- create_shelf_platform: C# ----------
    var ptStartL = L.PointAtStart;
    var ptEndL = L.PointAtEnd;

    var startX = Math.Min(ptStartL.X, ptEndL.X) - xOffset;
    var endX = startX + Width;
    var midX = startX + (Width / 2);
    var startY = Math.Max(ptStartL.Y, ptEndL.Y);
    var endY = startY + Height;

    List<LineCurve> platformCurves = new List<LineCurve>();

    if (Height > 0)
    {
      PlatformRiser = new LineCurve(new Point3d(midX, startY, 0), new Point3d(midX, endY, 0));
    }

    Platform = new LineCurve(new Point3d(startX, endY, 0), new Point3d(endX, endY, 0));
# ---------- end create_shelf_platform ----------
median_index = MedianIndex(L=merge_13)
move = Move(Geometry=create_shelf_platform.Platform, Motion=Y)  # -> Geometry, Transform
item_3 = ListItem(List=move.Geometry, Index=median_index, Wrap=True)
middle_section = CSharpScript(MiddlePlatform=item_3, WheelHeight=wheelheight_2, SlideLengths=slidelengths_2)  # -> out, Pl; inputs MiddlePlatform: Curve, WheelHeight: Double, SlideLengths: list of Double
# ---------- middle_section: C# ----------
    double minX = Math.Min(MiddlePlatform.PointAtStart.X, MiddlePlatform.PointAtEnd.X);
    double[] xs = new double[2] { minX, minX + SlideLengths.Max() };
    double[] ys = new double[2] { WheelHeight, MiddlePlatform.PointAtStart.Y};    
    
    List<Point3d> pts = new List<Point3d>()
      { Pt(xs[0], ys[0]), Pt(xs[0], ys[1]), Pt(xs[1], ys[1]), Pt(xs[1], ys[0]), Pt(xs[0], ys[0]) };
    
    Pl = new PolylineCurve(pts);
# ---------- middle_section: C# additional code ----------
  Point3d Pt(double x, double y)
  {
    return new Point3d(x, y, 0);
  }
# ---------- end middle_section ----------
item_4 = ListItem(List=create_trolley_lines.TrolleyVertical, Index=0, Wrap=True)  # -> Item, Item1
item_5 = ListItem(List=create_trolley_lines.TrolleyPusher, Index=0, Wrap=True)  # -> Item, Item1
bang = ExplodeTree(Data=create_shelf_platform.Platform)  # -> Branch0, Branch1, Branch2
bang_2 = ExplodeTree(Data=move.Geometry)  # -> Branch0, Branch1, Branch2
bang_3 = ExplodeTree(Data=item_5.Item)  # -> Branch0, Branch1, Branch2
bang_4 = ExplodeTree(Data=item_5.Item1)  # -> Branch0, Branch1, Branch2
bang_5 = ExplodeTree(Data=item_4.Item)  # -> Branch0, Branch1, Branch2
bang_6 = ExplodeTree(Data=item_4.Item1)  # -> Branch0, Branch1, Branch2
bang_7 = ExplodeTree(Data=merge_13)  # -> Branch0, Branch1, Branch2
bang_8 = ExplodeTree(Data=merge_14)  # -> Branch0, Branch1, Branch2
bang_9 = ExplodeTree(Data=middle_section.Pl)  # -> Branch0, Branch1, Branch2
platforms_real_top_surfaces = Curve(bang_2.Branch0)
initial_front_trolley_pusher = Curve(bang_3.Branch1)
initial_front_trolley_vertical = Curve(bang_5.Branch1)
initial_middle_section_outline = Curve(bang_9.Branch1)
initial_back_trolley_vertical = Curve(bang_6.Branch1)
initial_back_trolley_pusher = Curve(bang_4.Branch1)
final_back_trolley_pusher = Curve(bang_4.Branch2)
initial_rotating_arms = Curve(bang_8.Branch1)
front_trolley_pusher = Curve(bang_3.Branch0)
final_rotating_arms = Curve(bang_8.Branch2)
front_trolley_vertical = Curve(bang_5.Branch0)
middle_section_outline = Curve(bang_9.Branch0)
back_trolley_vertical = Curve(bang_6.Branch0)
back_trolley_pusher = Curve(bang_4.Branch0)
rotating_arms = Curve(bang_8.Branch0)
platformlines = Curve(bang.Branch0)
ls = Curve(bang_7.Branch0)
initial_ls = Curve(bang_7.Branch1)
final_ls = Curve(bang_7.Branch2)

# ---- group: Mirror plane
shelflength_2 = Number(shelflength)
division_4 = Division(A=shelflength_2, B="2")
floor_wall_corner_point_6 = Point(floor_wall_corner_point_4)
Y_2 = UnitY(Factor=division_4)
addition_9 = Addition(A=Y_2, B=floor_wall_corner_point_6)
xz = XZPlane(Origin=addition_9)
mirrorplane = Plane(xz)

# ----
item_6 = ListItem(List=rotating_arms, Index=0, Wrap=True)  # -> Item, Item1

initial_back_trolley_pusher_2 = Curve(initial_back_trolley_pusher)
initial_middle_section_outline_2 = Curve(initial_middle_section_outline)
initial_ls_2 = Curve(initial_ls)
initial_rotating_arms_2 = Curve(initial_rotating_arms)
initial_front_trolley_pusher_2 = Curve(initial_front_trolley_pusher)
initial_front_trolley_vertical_2 = Curve(initial_front_trolley_vertical)
initial_back_trolley_vertical_2 = Curve(initial_back_trolley_vertical)
armpivotholediameter_2 = Number(armpivotholediameter)
drawerslidemidlineelevations_2 = Number(drawerslidemidlineelevations)
slidelengths_3 = Number(slidelengths)
supportbeamsnormalisedxsalongl_2 = Number(supportbeamsnormalisedxsalongl)
supportbeamheights_2 = Number(supportbeamheights)
arm_width_6 = Number(arm_width_4)
platformmaterialthickness_2 = Number(platformmaterialthickness)
fingergap_2 = Number(fingergap)
armmaterialthickness_2 = Number(armmaterialthickness)
new_middle_unit = CSharpScript(
    MiddleSectionOutline=initial_middle_section_outline_2,
    Ls=initial_ls_2,
    RotatingArms=initial_rotating_arms_2,
    FrontTrolleyPusher=initial_front_trolley_pusher_2,
    BackTrolleyPusher=initial_back_trolley_pusher_2,
    FrontTrolleyVertical=initial_front_trolley_vertical_2,
    BackTrolleyVertical=initial_back_trolley_vertical_2,
    ArmPivotHoleDiameter=armpivotholediameter_2,
    DrawerSlideMidLineElevations=drawerslidemidlineelevations_2,
    SlideLengths=slidelengths_3,
    SupportBeamsNormalisedXsAlongL=supportbeamsnormalisedxsalongl_2,
    SupportBeamHeights=supportbeamheights_2,
    ArmWidth=arm_width_6,
    PlatformMaterialThickness=platformmaterialthickness_2,
    FingerGap=fingergap_2,
    ArmMaterialThickness=armmaterialthickness_2,
    n="2")  # -> out, Outline, Test, n_out; inputs MiddleSectionOutline: Polyline, Ls: list of Curve, RotatingArms: list of Curve, FrontTrolleyPusher: Curve, BackTrolleyPusher: Curve, FrontTrolleyVertical: Curve, BackTrolleyVertical: Curve, ArmPivotHoleDiameter: Double, DrawerSlideMidLineElevations: list of Double, SlideLengths: list of Double, SupportBeamsNormalisedXsAlongL: list of Double, SupportBeamHeights: list of Double, ArmWidth: Double, PlatformMaterialThickness: Double, FingerGap: Double, ArmMaterialThickness: Double, n: Int32
# ---------- new_middle_unit: C# ----------
    double tol = 0.01;

    Point3d[] backVerticalPts = (new [] { BackTrolleyVertical.PointAtStart, BackTrolleyVertical.PointAtEnd }).OrderBy(p => p.X).ToArray();
    Point3d[] frontVerticalPts = (new [] { FrontTrolleyVertical.PointAtStart, FrontTrolleyVertical.PointAtEnd }).OrderBy(p => p.X).ToArray();
    Point3d[] backPusherPts = (new [] { BackTrolleyPusher.PointAtStart, BackTrolleyPusher.PointAtEnd }).OrderBy(p => p.X).ToArray();
    Point3d[] frontPusherPts = (new [] { FrontTrolleyPusher.PointAtStart, FrontTrolleyPusher.PointAtEnd }).OrderBy(p => p.X).ToArray();

    double columnLeftX = backPusherPts[1].X + FingerGap + ArmWidth / 2;
    double columnRightX = MiddleSectionOutline.Max(p => p.X) - ArmMaterialThickness - FingerGap;
    double topY = MiddleSectionOutline.Max(p => p.Y);
    double lowerY = MiddleSectionOutline.Min(p => p.Y);
    double minX = MiddleSectionOutline.Min(p => p.X);

    Vector3d vFrontPusher = (new Line(frontPusherPts[0], frontPusherPts[1])).Direction;
    vFrontPusher.Unitize();

    Vector3d vFrontPusherPerp = new Vector3d(vFrontPusher.Y, -vFrontPusher.X, 0);
    Point3d frontPusherParallelStart = frontPusherPts[0] + (FingerGap + (ArmWidth / 2)) * vFrontPusherPerp;

    Vector3d vBackPusher = (new Line(backPusherPts[0], backPusherPts[1])).Direction;
    vBackPusher.Unitize();

    Vector3d vBackPusherPerp = new Vector3d(-vBackPusher.Y, vBackPusher.X, 0);
    Point3d backPusherParallelStart = backPusherPts[0] + (FingerGap + (ArmWidth / 2)) * vBackPusherPerp;

    Print("backPusherPts[0] = " + backPusherPts[0].ToString());
    Print("vBackPusher = " + vBackPusher.ToString());
    Print("vBackPusherPerp = " + vBackPusherPerp.ToString());

    Test = new Line(frontPusherPts[0], frontPusherPts[0] + vFrontPusherPerp);

    List<Point3d> pts = new List<Point3d>()
      {
        GetIntersectingPoint(new Line(backPusherParallelStart, vBackPusher), new Line(Pt(minX, lowerY), Pt(minX, topY)), tol),
        Pt(minX, topY),
        GetIntersectingPoint(new Line(frontPusherParallelStart, vFrontPusher), new Line(Pt(minX, topY), Pt(columnRightX, topY)), tol),
        GetIntersectingPoint(new Line(frontPusherParallelStart, vFrontPusher), new Line(Pt(columnRightX, topY), Pt(columnRightX, lowerY)), tol),
        Pt(columnRightX, lowerY),
        Pt(columnLeftX, lowerY),
        GetIntersectingPoint(new Line(backPusherParallelStart, vBackPusher), new Line(Pt(columnLeftX, lowerY), Pt(columnLeftX, topY)), tol)
        };
    pts.Add(pts.First());

    int backSlideIndex = SlideLengths.IndexOf(SlideLengths.Max());
    int frontSlideIndex = SlideLengths.IndexOf(SlideLengths.Min());
    Polyline backSlideRect = (new Rhino.Geometry.Rectangle3d(
      new Plane(Pt(minX, Math.Max(lowerY, DrawerSlideMidLineElevations[backSlideIndex] - ArmWidth / 2)), Vector3d.ZAxis),
      SlideLengths[backSlideIndex], ArmWidth)).ToPolyline();
    Polyline frontSlideRect = (new Rhino.Geometry.Rectangle3d(
      new Plane(Pt(columnRightX, Math.Max(lowerY, DrawerSlideMidLineElevations[frontSlideIndex] - ArmWidth / 2)), Vector3d.ZAxis),
      -SlideLengths[frontSlideIndex], ArmWidth)).ToPolyline();

    Outline = Curve.CreateBooleanUnion(new [] { new PolylineCurve(pts), backSlideRect.ToPolylineCurve(), frontSlideRect.ToPolylineCurve()}, tol);
# ---------- new_middle_unit: C# additional code ----------
  private Point3d Pt(double x, double y)
  {
    return new Point3d(x, y, 0);
  }

  private Point3d GetIntersectingPoint(Line l1, Line l2, double tol, bool finiteOnly = false)
  {
    double a, b;
    Rhino.Geometry.Intersect.Intersection.LineLine(l1, l2, out a, out b, tol, finiteOnly);
    return l1.PointAt(a);
  }
# ---------- end new_middle_unit ----------
expression_3 = Expression(t=armmaterialthickness_2, n="2", g=fingergap_2, Expression="n*(t + g)")
Y_3 = UnitY(Factor=armmaterialthickness_2)
X = UnitX(Factor=1)
Z = UnitZ(Factor=1)
vec_2 = VectorXYZ(XComponent=0, YComponent=expression_3, ZComponent=0)  # -> Vector, Length
rev = Reverse(Vector=Y_3)
cluster_5 = Cluster_4(dir1=X, dir2=Z, close="True")
rev_2 = Reverse(Vector=vec_2.Vector)
crv = Curve(cluster_5)
move_2 = Move(Geometry=cluster_5, Motion=rev_2)  # -> Geometry, Transform
extr = Extrude(Base=move_2.Geometry, Direction=rev)
cap = CapHoles(Brep=extr)

# ---- group: Swerving front rotating arm
back_trolley_pusher_2 = Curve(back_trolley_pusher)
item_7 = ListItem(List=final_ls, Index="1", Wrap=True)
end = EndPoints(Curve=back_trolley_pusher_2)  # -> Start, End
end_2 = EndPoints(Curve=item_7)  # -> Start, End
pt_4 = Point(end.Start)
ln = Line(StartPoint=end_2.Start, EndPoint=end_2.End)
divide = DivideCurve(Curve=ln, Count="3", Kinks=False)  # -> Points, Tangents, Parameters
number_slider_4 = Slider(90, range=0..100)
item_8 = ListItem(List=divide.Points, Index=0, Wrap=True)  # -> Item, Item1, Item2
armmaterialthickness_3 = Number(armmaterialthickness)
fingergap_3 = Number(fingergap)
arm_width_7 = Number(arm_width_4)
crv_2 = Curve(item_6.Item1)
dist = Distance(PointA=item_8.Item1, PointB=item_8.Item2)
arm_start_degrees_5 = Number(arm_start_degrees_3)
end_3 = EndPoints(Curve=crv_2)  # -> Start, End
len = Length(Curve=crv_2)
expression_4 = Expression(d=dist, t=armmaterialthickness_3, g=fingergap_3, aw=arm_width_7, Expression="d+t+2*g+aw")
panel_6 = Panel("200")
expression_5 = Expression(a=number_slider_4, sd=arm_start_degrees_5, Expression="360-a+sd")
division_5 = Division(A=len, B=2)
vec2pt = Vector2Pt(PointA=end_3.Start, PointB=end_3.End, Unitize=True)  # -> Vector, Length
pt_5 = Point(end_3.Start)
entwine_2 = Entwine(Branch00="82", Branch01=expression_4, Branch02="82", FlattenInputs=True)  # -> flatten(Result)
merge_15 = Merge(Data1=number_slider_4, Data2=expression_5)
cluster_6 = Cluster_5(startpt=pt_5, startdir=vec2pt.Vector, startlength=division_5, rotationdegrees=merge_15, remaininglengths=entwine_2)  # -> out, out_2, polyline
end_4 = EndPoints(Curve=cluster_6.polyline)  # -> Start, End
merge_16 = Merge(Data1=end_4.End, Data2=pt_4, Data3=end_3.End)
pline = PolyLine(Vertices=merge_16, Closed=False)
merge_17 = Merge(Data1=pline, Data2=cluster_6.polyline)
join = JoinCurves(Curves=merge_17, Preserve=False)
crv_3 = Curve(join)

# ---- group: Swerving back rotating arm
front_trolley_pusher_2 = Curve(front_trolley_pusher)
end_5 = EndPoints(Curve=front_trolley_pusher_2)  # -> Start, End
crv_4 = Curve(item_6.Item)
arm_end_degrees_3 = Number(arm_end_degrees)
pt_6 = Point(end_5.Start)
pt_7 = Point(end_5.End)
end_6 = EndPoints(Curve=crv_4)  # -> Start, End
subtraction_12 = Subtraction(A=arm_end_degrees_3, B="90")
expression_6 = Expression(d=subtraction_12, Expression="90 + d")
vec2pt_2 = Vector2Pt(PointA=end_6.Start, PointB=end_6.End, Unitize=True)  # -> Vector, Length
entwine_3 = Entwine(Branch00=Slider(24.8, range=0..30), Branch01=expression_4, FlattenInputs=True)  # -> flatten(Result)
dist_2 = Distance(PointA=end_6.Start, PointB=pt_6)
merge_18 = Merge(Data1="-90", Data2=expression_6)
cluster_7 = Cluster_5(startpt=end_6.Start, startdir=vec2pt_2.Vector, startlength=dist_2, rotationdegrees=merge_18, remaininglengths=entwine_3)  # -> out, out_2, polyline
middle_l_left_point_3 = Point(middle_l_left_point)
end_7 = EndPoints(Curve=cluster_7.polyline)  # -> Start, End
ln_2 = Line(StartPoint=end_7.End, EndPoint=middle_l_left_point_3)
ln_3 = Line(StartPoint=middle_l_left_point_3, EndPoint=end_6.End)
merge_19 = Merge(Data1=cluster_7.polyline, Data2=ln_2, Data3=ln_3)
join_2 = JoinCurves(Curves=merge_19, Preserve=False)

# ----
panel_7 = Panel(new_middle_unit.out)
middle_section_outline_2 = Curve(new_middle_unit.Outline)
panel_8 = Panel(cluster_7.out)
entwine_4 = Entwine(Branch00=join_2, Branch01=crv_3, FlattenInputs=True)  # -> flatten(Result)

middlesectionoutline = Curve(middle_section_outline_2)
middlesectionoutline_2 = Curve(middle_section_outline)
experimental_middle_section_3 = Boolean(experimental_middle_section_2)
back_trolley_vertical_2 = Curve(back_trolley_vertical)
floor_wall_corner_point_7 = Point(floor_wall_corner_point_4)
rotating_arms_2 = Curve(rotating_arms)
end_8 = EndPoints(Curve=back_trolley_vertical_2)  # -> Start, End
filter = StreamFilter(Gate=experimental_middle_section_3, Stream0=middlesectionoutline_2, Stream1=middlesectionoutline)
pdecon_3 = Deconstruct(Point=end_8.End)  # -> XComponent, YComponent, ZComponent
pdecon_4 = Deconstruct(Point=floor_wall_corner_point_7)  # -> XComponent, YComponent, ZComponent
middle_l_right_point_3 = Point(middle_l_right_point)
middle_l_left_point_4 = Point(middle_l_left_point)
platforms_real_top_surfaces_2 = Curve(platforms_real_top_surfaces)
front_trolley_vertical_2 = Curve(front_trolley_vertical)
front_trolley_pusher_3 = Curve(front_trolley_pusher)
back_trolley_pusher_3 = Curve(back_trolley_pusher)
platformlines_2 = Curve(platformlines)
pt_8 = ConstructPoint(XCoordinate=pdecon_3.XComponent, YCoordinate=pdecon_4.YComponent, ZCoordinate=0)
ls_2 = Curve(ls)
merge_20 = Merge(Data1=middle_l_left_point_4, Data2=middle_l_right_point_3)
entwine_5 = Entwine(
    Branch00=platformlines_2,
    Branch01=ls_2,
    Branch02=entwine_4,
    Branch03=front_trolley_pusher_3,
    Branch04=front_trolley_vertical_2,
    Branch05=back_trolley_pusher_3,
    Branch06=back_trolley_vertical_2,
    Branch07=filter,
    Branch08=platforms_real_top_surfaces_2,
    FlattenInputs=True)  # -> flatten(Result)
X_2 = UnitX(Factor=1)
subtraction_13 = Subtraction(A=floor_wall_corner_point_7, B=pt_8)
addition_10 = Addition(A=floor_wall_corner_point_7, B=X_2)
move_3 = Move(Geometry=entwine_5, Motion=subtraction_13)  # -> Geometry, Transform
move_4 = Move(Geometry=merge_20, Motion=subtraction_13)  # -> Geometry, Transform
ln_4 = Line(StartPoint=floor_wall_corner_point_7, EndPoint=addition_10)
rotax = RotateAxis(Geometry=move_3.Geometry, Angle=1.570796327, Axis=ln_4)  # -> flatten(Geometry), Transform
rotax_2 = RotateAxis(Geometry=move_4.Geometry, Angle=1.570796327, Axis=ln_4)  # -> flatten(Geometry), Transform
xz_curves_for_math_model = Curve(rotax.Geometry)

final_ls_2 = Curve(final_ls)
final_rotating_arms_2 = Curve(final_rotating_arms)
item_9 = ListItem(List=final_ls_2, Index="1", Wrap=True)
merge_21 = Merge(Data1=final_rotating_arms_2, Data2=item_9)
move_5 = Move(Geometry=merge_21, Motion=subtraction_13)  # -> Geometry, Transform
rotax_3 = RotateAxis(Geometry=move_5.Geometry, Angle=1.570796327, Axis=ln_4)  # -> flatten(Geometry), Transform
item_10 = ListItem(List=rotax_3.Geometry, Index=0, Wrap=True)  # -> Item, Item1, Item2
final_rotating_arms_3 = Curve([item_10.Item, item_10.Item1])
final_middle_l = Curve(item_10.Item2)

item_11 = ListItem(List=rotax_2.Geometry, Index=0, Wrap=True)  # -> Item, Item1
back_arm_midpoint = Point(item_11.Item)

front_arm_midpoint = Point(item_11.Item1)

xz_curves_for_math_model_2 = Curve(xz_curves_for_math_model)
item_12 = ListItem(List=xz_curves_for_math_model_2, Index=0, Wrap=True)  # -> Item, Item1, Item2, Item3, Item4, Item5, Item6, Item7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

crv_5 = Curve(item_12.Item6)
crv_6 = Curve(item_12.Item7)
crv_7 = Curve([item_12.Item13, item_12.Item14, item_12.Item15])
crv_8 = Curve(item_12.Item)
crv_9 = Curve(item_12.Item3)
crv_10 = Curve(item_12.Item1)
crv_11 = Curve(item_12.Item5)
crv_12 = Curve(item_12.Item9)
crv_13 = Curve(item_12.Item4)
crv_14 = Curve(item_12.Item10)
crv_15 = Curve(item_12.Item11)
crv_16 = Curve(item_12.Item12)
crv_17 = Curve(item_12.Item8)
merge_22 = Merge(Data1=crv_5, Data2=crv_6)
merge_23 = Merge(Data1=crv_9, Data2=crv_13, Data3=crv_11)

platformmaterialthickness_3 = Number(platformmaterialthickness)
armmaterialthickness_4 = Number(armmaterialthickness)
shelflength_3 = Number(shelflength)
arm_width_8 = Number(arm_width_4)
fingergap_4 = Number(fingergap)
rotating_arms_stabiliser_outline = CSharpScript(
    RotatingArms=merge_22,
    TopPlatformLine=crv_8,
    TopL=crv_9,
    HeightAlongArm="300",
    ShelfLength=shelflength_3,
    ArmWidth=arm_width_8,
    PlatformMaterialThickness=platformmaterialthickness_3,
    FingerGap=fingergap_4,
    ArmMaterialThickness=armmaterialthickness_4,
    n="1")  # -> out, StartPt, ZigZags, ArmUnitVector, ArmUnitPerpVector, n_out; inputs RotatingArms: list of Curve, TopPlatformLine: Curve, TopL: Curve, HeightAlongArm: Double, ShelfLength: Double, ArmWidth: Double, PlatformMaterialThickness: Double, FingerGap: Double, ArmMaterialThickness: Double, n: Int32
# ---------- rotating_arms_stabiliser_outline: C# ----------
    try
    {
      Point3d[] lPts = (new [] { TopL.PointAtStart, TopL.PointAtEnd }).OrderBy(p => p.X).ToArray();
      double tol = 0.01;

      double pivotToTopUnderside = TopPlatformLine.PointAtStart.Z + ArmWidth / 2 - PlatformMaterialThickness
        - lPts[1].Z - FingerGap;

      double startDistanceBelowPivot = (HeightAlongArm == 0 ? 200 : HeightAlongArm) - pivotToTopUnderside;

      Vector3d vArm = (RotatingArms[0].PointAtEnd.DistanceTo(lPts[0]) < tol)
        ? RotatingArms[0].PointAtEnd - RotatingArms[0].PointAtStart
        : RotatingArms[0].PointAtStart - RotatingArms[0].PointAtEnd;
      vArm.Unitize();
      Vector3d vArmPerp = new Vector3d(vArm.Z, 0, -vArm.X);

      Point3d startPt = lPts[1] + vArmPerp * ArmWidth / 2 - startDistanceBelowPivot * vArm;

      double pieceLength = ShelfLength + 2 * (ArmMaterialThickness + FingerGap);

      List<double> zigZags = new List<double>()
        {
          startDistanceBelowPivot + pivotToTopUnderside,  //Yes could just use HeightAlongArm here
          pieceLength,
          -(startDistanceBelowPivot + pivotToTopUnderside),
          -ArmWidth,
          startDistanceBelowPivot + pivotToTopUnderside - ArmWidth,
          -(pieceLength - 2 * ArmWidth),
          -(startDistanceBelowPivot + pivotToTopUnderside - ArmWidth)
          };

      ArmUnitVector = vArm;
      ArmUnitPerpVector = vArmPerp;
      ZigZags = zigZags;
      StartPt = startPt;
      n_out = n;
    }
    catch (Exception ex)
    {
      Print(ex.Message);
      Print(ex.StackTrace);
    }
# ---------- end rotating_arms_stabiliser_outline ----------
multiplication_6 = Multiplication(A=rotating_arms_stabiliser_outline.ArmUnitPerpVector, B=armmaterialthickness_4)

join_3 = TextJoin(Text=rotating_arms_stabiliser_outline.out, Join=". ")

# ---- group: RH_OUT:out
txt = Text(join_3)

# ==== cluster Cluster
numstuds = ClusterInput()
theoretical = ClusterInput()
theoretical_2 = Boolean(theoretical)
numstuds_2 = Integer(numstuds)
or = GateOr(A=theoretical_2, B="false")
null = NullItem(Item=numstuds_2)  # -> NullFlags, InvalidFlags, Description
filter = StreamFilter(Gate=or, Stream0="0.2", Stream1="0")
filter_2 = StreamFilter(Gate=null.NullFlags, Stream0=numstuds_2, Stream1="0")
filter_3 = StreamFilter(Gate=null.NullFlags, Stream0=filter, Stream1="0")
expression = Expression(NumStuds=filter_2, StudWidth="8", Tolerance=filter_3, Expression="NumStuds*StudWidth-(2*Tolerance)")
distance = Number(expression)
distance_2 = ClusterOutput(distance)

# ==== cluster Cluster_2
ka_back = ClusterInput()
s = ClusterInput()
h = ClusterInput()
g = ClusterInput()
w = ClusterInput()
ag = ClusterInput()
ac = ClusterInput()
ka_front = ClusterInput()
arm_calc = CSharpScript(s=s, h=h, g=g, w=w, ag=ag, ac=ac, ka_back=ka_back, ka_front=ka_front)  # -> out, A, R, K, J, L_height, L_width, TopShelf_height, MiddleShelf_height, BottomShelf_height; inputs s: Double, h: Double, g: Double, w: Double, ag: Double, ac: Double, ka_back: Double, ka_front: Double
# ---------- arm_calc: C# ----------
    // Where
    // s = shelf width
    // h = height of top shelf to height of middle shelf, in table position
    // g = starting angle of arms in shelf position

    double a = 0;
    double r = 0;
    if (h == 0)
    {
      r = s / (Math.Sin(g) + 1);
    }
    else
    {
      // https://www.wolframalpha.com/input?i=solve+cos%28a%29%3D%28s*sin%28a%29%29%2Fh+-+sin%28g%29+for+a

      // Copied from Wolfram Alpha with additions to make it valid for an Expression component:
      //2*(atan((s-sqrt(h^2*(-(sin(g)^2))+h^2+s^2))/(h*(sin(g)-1))))
      a = 2 * (Math.Atan((s - Math.Sqrt(Math.Pow(h, 2) * (-(Math.Pow(Math.Sin(g), 2))) + Math.Pow(h, 2) + Math.Pow(s, 2))) / (h * (Math.Sin(g) - 1))));
      r = h / Math.Sin(a);
    }

    // k = X offset from edge of shelf of the middle L's higher point to enable the starting angle of the arm to be g
    // j = vertical height of the arm at starting/rest position (will be equal to r when g = 0
    double k = r * Math.Sin(g);
    double j = r * Math.Cos(g);

    //double lh = (w + ag) / Math.Cos(a) + r * Math.Sin(a);
    double lh = (w + ag) / Math.Cos(a) + (s - (ka_back + ka_front) - k) * Math.Tan(a);
    double th = ac + (w / 2) + lh + r + h;

    TopShelf_height = th - h + j + 2 * h;
    MiddleShelf_height = th;
    BottomShelf_height = th - j;

    L_width = s - 2 * k - (ka_back + ka_front);
    L_height = lh;
    A = a;
    R = r;
    K = k;
    J = j;
# ---------- end arm_calc ----------
bottomshelf_height = ClusterOutput(arm_calc.BottomShelf_height)
A = ClusterOutput(arm_calc.A)
R = ClusterOutput(arm_calc.R)
K = ClusterOutput(arm_calc.K)
J = ClusterOutput(arm_calc.J)
l_height = ClusterOutput(arm_calc.L_height)
l_width = ClusterOutput(arm_calc.L_width)
topshelf_height = ClusterOutput(arm_calc.TopShelf_height)
middleshelf_height = ClusterOutput(arm_calc.MiddleShelf_height)

# ==== cluster Cluster_3
x1 = ClusterInput()
x2 = ClusterInput()
d_tr = ClusterInput()
k = ClusterInput()
a = ClusterInput()
g = ClusterInput()
trolleyarm_calc = CSharpScript(x1=x1, x2=x2, d_tr=d_tr, k=k, a=a, g=g)  # -> out, ArmLength, PusherLength; inputs x1: Double, x2: Double, d_tr: Double, k: Double, a: Double, g: Double
# ---------- trolleyarm_calc: C# ----------
    // Note p = rm, x = x1, y = x2 (renamed when entering into WolframAlpha to avoid possible parsing issues by WA

    // Where
    // x1 = start distance of centre of trolley leg relative to back edge of central unit
    // x2 = end distance of centre of trolley leg relative to back edge of central unit
    // g = angle of starting angle of main (left) arm
    // a = end angle relative to horizontal of arm in table position
    // rm = distance along main arm to position hinge for trolley pusher
    // m = length of trolley pusher

    //https://www.wolframalpha.com/input?i=solve+%28x-k%2Bp*sin%28g%29%29%5E2%2B%28p*cos%28g%29-d%29%5E2%3D%28y-p*cos%28a%29-k%29%5E2%2B%28p*sin%28a%29%2Bd%29%5E2+for+p
    // Plain text from WolframAlpha:
    //p = (-2 k x + 2 k y + x^2 - y^2)/(2 (d sin(a) + k sqrt(-sin^2(a) + sin^2(g) + cos^2(g)) - y sqrt(-sin^2(a) + sin^2(g) + cos^2(g)) + d cos(g) + k sin(g) - x sin(g)))
    double rm = (-2 * k * x1 + 2 * k * x2 + Math.Pow(x1, 2) - Math.Pow(x2, 2))
      / (2 * (d_tr * Math.Sin(a) + k * Math.Sqrt(-Math.Pow(Math.Sin(a), 2) + Math.Pow(Math.Sin(g), 2) + Math.Pow(Math.Cos(g), 2)) 
          - x2 * Math.Sqrt(-Math.Pow(Math.Sin(a), 2) + Math.Pow(Math.Sin(g), 2) + Math.Pow(Math.Cos(g), 2)) 
          + d_tr * Math.Cos(g) + k * Math.Sin(g) - x1 * Math.Sin(g)));
    double m = Math.Sqrt(Math.Pow(x1 - k + rm * Math.Sin(g), 2) + Math.Pow(rm * Math.Cos(g) - d_tr, 2));

    ArmLength = rm;
    PusherLength = m;
# ---------- end trolleyarm_calc ----------
armlength = ClusterOutput(trolleyarm_calc.ArmLength)
pusherlength = ClusterOutput(trolleyarm_calc.PusherLength)

# ==== cluster Cluster_4
startpt = ClusterInput()
zigzags = ClusterInput()
dir1 = ClusterInput()
dir2 = ClusterInput()
mirror = ClusterInput()
close = ClusterInput()
zigzag_polyline = CSharpScript(StartPt=startpt, ZigZags=zigzags, Dir1=dir1, Dir2=dir2, Mirror=mirror, Close=close)  # -> out, Pl; inputs StartPt: Point3d, ZigZags: list of Double, Dir1: Vector3d, Dir2: Vector3d, Mirror: Boolean, Close: Boolean
# ---------- zigzag_polyline: C# usings ----------
using System.Linq;
# ---------- zigzag_polyline: C# ----------
    if (StartPt == null) return;

    List<Point3d> pts = new List<Point3d>() { StartPt };

    List<double> zigZags = ZigZags.ToList();

    List<double> temp = zigZags.ToList();

    for (int i = 0; i < zigZags.Count; i++)
    {
      pts.Add(pts.Last() + zigZags[i] * (((i % 2) == 0) ? Dir1 : Dir2));
    }

    if (Mirror && ZigZags.Count >= 2)
    {
      int multiplier = -1;
      for (int i = (zigZags.Count - 2); i >= 0; i--)
      {
        pts.Add(pts.Last() + zigZags[i] * multiplier * (((i % 2) == 0) ? Dir1 : Dir2));
        multiplier *= -1;
        temp.Add(zigZags[i] * (((i % 2) == 0) ? 1 : -1));
      }
    }
    if (Close)
    {
      pts.Add(pts.First());
    }

    Print(string.Join(",", temp));
    Pl = new PolylineCurve(pts);
# ---------- end zigzag_polyline ----------
pl = ClusterOutput(zigzag_polyline.Pl)
panel = Panel(zigzag_polyline.out)

# ==== cluster MedianIndex
L = ClusterInput()
lng = ListLength(List=L)
division = Division(A=lng, B="2")
int = Integer(division)
subtraction = Subtraction(A=int, B="1")
I = ClusterOutput(subtraction)

# ==== cluster Cluster_5
startpt = ClusterInput()
startdir = ClusterInput()
startlength = ClusterInput()
rotationdegrees = ClusterInput()
remaininglengths = ClusterInput()
close = ClusterInput()
plane = ClusterInput()
c_script = CSharpScript(
    StartPt=startpt,
    StartDir=startdir,
    Plane=plane,
    StartLength=startlength,
    RotationDegrees=rotationdegrees,
    RemainingLengths=remaininglengths,
    Close=close)  # -> out, Polyline; inputs StartPt: Point3d, StartDir: Vector3d, Plane: Plane, StartLength: Double, RotationDegrees: list of Double, RemainingLengths: list of Double, Close: Boolean
# ---------- c_script: C# ----------
    double tol = RhinoDoc.ActiveDoc.ModelAbsoluteTolerance;

    try
    {
      Plane plane = (Plane == Plane.Unset || Plane.Normal.Length < tol) ? Plane.WorldXY : Plane;

      Vector3d startDir = new Vector3d(StartDir);
      startDir.Unitize();

      // Notes:
      // - the rotation is always in counter-clockwise
      if (StartLength <= tol || StartDir.Length < tol) return;
      else if ((RotationDegrees == null && RemainingLengths == null)
        || (RotationDegrees == null && RemainingLengths != null)
        || (RotationDegrees != null && RemainingLengths == null))
      {
        Polyline = new LineCurve(StartPt, StartPt + startDir * StartLength);
        return;
      }

      var pts = new List<Point3d>() { StartPt, StartPt + (startDir * StartLength) };

      int numRemaining = Math.Min(RotationDegrees.Count, RemainingLengths.Count);

      Point3d prevPt = pts.Last();
      Vector3d prevDir = StartDir;
      for (int i = 0; i < numRemaining; i++)
      {
        var radians = RotationDegrees[i] * Math.PI / 180;
        var newDir = new Vector3d(prevDir);
        newDir.Rotate(radians, plane.Normal);
        newDir.Unitize();

        var newPt = prevPt + newDir * RemainingLengths[i];
        pts.Add(newPt);

        prevDir = newDir;
        prevPt = newPt;
      }

      if (Close)
      {
        pts.Add(pts.First());
      }
      Polyline = new PolylineCurve(pts);
    }
    catch(Exception ex)
    {
      Print(ex.Message);
    }
# ---------- end c_script ----------
out = ClusterOutput(c_script.out)
polyline = ClusterOutput(c_script.Polyline)
out_2 = ClusterOutput(c_script.out)
