# Grasshopper definition couch_frame.gh (Grasshopper 1.0.7)
# ### Summary
# 
# This is an innovative product concept for the child furniture market: a display cabinet that transforms into a play table.  This displays the structural pieces to illustrate the motion and does not show hardware or wheels.
# 
# ### Inputs
# - Rotation: the amount of rotation of the arms from display cabinet mode (0) to play table mode (100)
# - Shelf width (mm)
# - Shelf Length (mm)
# - Arm start angle: the angle (degrees) off vertical (clockwise) the main arms begin at 0 rotation
# - Arm Width (mm)
# - Finger gap (mm)

# ---- group: 3D model parameters
experimental_middle_section = BooleanToggle(False)
panel = Panel("""0.67
0.33""")
panel_2 = Panel("""300
406""")
panel_3 = Panel("""236.73
411.741""")
panel_4 = Panel("""65
67""")
drawerslidemidlineelevations = Number(panel_3)
fronttrolleypushershapedeviationparallel = Number(Slider(283, range=0..800))  # "FrontTrolleyPusherShapeDeviationParallelDistance"
fronttrolleypushershapedeviationperpdist = Number(Slider(0, range=0..400))  # "FrontTrolleyPusherShapeDeviationPerpDistance"
backtrolleypushershapedeviationparalleld = Number(Slider(157, range=0..800))  # "BackTrolleyPusherShapeDeviationParallelDistance"
fronttrolleydrawerslidelength = Number("300")
backtrolleydrawerslidelength = Number("406")
backtrolleypushershapedeviationperpdista = Number(Slider(86, range=0..400))  # "BackTrolleyPusherShapeDeviationPerpDistance"
slidelengths = Number(panel_2)
supportbeamheights = Number(panel_4)
wheelheight = Number(Slider(50, range=20..100))
supportbeamsnormalisedxsalongl = Number(panel)
experimental_middle_section_2 = Boolean(experimental_middle_section)
min = Minimum(A=Slider(250, range=0..500), B=fronttrolleydrawerslidelength)
max = Maximum(A=fronttrolleydrawerslidelength, B=backtrolleydrawerslidelength)
platformmaterialthickness = Number(Slider(12, range=10..30))
armpivotholediameter = Number(Slider(10, range=3..30))
armmaterialthickness = Number(Slider(18, range=10..30))

# ----
finger_gap = GetNumber(Slider(15, range=8..35), AtLeast=1, AtMost=1, Maximum=1.797693135e+308, Minimum=-1.797693135e+308, TreeAccess=False)
arm_width = GetNumber(Slider(50, range=25..75), AtLeast=1, AtMost=1, Maximum=1.797693135e+308, Minimum=-1.797693135e+308, TreeAccess=False)
arm_start_angle = GetNumber(Slider(-2, range=-5..5), AtLeast=1, AtMost=1, Maximum=1.797693135e+308, Minimum=-1.797693135e+308, TreeAccess=False)
shelf_width = GetNumber(Slider(384, range=200..500), AtLeast=1, AtMost=1, Maximum=1.797693135e+308, Minimum=-1.797693135e+308, TreeAccess=False)
shelf_length = GetNumber(
    Slider(1152, range=600..1500),
    AtLeast=1,
    AtMost=1,
    Maximum=1.797693135e+308,
    Minimum=-1.797693135e+308,
    TreeAccess=False)
rotation = GetNumber(Slider(0, range=0..100), AtLeast=1, AtMost=100, Maximum=100, Minimum=1, TreeAccess=False)
num = Number(finger_gap)
distance = Number(shelf_width)
shelflength = Number(shelf_length)
num_2 = Number(arm_width)
fingergap = Number(num)
expression = Expression(aw=num_2, t=armmaterialthickness, fg=fingergap, sl=max, w=distance, Expression="w-(sl-aw-fg-(t+fg)-aw/2)")
expression_2 = Expression(aw=num_2, t=armmaterialthickness, fg=fingergap, Expression="t + fg + aw/2")
division = Division(A=num_2, B="2")
number_slider = Slider(25, range=0..100)
addition = Addition(A=distance, B=distance, C=min)
pt = ConstructPoint(XCoordinate=0, YCoordinate=0, ZCoordinate=0)
# Adjustment to account for angle.  Remember to check the gap between the rear arm and the rear-most vertical U stabiliser (but just the horizontal part of that)
addition_2 = Addition(A=expression_2, B=Slider(-15, range=-100..0))
k_add_front = Number(expression)
subtraction = Subtraction(A=addition, B=division)
subtraction_2 = Subtraction(A=backtrolleydrawerslidelength, B=division)

# ----
# Currently the trolley
# offset start/end are how far the centre linse are away from the wall (x=0)
# Currently the diffs are vertical distances from the relative L points
backtrolley_bottom_vertical_diff = Number(Slider(-60, range=-400..200))
fronttrolley_offset_end = Number(subtraction)
fronttrolley_offset_start = Number(subtraction_2)
shelf_vertical_clearance = Number(Slider(33.5, range=0..200))
floor_wall_corner_point = Point(pt)
arm_floor_clearance = Number(Slider(10, range=0..100))
fronttrolley_top_diff = Number(Slider(-8.3, range=-300..200))
# This assumes the arms rotate from top towards the RIGHT.
# 
# Angles in inputs are relative to VERTICAL.
# 
# Also these inputs are don't refer to the centre points or lines; they refer to the measurements based on edges of physical pieces.  e.g. the minimum arm height is not the height of the arm's extreme rotation point but the lower edge of the physical arm (with its width etc).
shelf_width_2 = Number(distance)
arm_start_degrees = Number(arm_start_angle)
arm_width_2 = Number(num_2)
k_add_front_2 = Number(Slider(137.1, range=0..200))
arm_gap = Number(num)
k_add_back = Number(addition_2)

backtrolley_offset_start = Number(division)
backtrolley_offset_end = Number(division)
rad = Radians(Degrees=arm_start_degrees)
backtrolley_bottom_diff = Number(backtrolley_bottom_vertical_diff)
fronttrolley_top_diff_2 = Number(fronttrolley_top_diff)
division_2 = Division(A=shelf_vertical_clearance, B="2")
multiplication = Multiplication(A=backtrolley_bottom_vertical_diff, B=-1)
abs = Absolute(Value=rad)
shelf_width_3 = Number(shelf_width_2)
k_add_back_2 = Number(k_add_back)
middle_l_to_top_l_drop_down = Number(division_2)
k_add_back_3 = Number(k_add_back_2)
subtraction_3 = Subtraction(A=shelf_width_3, B=backtrolley_offset_start)
k_add_front_3 = Number(k_add_front_2)
merge = Merge(Data1=fronttrolley_top_diff_2, Data2=multiplication)
shelf_width_4 = Number(shelf_width_2)
k_add_back_4 = Number(k_add_back_2)
k_add_front_4 = Number(k_add_front_2)
g_gamma = Number(abs)
arm_width_3 = Number(arm_width_2)
subtraction_4 = Subtraction(A=fronttrolley_offset_start, B=k_add_back_3)
subtraction_5 = Subtraction(A=subtraction_3, B=k_add_front_3)
multiplication_2 = Multiplication(A=shelf_width_3, B="2")
subtraction_6 = Subtraction(A=fronttrolley_offset_end, B=shelf_width_3)
arm_calc = CSharpScript(
    s=shelf_width_4,
    h=middle_l_to_top_l_drop_down,
    g=g_gamma,
    w=arm_width_3,
    ag=arm_gap,
    ac=arm_floor_clearance,
    ka_back=k_add_back_4,
    ka_front=k_add_front_4)  # -> out, A, R, K, J, L_height, L_width, TopShelf_height, MiddleShelf_height, BottomShelf_height; inputs s: Double, h: Double, g: Double, w: Double, ag: Double, ac: Double, ka_back: Double, ka_front: Double
# ---------- arm_calc: C# ----------
    // Where
    // s = shelf width
    // h = height of top shelf to height of middle shelf, in table position
    // g = starting angle of arms in shelf position

    double a = 0;
    double r = 0;
    if (h == 0)
    {
      r = s / (Math.Sin(g) + 1);
    }
    else
    {
      // https://www.wolframalpha.com/input?i=solve+cos%28a%29%3D%28s*sin%28a%29%29%2Fh+-+sin%28g%29+for+a

      // Copied from Wolfram Alpha with additions to make it valid for an Expression component:
      //2*(atan((s-sqrt(h^2*(-(sin(g)^2))+h^2+s^2))/(h*(sin(g)-1))))
      a = 2 * (Math.Atan((s - Math.Sqrt(Math.Pow(h, 2) * (-(Math.Pow(Math.Sin(g), 2))) + Math.Pow(h, 2) + Math.Pow(s, 2))) / (h * (Math.Sin(g) - 1))));
      r = h / Math.Sin(a);
    }

    // k = X offset from edge of shelf of the middle L's higher point to enable the starting angle of the arm to be g
    // j = vertical height of the arm at starting/rest position (will be equal to r when g = 0
    double k = r * Math.Sin(g);
    double j = r * Math.Cos(g);

    //double lh = (w + ag) / Math.Cos(a) + r * Math.Sin(a);
    double lh = (w + ag) / Math.Cos(a) + (s - (ka_back + ka_front) - k) * Math.Tan(a);
    double th = ac + (w / 2) + lh + r + h;

    TopShelf_height = th - h + j + 2 * h;
    MiddleShelf_height = th;
    BottomShelf_height = th - j;

    L_width = s - 2 * k - (ka_back + ka_front);
    L_height = lh;
    A = a;
    R = r;
    K = k;
    J = j;
# ---------- end arm_calc ----------
merge_2 = Merge(Data1=subtraction_4, Data2=subtraction_5)
k_add_front_5 = Number(k_add_front_2)
k_add_back_5 = Number(k_add_back_2)
subtraction_7 = Subtraction(A=multiplication_2, B=backtrolley_offset_end)
num_3 = Number(arm_gap)
floor_wall_corner_point_2 = Point(floor_wall_corner_point)
subtraction_8 = Subtraction(A=subtraction_6, B=k_add_back_5)
subtraction_9 = Subtraction(A=subtraction_7, B=k_add_front_5)
arm_angle_x_component = Number(arm_calc.K)
middle_l_to_top_l_drop_down_2 = Number(middle_l_to_top_l_drop_down)
deg = Degrees(Radians=arm_calc.A)
arm_length = Number(arm_calc.R)
arm_angle_x_component_2 = Number(arm_calc.K)
arm_angle_x_component_k = Number(arm_angle_x_component_2)
middle_to_top_rotation_vertical = Number(arm_calc.J)
top_shelf_height = Number(arm_calc.TopShelf_height)
bottom_shelf_height = Number(arm_calc.BottomShelf_height)
merge_3 = Merge(Data1=subtraction_8, Data2=subtraction_9)
arm_final_angle = Number(arm_calc.A)
arm_final_angle_alpha = Number(arm_final_angle)
l_height = Number(arm_calc.L_height)
l_width = Number(arm_calc.L_width)
table_height = Number(arm_calc.MiddleShelf_height)
g_gamma_2 = Number(g_gamma)
table_height_2 = Number(table_height)
pdecon = Deconstruct(Point=floor_wall_corner_point_2)  # -> XComponent, YComponent, ZComponent
trolleyarm_calc = CSharpScript(x1=merge_2, x2=merge_3, d_tr=merge, k=arm_angle_x_component, a=arm_final_angle_alpha, g=g_gamma_2)  # -> out, ArmLength, PusherLength; inputs x1: Double, x2: Double, d_tr: Double, k: Double, a: Double, g: Double
# ---------- trolleyarm_calc: C# ----------
    // Note p = rm, x = x1, y = x2 (renamed when entering into WolframAlpha to avoid possible parsing issues by WA

    // Where
    // x1 = start distance of centre of trolley leg relative to back edge of central unit
    // x2 = end distance of centre of trolley leg relative to back edge of central unit
    // g = angle of starting angle of main (left) arm
    // a = end angle relative to horizontal of arm in table position
    // rm = distance along main arm to position hinge for trolley pusher
    // m = length of trolley pusher

    //https://www.wolframalpha.com/input?i=solve+%28x-k%2Bp*sin%28g%29%29%5E2%2B%28p*cos%28g%29-d%29%5E2%3D%28y-p*cos%28a%29-k%29%5E2%2B%28p*sin%28a%29%2Bd%29%5E2+for+p
    // Plain text from WolframAlpha:
    //p = (-2 k x + 2 k y + x^2 - y^2)/(2 (d sin(a) + k sqrt(-sin^2(a) + sin^2(g) + cos^2(g)) - y sqrt(-sin^2(a) + sin^2(g) + cos^2(g)) + d cos(g) + k sin(g) - x sin(g)))
    double rm = (-2 * k * x1 + 2 * k * x2 + Math.Pow(x1, 2) - Math.Pow(x2, 2))
      / (2 * (d_tr * Math.Sin(a) + k * Math.Sqrt(-Math.Pow(Math.Sin(a), 2) + Math.Pow(Math.Sin(g), 2) + Math.Pow(Math.Cos(g), 2)) 
          - x2 * Math.Sqrt(-Math.Pow(Math.Sin(a), 2) + Math.Pow(Math.Sin(g), 2) + Math.Pow(Math.Cos(g), 2)) 
          + d_tr * Math.Cos(g) + k * Math.Sin(g) - x1 * Math.Sin(g)));
    double m = Math.Sqrt(Math.Pow(x1 - k + rm * Math.Sin(g), 2) + Math.Pow(rm * Math.Cos(g) - d_tr, 2));

    ArmLength = rm;
    PusherLength = m;
# ---------- end trolleyarm_calc ----------
subtraction_10 = Subtraction(A=table_height_2, B=middle_l_to_top_l_drop_down_2)
addition_3 = Addition(A=pdecon.XComponent, B=arm_angle_x_component_k)
addition_4 = Addition(A=deg, B="90")
k_add_back_6 = Number(k_add_back)
pt_2 = ConstructPoint(XCoordinate=addition_3, YCoordinate=subtraction_10, ZCoordinate=0)
vec = VectorXYZ(XComponent=k_add_back_6, YComponent=0, ZComponent=0)  # -> Vector, Length
arm_angle_x_component_k_2 = Number(arm_angle_x_component_2)
k_add_back_7 = Number(k_add_back_2)
addition_5 = Addition(A=vec.Vector, B=pt_2)
item = ListItem(List=trolleyarm_calc.ArmLength, Index=0, Wrap=True)  # -> Item, Item1
item_2 = ListItem(List=trolleyarm_calc.PusherLength, Index=0, Wrap=True)  # -> Item, Item1
multiplication_3 = Multiplication(A=arm_angle_x_component_k_2, B="2")
pdecon_2 = Deconstruct(Point=addition_5)  # -> XComponent, YComponent, ZComponent
l_width_2 = Number(l_width)
l_height_2 = Number(l_height)
l_width_3 = Number(l_width)
arm_angle_x_component_k_3 = Number(arm_angle_x_component_2)
middle_l_to_top_l_drop_down_3 = Number(middle_l_to_top_l_drop_down)
top_shelf_height_2 = Number(top_shelf_height)
multiplication_4 = Multiplication(A=middle_l_to_top_l_drop_down_2, B="2")
bottom_shelf_height_2 = Number(bottom_shelf_height)
addition_6 = Addition(A=k_add_back_7, B=arm_angle_x_component_k_2)
addition_7 = Addition(A=k_add_back_7, B=multiplication_3)
arm_length_2 = Number(arm_length)
table_height_3 = Number(table_height)
backtrolley_bottom_diff_2 = Number(backtrolley_bottom_diff)
fronttrolley_top_diff_3 = Number(fronttrolley_top_diff_2)
addition_8 = Addition(A=l_width_3, B=pdecon_2.XComponent)
subtraction_11 = Subtraction(A=pdecon_2.YComponent, B=l_height_2)
floor_wall_corner_point_3 = Point(floor_wall_corner_point)
shelf_width_5 = Number(shelf_width_2)
arm_start_degrees_2 = Number(arm_start_degrees)
arm_width_4 = Number(arm_width_2)
pt_3 = ConstructPoint(XCoordinate=addition_8, YCoordinate=subtraction_11, ZCoordinate=0)
middle_platform_vertical_offset = Number(middle_l_to_top_l_drop_down_3)

fronttrolley_arm_length = Number(item.Item)
fronttrolley_pusher_length = Number(item_2.Item)
backtrolley_arm_length = Number(item.Item1)
backtrolley_pusher_length = Number(item_2.Item1)
floor_wall_corner_point_4 = Point(floor_wall_corner_point_3)
fronttrolley_top_diff_4 = Number(fronttrolley_top_diff_3)
backtrolley_bottom_diff_3 = Number(backtrolley_bottom_diff_2)
arm_start_degrees_3 = Number(arm_start_degrees_2)
bottom_shelf_height_3 = Number(bottom_shelf_height_2)
middle_l_left_point = Point(addition_5)
arm_end_degrees = Number(addition_4)
shelf_width_6 = Number(shelf_width_5)
middle_l_right_point = Point(pt_3)
l_points_height = Number(l_height_2)
arm_width_5 = Number(arm_width_4)
xoffsetpershelf = Number(arm_angle_x_component_k_3)
l_points_width = Number(l_width_2)
top_shelf_height_3 = Number(top_shelf_height_2)
arm_length_3 = Number(arm_length_2)

bottom_platform_x_offset = Number(addition_7)
top_platform_vertical_offset = Number(multiplication_4)
middle_platform_x_offset = Number(addition_6)
top_platform_x_offset = Number(k_add_back_7)
middle_shelf_height = Number(table_height_3)
arm_gap_2 = Number(num_3)
entwine = Entwine(Branch00=rotation, Branch01="0", Branch02="100", FlattenInputs=True)  # -> simplify(Result)

# ---- group: Mirror plane
shelflength_2 = Number(shelflength)
division_3 = Division(A=shelflength_2, B="2")
floor_wall_corner_point_5 = Point(floor_wall_corner_point_4)
Y = UnitY(Factor=division_3)
addition_9 = Addition(A=Y, B=floor_wall_corner_point_5)
xz = XZPlane(Origin=addition_9)
mirrorplane = Plane(xz)

# ----
number_slider_2 = Slider(12, range=0..20)
experimental_middle_section_3 = Boolean(experimental_middle_section_2)
experimental_middle_section_4 = Boolean(experimental_middle_section_2)
slidelengths_2 = Number(slidelengths)
xz_2 = XZPlane(Origin=Point(0, 0, 0))
jagged = SettingsSpeed()
jagged_2 = SettingsSpeed()
jagged_3 = SettingsSpeed()
jagged_4 = SettingsSpeed()
jagged_5 = SettingsSpeed()
swatch = ColourSwatch(SwatchColor=RGB(207, 225, 255))
swatch_2 = ColourSwatch(SwatchColor=RGB(116, 191, 247))

# ----
# These offsets include both k and k_add
# This script is run twice, for front and back trolleys
floor_wall_corner_point_6 = Point(floor_wall_corner_point_4)
slidelengths_3 = Number(slidelengths)
fronttrolley_arm_length_2 = Number(fronttrolley_arm_length)
fronttrolley_pusher_length_2 = Number(fronttrolley_pusher_length)
fronttrolleypushershapedeviationparallel_2 = Number(fronttrolleypushershapedeviationparallel)  # "FrontTrolleyPusherShapeDeviationParallelDistance"
backtrolleypushershapedeviationparalleld_2 = Number(backtrolleypushershapedeviationparalleld)  # "BackTrolleyPusherShapeDeviationParallelDistance"
fronttrolleypushershapedeviationperpdist_2 = Number(fronttrolleypushershapedeviationperpdist)  # "FrontTrolleyPusherShapeDeviationPerpDistance"
middle_l_left_point_2 = Point(middle_l_left_point)
middle_l_right_point_2 = Point(middle_l_right_point)
backtrolley_arm_length_2 = Number(backtrolley_arm_length)
fronttrolley_top_diff_5 = Number(fronttrolley_top_diff_4)
backtrolley_bottom_diff_4 = Number(backtrolley_bottom_diff_3)
backtrolley_pusher_length_2 = Number(backtrolley_pusher_length)
backtrolleypushershapedeviationperpdista_2 = Number(backtrolleypushershapedeviationperpdista)  # "BackTrolleyPusherShapeDeviationPerpDistance"
top_platform_x_offset_2 = Number(top_platform_x_offset)
middle_platform_x_offset_2 = Number(middle_platform_x_offset)
bottom_platform_x_offset_2 = Number(bottom_platform_x_offset)
rotationpercentage = Number(entwine)
arm_end_degrees_2 = Number(arm_end_degrees)
arm_length_4 = Number(arm_length_3)
l_points_height_2 = Number(l_points_height)
l_points_width_2 = Number(l_points_width)
top_platform_offset = Number(top_platform_vertical_offset)
middle_platform_vertical_offset_2 = Number(middle_l_to_top_l_drop_down)
arm_start_degrees_4 = Number(arm_start_degrees_3)
shelf_width_7 = Number(shelf_width_6)
wheelheight_2 = Number(wheelheight)
arm_width_6 = Number(arm_width_5)
bottom_platform_vertical_offset = Number("0")
create_ls_rotating_arms = CSharpScript(
    RotationPercentage=rotationpercentage,
    ArmStartDegrees=arm_start_degrees_4,
    ArmEndDegrees=arm_end_degrees_2,
    ArmLength=arm_length_4,
    LPointsHeight=l_points_height_2,
    LPointsWidth=l_points_width_2,
    MiddleLPointLeft=middle_l_left_point_2,
    MiddleLPointRight=middle_l_right_point_2)  # -> out, TopL, MiddleL, BottomL, RotatingArmLeft, RotatingArmRight, CurrentAngleRadians, RotationAxisLeft, RotationAxisRight; inputs RotationPercentage: Double, ArmStartDegrees: Double, ArmEndDegrees: Double, ArmLength: Double, LPointsHeight: Double, LPointsWidth: Double, MiddleLPointLeft: Point3d, MiddleLPointRight: Point3d
# ---------- create_ls_rotating_arms: C# ----------
    double degrees = ArmStartDegrees + (ArmEndDegrees - ArmStartDegrees) / 100 * RotationPercentage;
    double radians = degrees * Math.PI / 180;
    Vector3d vInitialMiddlePointToEdge = new Vector3d(0, ArmLength, 0);
    Vector3d vLeftToRightForL_X = new Vector3d(MiddleLPointRight.X - MiddleLPointLeft.X, 0, 0);
    Vector3d vLeftToRightForL = new Vector3d(MiddleLPointRight.X - MiddleLPointLeft.X, MiddleLPointRight.Y - MiddleLPointLeft.Y, 0);

    LineCurve armLeft = new LineCurve(MiddleLPointLeft + vInitialMiddlePointToEdge, MiddleLPointLeft - vInitialMiddlePointToEdge);
    armLeft.Rotate(radians, Vector3d.ZAxis * -1, MiddleLPointLeft);
    LineCurve armRight = new LineCurve(MiddleLPointRight + vInitialMiddlePointToEdge, MiddleLPointRight - vInitialMiddlePointToEdge);
    armRight.Rotate(radians, Vector3d.ZAxis * -1, MiddleLPointRight);

    TopL = new PolylineCurve(new List<Point3d> { armLeft.PointAtStart, armLeft.PointAtStart + vLeftToRightForL_X, armLeft.PointAtStart + vLeftToRightForL });
    MiddleL = new PolylineCurve(new List<Point3d> { MiddleLPointLeft, MiddleLPointLeft + vLeftToRightForL_X, MiddleLPointLeft + vLeftToRightForL });
    BottomL = new PolylineCurve(new List<Point3d> { armLeft.PointAtEnd, armLeft.PointAtEnd + vLeftToRightForL_X, armLeft.PointAtEnd + vLeftToRightForL });

    RotatingArmLeft = armLeft;
    RotatingArmRight = armRight;
    CurrentAngleRadians = radians;
    RotationAxisLeft = new Line(MiddleLPointLeft, MiddleLPointLeft + Vector3d.ZAxis * -1);
    RotationAxisRight = new Line(MiddleLPointRight, MiddleLPointRight + Vector3d.ZAxis * -1);
# ---------- end create_ls_rotating_arms ----------
merge_4 = Merge(Data1=top_platform_x_offset_2, Data2=middle_platform_x_offset_2, Data3=bottom_platform_x_offset_2)
merge_5 = Merge(Data1=top_platform_offset, Data2=middle_platform_vertical_offset_2, Data3=bottom_platform_vertical_offset)
panel_5 = Panel("""1
-1""")
platform_width = Number(shelf_width_7)
merge_6 = Merge(Data1=create_ls_rotating_arms.RotationAxisLeft, Data2=create_ls_rotating_arms.RotationAxisRight)
merge_7 = Merge(Data1=middle_l_left_point_2, Data2=middle_l_right_point_2)
merge_8 = Merge(Data1=fronttrolley_arm_length_2, Data2=backtrolley_arm_length_2)
merge_9 = Merge(Data1=fronttrolley_top_diff_5, Data2=backtrolley_bottom_diff_4)
merge_10 = Merge(Data1=fronttrolley_pusher_length_2, Data2=backtrolley_pusher_length_2)
merge_11 = Merge(Data1=fronttrolleypushershapedeviationparallel_2, Data2=backtrolleypushershapedeviationparalleld_2)
merge_12 = Merge(Data1=fronttrolleypushershapedeviationperpdist_2, Data2=backtrolleypushershapedeviationperpdista_2)
division_4 = Division(A=arm_width_6, B="2")
bottom_l = Curve(create_ls_rotating_arms.BottomL)
mid_l = Curve(create_ls_rotating_arms.MiddleL)
top_l = Curve(create_ls_rotating_arms.TopL)
Y_2 = UnitY(Factor=division_4)
merge_13 = Merge(Data1=top_l, Data2=mid_l, Data3=bottom_l)
merge_14 = Merge(Data1=create_ls_rotating_arms.RotatingArmLeft, Data2=create_ls_rotating_arms.RotatingArmRight)
create_trolley_lines = CSharpScript(
    CurrentAngleRadians=create_ls_rotating_arms.CurrentAngleRadians,
    RotationAxis=merge_6,
    MiddleLPoint=merge_7,
    LengthAlongArmToPusher=merge_8,
    TopDiff=merge_9,
    PusherLength=merge_10,
    DeviationParallelDistance=merge_11,
    DeviationPerpDistance=merge_12,
    Direction=panel_5,
    FloorWallCornerPoint=floor_wall_corner_point_6,
    WheelHeight=wheelheight_2)  # -> out, TrolleyPusher, TrolleyVertical, Test; inputs CurrentAngleRadians: Double, RotationAxis: Line, MiddleLPoint: Point3d, LengthAlongArmToPusher: Double, TopDiff: Double, PusherLength: Double, DeviationParallelDistance: Double, DeviationPerpDistance: Double, Direction: Int32, FloorWallCornerPoint: Point3d, WheelHeight: Double
# ---------- create_trolley_lines: C# usings ----------
using System.Linq;
# ---------- create_trolley_lines: C# ----------
    Point3d leftPtL = MiddleLPoint;
    int dir = Direction / Math.Abs(Direction);

    LineCurve centreToPusherStart = new LineCurve(leftPtL, leftPtL + Vector3d.YAxis * LengthAlongArmToPusher * dir);
    centreToPusherStart.Rotate(CurrentAngleRadians, RotationAxis.Direction, leftPtL);

    double lowY = WheelHeight;

    //    int longestSlideIndex = SlideLengths.IndexOf(SlideLengths.Max());
    //    int shortestSlideIndex = (longestSlideIndex == 0) ? 1 : 0;
    //    bool widerSlideBelow = (DrawerSlideMidLineElevations[longestSlideIndex] < DrawerSlideMidLineElevations[shortestSlideIndex]);
    //
    //    if (widerSlideBelow)
    //    {
    //      lowY = DrawerSlideMidLineElevations[longestSlideIndex] + ArmWidth / 2 + FingerGap;
    //    }

    double pusherEndY = leftPtL.Y + TopDiff;
    Line horizontalLineForIntersection = new Line(Pt(leftPtL.X, pusherEndY), Pt(centreToPusherStart.PointAtEnd.X + PusherLength * dir, pusherEndY));
    Circle circleForIntersection = new Circle(Plane.WorldXY, centreToPusherStart.PointAtEnd, PusherLength);
    Point3d[] horizontalLineForIntersectionEndPts = (new [] { horizontalLineForIntersection.From, horizontalLineForIntersection.To }).OrderBy(p => p.X).ToArray();

    Point3d intPt1, intPt2;
    double t1, t2;
    Rhino.Geometry.Intersect.Intersection.LineCircle(horizontalLineForIntersection, circleForIntersection, out t1, out intPt1, out t2, out intPt2);
    Point3d pusherVerticalPivotPoint;

    if (intPt1 != null && intPt2 == null) pusherVerticalPivotPoint = intPt1;
    else if (intPt1 == null && intPt2 != null) pusherVerticalPivotPoint = intPt2;
    else
    {
      var eligible = (new [] { intPt1, intPt2 })
        .Where(p => p.X >= horizontalLineForIntersectionEndPts[0].X && p.X <= horizontalLineForIntersectionEndPts[1].X).ToList();

      pusherVerticalPivotPoint = (dir == 1) ? eligible.First() : eligible.Last();
    }

    Line pusherLine = new Line(centreToPusherStart.PointAtEnd, pusherVerticalPivotPoint);
    Vector3d vPusher = new Vector3d(pusherLine.Direction);
    vPusher.Unitize();
    Vector3d vPusherPerp = new Vector3d(-vPusher.Y, vPusher.X, 0);

    Point3d[] pusherPts = new Point3d[] {
      centreToPusherStart.PointAtEnd,
      centreToPusherStart.PointAtEnd + vPusher * DeviationParallelDistance + vPusherPerp * DeviationPerpDistance,
      pusherVerticalPivotPoint
      };

    TrolleyPusher = new PolylineCurve(pusherPts);
    TrolleyVertical = new LineCurve(pusherVerticalPivotPoint, Pt(pusherVerticalPivotPoint.X, lowY));

    Test = new List<object>() { horizontalLineForIntersection, circleForIntersection };
# ---------- create_trolley_lines: C# additional code ----------
  private Point3d Pt(double x, double y)
  {
    return new Point3d(x, y, 0);
  }
# ---------- end create_trolley_lines ----------
create_shelf_platform = CSharpScript(xOffset=merge_4, Width=platform_width, Height=merge_5, L=merge_13)  # -> out, Platform, PlatformRiser; inputs xOffset: Double, Width: Double, Height: Double, L: Curve
# ---------- create_shelf_platform: C# ----------
    var ptStartL = L.PointAtStart;
    var ptEndL = L.PointAtEnd;

    var startX = Math.Min(ptStartL.X, ptEndL.X) - xOffset;
    var endX = startX + Width;
    var midX = startX + (Width / 2);
    var startY = Math.Max(ptStartL.Y, ptEndL.Y);
    var endY = startY + Height;

    List<LineCurve> platformCurves = new List<LineCurve>();

    if (Height > 0)
    {
      PlatformRiser = new LineCurve(new Point3d(midX, startY, 0), new Point3d(midX, endY, 0));
    }

    Platform = new LineCurve(new Point3d(startX, endY, 0), new Point3d(endX, endY, 0));
# ---------- end create_shelf_platform ----------
move = Move(Geometry=create_shelf_platform.Platform, Motion=Y_2)  # -> Geometry, Transform
item_3 = ListItem(List=create_trolley_lines.TrolleyVertical, Index=0, Wrap=True)  # -> Item, Item1
item_4 = ListItem(List=create_trolley_lines.TrolleyPusher, Index=0, Wrap=True)  # -> Item, Item1
bang = ExplodeTree(Data=create_shelf_platform.Platform)  # -> Branch0, Branch1, Branch2
bang_2 = ExplodeTree(Data=move.Geometry)  # -> Branch0, Branch1, Branch2
bang_3 = ExplodeTree(Data=item_4.Item)  # -> Branch0, Branch1, Branch2
bang_4 = ExplodeTree(Data=item_4.Item1)  # -> Branch0, Branch1, Branch2
bang_5 = ExplodeTree(Data=item_3.Item)  # -> Branch0, Branch1, Branch2
bang_6 = ExplodeTree(Data=item_3.Item1)  # -> Branch0, Branch1, Branch2
bang_7 = ExplodeTree(Data=merge_13)  # -> Branch0, Branch1, Branch2
bang_8 = ExplodeTree(Data=merge_14)  # -> Branch0, Branch1, Branch2
platforms_real_top_surfaces = Curve(bang_2.Branch0)
initial_front_trolley_pusher = Curve(bang_3.Branch1)
initial_front_trolley_vertical = Curve(bang_5.Branch1)
initial_back_trolley_vertical = Curve(bang_6.Branch1)
initial_back_trolley_pusher = Curve(bang_4.Branch1)
final_back_trolley_pusher = Curve(bang_4.Branch2)
initial_rotating_arms = Curve(bang_8.Branch1)
front_trolley_pusher = Curve(bang_3.Branch0)
final_rotating_arms = Curve(bang_8.Branch2)
front_trolley_vertical = Curve(bang_5.Branch0)
back_trolley_vertical = Curve(bang_6.Branch0)
back_trolley_pusher = Curve(bang_4.Branch0)
rotating_arms = Curve(bang_8.Branch0)
platformlines = Curve(bang.Branch0)
ls = Curve(bang_7.Branch0)
initial_ls = Curve(bang_7.Branch1)
final_ls = Curve(bang_7.Branch2)

lng = ListLength(List=merge_13)
division_5 = Division(A=lng, B="2")
int = Integer(division_5)
subtraction_12 = Subtraction(A=int, B="1")

item_5 = ListItem(List=move.Geometry, Index=subtraction_12, Wrap=True)
middle_section = CSharpScript(MiddlePlatform=item_5, WheelHeight=wheelheight_2, SlideLengths=slidelengths_3)  # -> out, Pl; inputs MiddlePlatform: Curve, WheelHeight: Double, SlideLengths: list of Double
# ---------- middle_section: C# ----------
    double minX = Math.Min(MiddlePlatform.PointAtStart.X, MiddlePlatform.PointAtEnd.X);
    double[] xs = new double[2] { minX, minX + SlideLengths.Max() };
    double[] ys = new double[2] { WheelHeight, MiddlePlatform.PointAtStart.Y};    
    
    List<Point3d> pts = new List<Point3d>()
      { Pt(xs[0], ys[0]), Pt(xs[0], ys[1]), Pt(xs[1], ys[1]), Pt(xs[1], ys[0]), Pt(xs[0], ys[0]) };
    
    Pl = new PolylineCurve(pts);
# ---------- middle_section: C# additional code ----------
  Point3d Pt(double x, double y)
  {
    return new Point3d(x, y, 0);
  }
# ---------- end middle_section ----------
bang_9 = ExplodeTree(Data=middle_section.Pl)  # -> Branch0, Branch1, Branch2
initial_middle_section_outline = Curve(bang_9.Branch1)
middle_section_outline = Curve(bang_9.Branch0)

item_6 = ListItem(List=rotating_arms, Index=0, Wrap=True)  # -> Item, Item1

initial_back_trolley_pusher_2 = Curve(initial_back_trolley_pusher)
initial_front_trolley_vertical_2 = Curve(initial_front_trolley_vertical)
slidelengths_4 = Number(slidelengths)
supportbeamsnormalisedxsalongl_2 = Number(supportbeamsnormalisedxsalongl)
initial_middle_section_outline_2 = Curve(initial_middle_section_outline)
initial_ls_2 = Curve(initial_ls)
initial_rotating_arms_2 = Curve(initial_rotating_arms)
initial_front_trolley_pusher_2 = Curve(initial_front_trolley_pusher)
initial_back_trolley_vertical_2 = Curve(initial_back_trolley_vertical)
armpivotholediameter_2 = Number(armpivotholediameter)
drawerslidemidlineelevations_2 = Number(drawerslidemidlineelevations)
supportbeamheights_2 = Number(supportbeamheights)
arm_width_7 = Number(arm_width_5)
platformmaterialthickness_2 = Number(platformmaterialthickness)
fingergap_2 = Number(fingergap)
armmaterialthickness_2 = Number(armmaterialthickness)
new_middle_unit = CSharpScript(
    MiddleSectionOutline=initial_middle_section_outline_2,
    Ls=initial_ls_2,
    RotatingArms=initial_rotating_arms_2,
    FrontTrolleyPusher=initial_front_trolley_pusher_2,
    BackTrolleyPusher=initial_back_trolley_pusher_2,
    FrontTrolleyVertical=initial_front_trolley_vertical_2,
    BackTrolleyVertical=initial_back_trolley_vertical_2,
    ArmPivotHoleDiameter=armpivotholediameter_2,
    DrawerSlideMidLineElevations=drawerslidemidlineelevations_2,
    SlideLengths=slidelengths_4,
    SupportBeamsNormalisedXsAlongL=supportbeamsnormalisedxsalongl_2,
    SupportBeamHeights=supportbeamheights_2,
    ArmWidth=arm_width_7,
    PlatformMaterialThickness=platformmaterialthickness_2,
    FingerGap=fingergap_2,
    ArmMaterialThickness=armmaterialthickness_2,
    n="2")  # -> out, Outline, Test, n_out; inputs MiddleSectionOutline: Polyline, Ls: list of Curve, RotatingArms: list of Curve, FrontTrolleyPusher: Curve, BackTrolleyPusher: Curve, FrontTrolleyVertical: Curve, BackTrolleyVertical: Curve, ArmPivotHoleDiameter: Double, DrawerSlideMidLineElevations: list of Double, SlideLengths: list of Double, SupportBeamsNormalisedXsAlongL: list of Double, SupportBeamHeights: list of Double, ArmWidth: Double, PlatformMaterialThickness: Double, FingerGap: Double, ArmMaterialThickness: Double, n: Int32
# ---------- new_middle_unit: C# ----------
    double tol = 0.01;

    Point3d[] backVerticalPts = (new [] { BackTrolleyVertical.PointAtStart, BackTrolleyVertical.PointAtEnd }).OrderBy(p => p.X).ToArray();
    Point3d[] frontVerticalPts = (new [] { FrontTrolleyVertical.PointAtStart, FrontTrolleyVertical.PointAtEnd }).OrderBy(p => p.X).ToArray();
    Point3d[] backPusherPts = (new [] { BackTrolleyPusher.PointAtStart, BackTrolleyPusher.PointAtEnd }).OrderBy(p => p.X).ToArray();
    Point3d[] frontPusherPts = (new [] { FrontTrolleyPusher.PointAtStart, FrontTrolleyPusher.PointAtEnd }).OrderBy(p => p.X).ToArray();

    double columnLeftX = backPusherPts[1].X + FingerGap + ArmWidth / 2;
    double columnRightX = MiddleSectionOutline.Max(p => p.X) - ArmMaterialThickness - FingerGap;
    double topY = MiddleSectionOutline.Max(p => p.Y);
    double lowerY = MiddleSectionOutline.Min(p => p.Y);
    double minX = MiddleSectionOutline.Min(p => p.X);

    Vector3d vFrontPusher = (new Line(frontPusherPts[0], frontPusherPts[1])).Direction;
    vFrontPusher.Unitize();

    Vector3d vFrontPusherPerp = new Vector3d(vFrontPusher.Y, -vFrontPusher.X, 0);
    Point3d frontPusherParallelStart = frontPusherPts[0] + (FingerGap + (ArmWidth / 2)) * vFrontPusherPerp;

    Vector3d vBackPusher = (new Line(backPusherPts[0], backPusherPts[1])).Direction;
    vBackPusher.Unitize();

    Vector3d vBackPusherPerp = new Vector3d(-vBackPusher.Y, vBackPusher.X, 0);
    Point3d backPusherParallelStart = backPusherPts[0] + (FingerGap + (ArmWidth / 2)) * vBackPusherPerp;

    Print("backPusherPts[0] = " + backPusherPts[0].ToString());
    Print("vBackPusher = " + vBackPusher.ToString());
    Print("vBackPusherPerp = " + vBackPusherPerp.ToString());

    Test = new Line(frontPusherPts[0], frontPusherPts[0] + vFrontPusherPerp);

    List<Point3d> pts = new List<Point3d>()
      {
        GetIntersectingPoint(new Line(backPusherParallelStart, vBackPusher), new Line(Pt(minX, lowerY), Pt(minX, topY)), tol),
        Pt(minX, topY),
        GetIntersectingPoint(new Line(frontPusherParallelStart, vFrontPusher), new Line(Pt(minX, topY), Pt(columnRightX, topY)), tol),
        GetIntersectingPoint(new Line(frontPusherParallelStart, vFrontPusher), new Line(Pt(columnRightX, topY), Pt(columnRightX, lowerY)), tol),
        Pt(columnRightX, lowerY),
        Pt(columnLeftX, lowerY),
        GetIntersectingPoint(new Line(backPusherParallelStart, vBackPusher), new Line(Pt(columnLeftX, lowerY), Pt(columnLeftX, topY)), tol)
        };
    pts.Add(pts.First());

    int backSlideIndex = SlideLengths.IndexOf(SlideLengths.Max());
    int frontSlideIndex = SlideLengths.IndexOf(SlideLengths.Min());
    Polyline backSlideRect = (new Rhino.Geometry.Rectangle3d(
      new Plane(Pt(minX, Math.Max(lowerY, DrawerSlideMidLineElevations[backSlideIndex] - ArmWidth / 2)), Vector3d.ZAxis),
      SlideLengths[backSlideIndex], ArmWidth)).ToPolyline();
    Polyline frontSlideRect = (new Rhino.Geometry.Rectangle3d(
      new Plane(Pt(columnRightX, Math.Max(lowerY, DrawerSlideMidLineElevations[frontSlideIndex] - ArmWidth / 2)), Vector3d.ZAxis),
      -SlideLengths[frontSlideIndex], ArmWidth)).ToPolyline();

    Outline = Curve.CreateBooleanUnion(new [] { new PolylineCurve(pts), backSlideRect.ToPolylineCurve(), frontSlideRect.ToPolylineCurve()}, tol);
# ---------- new_middle_unit: C# additional code ----------
  private Point3d Pt(double x, double y)
  {
    return new Point3d(x, y, 0);
  }

  private Point3d GetIntersectingPoint(Line l1, Line l2, double tol, bool finiteOnly = false)
  {
    double a, b;
    Rhino.Geometry.Intersect.Intersection.LineLine(l1, l2, out a, out b, tol, finiteOnly);
    return l1.PointAt(a);
  }
# ---------- end new_middle_unit ----------
expression_3 = Expression(t=armmaterialthickness_2, n="2", g=fingergap_2, Expression="n*(t + g)")
Y_3 = UnitY(Factor=armmaterialthickness_2)
X = UnitX(Factor=1)
Z = UnitZ(Factor=1)
vec_2 = VectorXYZ(XComponent=0, YComponent=expression_3, ZComponent=0)  # -> Vector, Length
rev = Reverse(Vector=Y_3)
rev_2 = Reverse(Vector=vec_2.Vector)

zigzag_polyline = CSharpScript(Dir1=X, Dir2=Z, Close="True")  # -> out, Pl; inputs StartPt: Point3d, ZigZags: list of Double, Dir1: Vector3d, Dir2: Vector3d, Mirror: Boolean, Close: Boolean
# ---------- zigzag_polyline: C# ----------
    if (StartPt == null) return;

    List<Point3d> pts = new List<Point3d>() { StartPt };

    List<double> zigZags = ZigZags.ToList();

    List<double> temp = zigZags.ToList();

    for (int i = 0; i < zigZags.Count; i++)
    {
      pts.Add(pts.Last() + zigZags[i] * (((i % 2) == 0) ? Dir1 : Dir2));
    }

    if (Mirror && ZigZags.Count >= 2)
    {
      int multiplier = -1;
      for (int i = (zigZags.Count - 2); i >= 0; i--)
      {
        pts.Add(pts.Last() + zigZags[i] * multiplier * (((i % 2) == 0) ? Dir1 : Dir2));
        multiplier *= -1;
        temp.Add(zigZags[i] * (((i % 2) == 0) ? 1 : -1));
      }
    }
    if (Close)
    {
      pts.Add(pts.First());
    }

    Print(string.Join(",", temp));
    Pl = new PolylineCurve(pts);
# ---------- end zigzag_polyline ----------
panel_6 = Panel(zigzag_polyline.out)
panel_7 = Panel(new_middle_unit.out)

crv = Curve(zigzag_polyline.Pl)
move_2 = Move(Geometry=zigzag_polyline.Pl, Motion=rev_2)  # -> Geometry, Transform
extr = Extrude(Base=move_2.Geometry, Direction=rev)
cap = CapHoles(Brep=extr)

middle_section_outline_2 = Curve(new_middle_unit.Outline)

# ---- group: Swerving front rotating arm
back_trolley_pusher_2 = Curve(back_trolley_pusher)
item_7 = ListItem(List=final_ls, Index="1", Wrap=True)
end = EndPoints(Curve=back_trolley_pusher_2)  # -> Start, End
end_2 = EndPoints(Curve=item_7)  # -> Start, End
pt_4 = Point(end.Start)
ln = Line(StartPoint=end_2.Start, EndPoint=end_2.End)
divide = DivideCurve(Curve=ln, Count="3", Kinks=False)  # -> Points, Tangents, Parameters
number_slider_3 = Slider(90, range=0..100)
item_8 = ListItem(List=divide.Points, Index=0, Wrap=True)  # -> Item, Item1, Item2
armmaterialthickness_3 = Number(armmaterialthickness)
arm_width_8 = Number(arm_width_5)
fingergap_3 = Number(fingergap)
crv_2 = Curve(item_6.Item1)
dist = Distance(PointA=item_8.Item1, PointB=item_8.Item2)
arm_start_degrees_5 = Number(arm_start_degrees_3)
end_3 = EndPoints(Curve=crv_2)  # -> Start, End
len = Length(Curve=crv_2)
expression_4 = Expression(d=dist, t=armmaterialthickness_3, g=fingergap_3, aw=arm_width_8, Expression="d+t+2*g+aw")
panel_8 = Panel("200")
expression_5 = Expression(a=number_slider_3, sd=arm_start_degrees_5, Expression="360-a+sd")
division_6 = Division(A=len, B=2)
vec2pt = Vector2Pt(PointA=end_3.Start, PointB=end_3.End, Unitize=True)  # -> Vector, Length
pt_5 = Point(end_3.Start)
entwine_2 = Entwine(Branch00="82", Branch01=expression_4, Branch02="82", FlattenInputs=True)  # -> flatten(Result)
merge_15 = Merge(Data1=number_slider_3, Data2=expression_5)

# ----
c_script = CSharpScript(StartPt=pt_5, StartDir=vec2pt.Vector, StartLength=division_6, RotationDegrees=merge_15, RemainingLengths=entwine_2)  # -> out, Polyline; inputs StartPt: Point3d, StartDir: Vector3d, Plane: Plane, StartLength: Double, RotationDegrees: list of Double, RemainingLengths: list of Double, Close: Boolean
# ---------- c_script: C# ----------
    double tol = 0.01;

    try
    {
      Plane plane = (Plane == Plane.Unset || Plane.Normal.Length < tol) ? Plane.WorldXY : Plane;

      Vector3d startDir = new Vector3d(StartDir);
      startDir.Unitize();

      // Notes:
      // - the rotation is always in counter-clockwise
      if (StartLength <= tol || StartDir.Length < tol) return;
      else if ((RotationDegrees == null && RemainingLengths == null)
        || (RotationDegrees == null && RemainingLengths != null)
        || (RotationDegrees != null && RemainingLengths == null))
      {
        Polyline = new LineCurve(StartPt, StartPt + startDir * StartLength);
        return;
      }

      var pts = new List<Point3d>() { StartPt, StartPt + (startDir * StartLength) };

      int numRemaining = Math.Min(RotationDegrees.Count, RemainingLengths.Count);

      Point3d prevPt = pts.Last();
      Vector3d prevDir = StartDir;
      for (int i = 0; i < numRemaining; i++)
      {
        var radians = RotationDegrees[i] * Math.PI / 180;
        var newDir = new Vector3d(prevDir);
        newDir.Rotate(radians, plane.Normal);
        newDir.Unitize();

        var newPt = prevPt + newDir * RemainingLengths[i];
        pts.Add(newPt);

        prevDir = newDir;
        prevPt = newPt;
      }

      if (Close)
      {
        pts.Add(pts.First());
      }
      Polyline = new PolylineCurve(pts);
    }
    catch(Exception ex)
    {
      Print(ex.Message);
    }
# ---------- end c_script ----------

# ---- group: Swerving front rotating arm (continued)
end_4 = EndPoints(Curve=c_script.Polyline)  # -> Start, End
merge_16 = Merge(Data1=end_4.End, Data2=pt_4, Data3=end_3.End)
pline = PolyLine(Vertices=merge_16, Closed=False)
merge_17 = Merge(Data1=pline, Data2=c_script.Polyline)
join = JoinCurves(Curves=merge_17, Preserve=False)
crv_3 = Curve(join)

# ---- group: Swerving back rotating arm
front_trolley_pusher_2 = Curve(front_trolley_pusher)
end_5 = EndPoints(Curve=front_trolley_pusher_2)  # -> Start, End
crv_4 = Curve(item_6.Item)
arm_end_degrees_3 = Number(arm_end_degrees)
pt_6 = Point(end_5.Start)
pt_7 = Point(end_5.End)
end_6 = EndPoints(Curve=crv_4)  # -> Start, End
subtraction_13 = Subtraction(A=arm_end_degrees_3, B="90")
expression_6 = Expression(d=subtraction_13, Expression="90 + d")
vec2pt_2 = Vector2Pt(PointA=end_6.Start, PointB=end_6.End, Unitize=True)  # -> Vector, Length
entwine_3 = Entwine(Branch00=Slider(24.8, range=0..30), Branch01=expression_4, FlattenInputs=True)  # -> flatten(Result)
dist_2 = Distance(PointA=end_6.Start, PointB=pt_6)
merge_18 = Merge(Data1="-90", Data2=expression_6)
middle_l_left_point_3 = Point(middle_l_left_point)
ln_2 = Line(StartPoint=middle_l_left_point_3, EndPoint=end_6.End)

# ----
c_script_2 = CSharpScript(StartPt=end_6.Start, StartDir=vec2pt_2.Vector, StartLength=dist_2, RotationDegrees=merge_18, RemainingLengths=entwine_3)  # -> out, Polyline; inputs StartPt: Point3d, StartDir: Vector3d, Plane: Plane, StartLength: Double, RotationDegrees: list of Double, RemainingLengths: list of Double, Close: Boolean; same code as c_script

# ---- group: Swerving back rotating arm (continued)
end_7 = EndPoints(Curve=c_script_2.Polyline)  # -> Start, End
ln_3 = Line(StartPoint=end_7.End, EndPoint=middle_l_left_point_3)
merge_19 = Merge(Data1=c_script_2.Polyline, Data2=ln_3, Data3=ln_2)
join_2 = JoinCurves(Curves=merge_19, Preserve=False)

# ----
panel_9 = Panel(c_script_2.out)
entwine_4 = Entwine(Branch00=join_2, Branch01=crv_3, FlattenInputs=True)  # -> flatten(Result)

middlesectionoutline = Curve(middle_section_outline_2)
middlesectionoutline_2 = Curve(middle_section_outline)
experimental_middle_section_5 = Boolean(experimental_middle_section_2)
back_trolley_vertical_2 = Curve(back_trolley_vertical)
floor_wall_corner_point_7 = Point(floor_wall_corner_point_4)
rotating_arms_2 = Curve(rotating_arms)
end_8 = EndPoints(Curve=back_trolley_vertical_2)  # -> Start, End
filter = StreamFilter(Gate=experimental_middle_section_5, Stream0=middlesectionoutline_2, Stream1=middlesectionoutline)
pdecon_3 = Deconstruct(Point=end_8.End)  # -> XComponent, YComponent, ZComponent
pdecon_4 = Deconstruct(Point=floor_wall_corner_point_7)  # -> XComponent, YComponent, ZComponent
middle_l_right_point_3 = Point(middle_l_right_point)
middle_l_left_point_4 = Point(middle_l_left_point)
platforms_real_top_surfaces_2 = Curve(platforms_real_top_surfaces)
front_trolley_vertical_2 = Curve(front_trolley_vertical)
front_trolley_pusher_3 = Curve(front_trolley_pusher)
back_trolley_pusher_3 = Curve(back_trolley_pusher)
platformlines_2 = Curve(platformlines)
pt_8 = ConstructPoint(XCoordinate=pdecon_3.XComponent, YCoordinate=pdecon_4.YComponent, ZCoordinate=0)
ls_2 = Curve(ls)
merge_20 = Merge(Data1=middle_l_left_point_4, Data2=middle_l_right_point_3)
entwine_5 = Entwine(
    Branch00=platformlines_2,
    Branch01=ls_2,
    Branch02=entwine_4,
    Branch03=front_trolley_pusher_3,
    Branch04=front_trolley_vertical_2,
    Branch05=back_trolley_pusher_3,
    Branch06=back_trolley_vertical_2,
    Branch07=filter,
    Branch08=platforms_real_top_surfaces_2,
    FlattenInputs=True)  # -> flatten(Result)
X_2 = UnitX(Factor=1)
subtraction_14 = Subtraction(A=floor_wall_corner_point_7, B=pt_8)
addition_10 = Addition(A=floor_wall_corner_point_7, B=X_2)
move_3 = Move(Geometry=entwine_5, Motion=subtraction_14)  # -> Geometry, Transform
move_4 = Move(Geometry=merge_20, Motion=subtraction_14)  # -> Geometry, Transform
ln_4 = Line(StartPoint=floor_wall_corner_point_7, EndPoint=addition_10)
rotax = RotateAxis(Geometry=move_3.Geometry, Angle=1.570796327, Axis=ln_4)  # -> flatten(Geometry), Transform
rotax_2 = RotateAxis(Geometry=move_4.Geometry, Angle=1.570796327, Axis=ln_4)  # -> flatten(Geometry), Transform
xz_curves_for_math_model = Curve(rotax.Geometry)

final_ls_2 = Curve(final_ls)
final_rotating_arms_2 = Curve(final_rotating_arms)
item_9 = ListItem(List=final_ls_2, Index="1", Wrap=True)
merge_21 = Merge(Data1=final_rotating_arms_2, Data2=item_9)
move_5 = Move(Geometry=merge_21, Motion=subtraction_14)  # -> Geometry, Transform
rotax_3 = RotateAxis(Geometry=move_5.Geometry, Angle=1.570796327, Axis=ln_4)  # -> flatten(Geometry), Transform
item_10 = ListItem(List=rotax_3.Geometry, Index=0, Wrap=True)  # -> Item, Item1, Item2
final_rotating_arms_3 = Curve([item_10.Item, item_10.Item1])
final_middle_l = Curve(item_10.Item2)

item_11 = ListItem(List=rotax_2.Geometry, Index=0, Wrap=True)  # -> Item, Item1
back_arm_midpoint = Point(item_11.Item)
xz_curves_for_math_model_2 = Curve(xz_curves_for_math_model)

front_arm_midpoint = Point(item_11.Item1)

item_12 = ListItem(List=xz_curves_for_math_model_2, Index=0, Wrap=True)  # -> Item, Item1, Item2, Item3, Item4, Item5, Item6, Item7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

crv_5 = Curve(item_12.Item6)
crv_6 = Curve(item_12.Item7)
crv_7 = Curve([item_12.Item13, item_12.Item14, item_12.Item15])
crv_8 = Curve(item_12.Item)
crv_9 = Curve(item_12.Item3)
crv_10 = Curve(item_12.Item1)
crv_11 = Curve(item_12.Item5)
crv_12 = Curve(item_12.Item9)
crv_13 = Curve(item_12.Item4)
crv_14 = Curve(item_12.Item10)
crv_15 = Curve(item_12.Item11)
crv_16 = Curve(item_12.Item12)
crv_17 = Curve(item_12.Item8)
merge_22 = Merge(Data1=crv_5, Data2=crv_6)
merge_23 = Merge(Data1=crv_9, Data2=crv_13, Data3=crv_11)

# ---- group: XZ Trolley vertical breps
xz_curves_for_math_model_3 = Curve(xz_curves_for_math_model)
panel_10 = Panel("""9
11
12""")
panel_11 = Panel("""-1
1""")
drawerslidemidlineelevations_3 = Number(drawerslidemidlineelevations)
item_13 = ListItem(List=xz_curves_for_math_model_3, Index=panel_10, Wrap=True)
armpivotholediameter_3 = Number(armpivotholediameter)
armmaterialthickness_4 = Number(armmaterialthickness)
slidelengths_5 = Number(slidelengths)
arm_width_9 = Number(arm_width_5)
item_14 = ListItem(List=item_13, Index=0, Wrap=True)  # -> Item, Item1, Item2
merge_24 = Merge(Data1=item_14.Item, Data2=item_14.Item1)
trolley_vertical_xz_brep = CSharpScript(
    ArmWidth=arm_width_9,
    MaterialThickness=armmaterialthickness_4,
    PivotHoleDiameter=armpivotholediameter_3,
    DrawerSlideLength=slidelengths_5,
    DrawerSlideHeight="40",
    DrawerSlideMidLineElevation=drawerslidemidlineelevations_3,
    DrawerSlideXDirection=panel_11,
    TrolleyVerticalCurve=merge_24,
    MiddleSectionOutline=item_14.Item2)  # -> out, L_Brep; inputs ArmWidth: Double, MaterialThickness: Double, PivotHoleDiameter: Double, DrawerSlideLength: Double, DrawerSlideHeight: Double, DrawerSlideMidLineElevation: Double, DrawerSlideXDirection: Int32, TrolleyVerticalCurve: Curve, MiddleSectionOutline: Curve
# ---------- trolley_vertical_xz_brep: C# ----------
    double tol = 0.01;

    Curve[] segments = MiddleSectionOutline.DuplicateSegments();
    List<Curve> verticals = segments.Where(s => s.GetLength() > (ArmWidth + tol) && Math.Abs((new Line(s.PointAtStart, s.PointAtEnd)).Direction.X) < tol)
      .OrderBy(s => s.PointAtStart.X).ToList();

    double sliderIndentX = segments.SelectMany(s => new List<double>() { s.PointAtStart.X, s.PointAtEnd.X }).Max() - verticals.Last().PointAtStart.X;

    var vertical = TrolleyVerticalCurve.DuplicateCurve();
    if (vertical.PointAtStart.Z > vertical.PointAtEnd.Z)
    {
      vertical.Reverse();
    }
    Point3d pivotPt = vertical.PointAtEnd;
    if ((vertical.PointAtEnd.Z - vertical.PointAtStart.Z) < DrawerSlideMidLineElevation)
    {
      vertical = new LineCurve(vertical.PointAtStart,
        Pt(vertical.PointAtStart, 0, DrawerSlideMidLineElevation));
    }
    double sliderArmWidth = Math.Max(ArmWidth, DrawerSlideHeight);
    List<Curve> curves = new List<Curve>();
    List<Point3d> pts = new List<Point3d>();

    //Starting top left, going anti-clockwise
    double centreX = vertical.PointAtEnd.X;
    double mainLeftEdgeX = centreX - ArmWidth / 2;
    double mainRightEdgeX = centreX + ArmWidth / 2;
    double extremeX = centreX + (DrawerSlideLength - ArmWidth / 2) * DrawerSlideXDirection
      - ((DrawerSlideXDirection < 0 ) ? sliderIndentX : 0);

    Print(DrawerSlideLength.ToString());
    var rectMain = new Rhino.Geometry.Rectangle3d(Plane.WorldZX, Pt(mainLeftEdgeX, 0, vertical.PointAtStart.Z),
      Pt(mainRightEdgeX, 0, vertical.PointAtEnd.Z + ArmWidth / 2));

    Curve hole = new ArcCurve(new Circle(pivotPt, PivotHoleDiameter / 2));
    PolylineCurve outline = new PolylineCurve(rectMain.ToPolyline());
    Brep lowerFace = Brep.CreatePlanarBreps(new [] { outline, hole }, tol).FirstOrDefault(b => b != null);
    Brep post = lowerFace.Faces[0].CreateExtrusion(new LineCurve(Pt(0, 0, 0), Pt(0, -MaterialThickness, 0)), true);

    var rectSlide = new Rhino.Geometry.Rectangle3d(Plane.WorldZX, Pt(extremeX, 0, DrawerSlideMidLineElevation - ArmWidth / 2),
      Pt(centreX + (ArmWidth / 2) * DrawerSlideXDirection, 0, DrawerSlideMidLineElevation + ArmWidth / 2));
    Brep slide = Extrusion.CreateExtrusion(new PolylineCurve(rectSlide.ToPolyline()),
      new Vector3d(0, -MaterialThickness, 0)).ToBrep();
    slide = slide.CapPlanarHoles(tol);

    L_Brep = new [] { post, slide };
# ---------- trolley_vertical_xz_brep: C# additional code ----------
  Point3d SecondLast(List<Point3d> pts)
  {
    return pts[pts.Count - 2];
  }

  Point3d Pt(double x, double y, double z)
  {
    return new Point3d(x, y, z);
  }

  Point3d Pt(Point3d refPt, double xDiff, double zDiff)
  {
    return new Point3d(refPt.X + xDiff, refPt.Y, refPt.Z + zDiff);
  }
# ---------- end trolley_vertical_xz_brep ----------
armmaterialthickness_5 = Number(armmaterialthickness)
fingergap_4 = Number(fingergap)
Y_4 = UnitY(Factor=1)
expression_7 = Expression(n="3", t=armmaterialthickness_5, g=fingergap_4, Expression="n*g+(n-1)*t")
rev_3 = Reverse(Vector=Y_4)
D = Data(trolley_vertical_xz_brep.L_Brep)
multiplication_5 = Multiplication(A=expression_7, B=rev_3)
mirrorplane_2 = Plane(mirrorplane)
tstat = TreeStatistics(Tree=D)  # -> Paths, Length, Count
larger = LargerThan(FirstNumber=tstat.Count, SecondNumber="1")  # -> LargerThan, OrEqualTo
flatten = FlattenTree(Tree=D, Path="{0}")
simplify = SimplifyTree(Tree=D, Front=False)
filter_2 = StreamFilter(Gate=larger.LargerThan, Stream0=flatten, Stream1=simplify)
D_2 = Data(filter_2)
move_6 = Move(Geometry=D_2, Motion=multiplication_5)  # -> Geometry, Transform
mirror = Mirror(Geometry=move_6.Geometry, Plane=mirrorplane_2)  # -> Geometry, Transform
merge_25 = Merge(Data1=move_6.Geometry, Data2=mirror.Geometry)

# ---- group: Middle section brep
armmaterialthickness_6 = Number(armmaterialthickness)
experimental_middle_section_6 = Boolean(experimental_middle_section_2)
fingergap_5 = Number(fingergap)
xz_curves_for_math_model_4 = Curve(xz_curves_for_math_model)
filter_3 = StreamFilter(Gate=experimental_middle_section_6, Stream0="4", Stream1="2")
item_15 = ListItem(List=xz_curves_for_math_model_4, Index="12", Wrap=True)
Y_5 = UnitY(Factor=1)
expression_8 = Expression(t=armmaterialthickness_6, n=filter_3, g=fingergap_5, Expression="n*g+(n-1)*t")
vec_3 = VectorXYZ(XComponent=0, YComponent=armmaterialthickness_6, ZComponent=0)  # -> Vector, Length
rev_4 = Reverse(Vector=Y_5)
rev_5 = Reverse(Vector=vec_3.Vector)
extr_2 = Extrude(Base=item_15, Direction=rev_5)  # -> flatten(Extrusion)
multiplication_6 = Multiplication(A=expression_8, B=rev_4)
cap_2 = CapHoles(Brep=extr_2)
move_7 = Move(Geometry=cap_2, Motion=multiplication_6)  # -> Geometry, Transform
mirrorplane_3 = Plane(mirrorplane)
mirror_2 = Mirror(Geometry=move_7.Geometry, Plane=mirrorplane_3)  # -> Geometry, Transform
merge_26 = Merge(Data1=move_7.Geometry, Data2=mirror_2.Geometry)

# ----
xz_curves_for_math_model_5 = Curve(xz_curves_for_math_model)
armpivotholediameter_4 = Number(armpivotholediameter)
armmaterialthickness_7 = Number(armmaterialthickness)
item_16 = ListItem(List=xz_curves_for_math_model_5, Index=0, Wrap=True)  # -> Item, Item1, Item2, Item3, Item4, Item5
arm_width_10 = Number(arm_width_5)
merge_27 = Merge(Data1=item_16.Item3, Data2=item_16.Item4, Data3=item_16.Item5)
merge_28 = Merge(Data1=item_16.Item, Data2=item_16.Item1, Data3=item_16.Item2)
l_xz_brep = CSharpScript(
    PlatformCurve=merge_28,
    L_Curve=merge_27,
    ArmWidth=arm_width_10,
    MaterialThickness=armmaterialthickness_7,
    PivotHoleDiameter=armpivotholediameter_4)  # -> out, L_Brep; inputs PlatformCurve: Curve, L_Curve: Curve, ArmWidth: Double, MaterialThickness: Double, PivotHoleDiameter: Double
# ---------- l_xz_brep: C# ----------
    double tol = 0.01;

    try
    {
      var raisedPlatform = new LineCurve(PlatformCurve.PointAtStart, PlatformCurve.PointAtEnd);
      if (raisedPlatform.PointAtStart.X > raisedPlatform.PointAtEnd.X)
      {
        raisedPlatform.Reverse();
      }
      raisedPlatform.Translate(new Vector3d(0, 0, ArmWidth / 2));

      if (L_Curve.PointAtStart.X > L_Curve.PointAtEnd.X)
      {
        L_Curve.Reverse();
      }

      List<Curve> curves = new List<Curve>();

      List<Point3d> pts = new List<Point3d>();
      pts.Add(new Point3d(L_Curve.PointAtStart.X - ArmWidth / 2, 0, L_Curve.PointAtStart.Z));
      if (raisedPlatform.PointAtStart.Z > pts.Last().Z)
      {
        pts.Add(new Point3d(pts.Last().X, 0, raisedPlatform.PointAtStart.Z));
        curves.Add(new LineCurve(SecondLast(pts), pts.Last()));
      }
      Print("z = " + raisedPlatform.PointAtStart.Z);
      pts.Add(new Point3d(L_Curve.PointAtEnd.X + ArmWidth / 2, 0, raisedPlatform.PointAtEnd.Z));
      curves.Add(new LineCurve(SecondLast(pts), pts.Last()));
      pts.Add(new Point3d(L_Curve.PointAtEnd.X + ArmWidth / 2, 0, L_Curve.PointAtEnd.Z));
      curves.Add(new LineCurve(SecondLast(pts), pts.Last()));

      Vector3d angled = new Vector3d(L_Curve.PointAtStart.X - L_Curve.PointAtEnd.X, 0, L_Curve.PointAtStart.Z - L_Curve.PointAtEnd.Z);
      Vector3d rotatedUnitAngle = new Vector3d(angled);
      rotatedUnitAngle.Rotate(Math.PI / 2, -1 * Vector3d.YAxis);
      rotatedUnitAngle.Unitize();
      pts.Add(L_Curve.PointAtEnd + rotatedUnitAngle * ArmWidth / 2);

      curves.Add(new ArcCurve(new Arc(SecondLast(pts), Vector3d.ZAxis * -1, pts.Last())));

      pts.Add(pts.Last() + angled);
      curves.Add(new LineCurve(SecondLast(pts), pts.Last()));

      curves.Add(new ArcCurve(new Arc(pts.Last(), angled, pts.First())));

      Curve outline = Curve.JoinCurves(curves).FirstOrDefault(c => c != null && c.IsClosed);

      Curve holeL = new ArcCurve(new Circle(L_Curve.PointAtStart, PivotHoleDiameter / 2));
      Curve holeR = new ArcCurve(new Circle(L_Curve.PointAtEnd, PivotHoleDiameter / 2));


      Brep lowerFace = Brep.CreatePlanarBreps(new [] { outline, holeL, holeR }, tol).FirstOrDefault(b => b != null);
      Brep upperFace = lowerFace.DuplicateBrep();
      upperFace.Translate(0, MaterialThickness, 0);

      List<Brep> breps = new List<Brep>() { lowerFace, upperFace };

      breps.AddRange((new [] { outline, holeL, holeR})
        .Select(c => Surface.CreateExtrusion(c, new Vector3d(0, MaterialThickness, 0)).ToBrep()));

      Brep solid = Brep.JoinBreps(breps, tol).FirstOrDefault(b => b.IsSolid);
      L_Brep = solid;
    }
    catch (Exception ex)
    {
      Print(ex.Message);
      Print(ex.StackTrace);
    }
# ---------- l_xz_brep: C# additional code ----------
  Point3d SecondLast(List<Point3d> pts)
  {
    return pts[pts.Count - 2];
  }
# ---------- end l_xz_brep ----------
division_7 = Division(A=arm_width_10, B=-2)
explode = Explode(Curve=merge_27, Recursive=True)  # -> Segments, Vertices
end_9 = EndPoints(Curve=merge_27)  # -> Start, End
item_17 = ListItem(List=explode.Segments, Index=0, Wrap=True)  # -> Item, Item1
end_10 = EndPoints(Curve=graft(merge_28))  # -> Start, End
end_11 = EndPoints(Curve=item_17.Item)  # -> Start, End
pdecon_5 = Deconstruct(Point=end_10.Start)  # -> XComponent, YComponent, ZComponent
pdecon_6 = Deconstruct(Point=end_11.Start)  # -> XComponent, YComponent, ZComponent
pdecon_7 = Deconstruct(Point=end_11.End)  # -> XComponent, YComponent, ZComponent
pdecon_8 = Deconstruct(Point=end_10.End)  # -> XComponent, YComponent, ZComponent
pt_9 = Point(graft(end_9.End))
pt_10 = ConstructPoint(XCoordinate=pdecon_6.XComponent, YCoordinate=pdecon_6.YComponent, ZCoordinate=pdecon_5.ZComponent)
pt_11 = ConstructPoint(XCoordinate=pdecon_7.XComponent, YCoordinate=pdecon_7.YComponent, ZCoordinate=pdecon_8.ZComponent)
pt_12 = Point(pt_10)
pt_13 = Point(pt_11)
pt_14 = Point(end_11.Start)
merge_29 = Merge(Data1=pt_14, Data2=pt_12, Data3=pt_13, Data4=pt_9)
cullpt = CullDuplicates(Points=merge_29, Tolerance=0.1, CullMode=3)  # -> Points, Indices, Valence
item_18 = ListItem(List=cullpt.Points, Index=0, Wrap=True)  # -> Item1, Item
pline_2 = PolyLine(Vertices=cullpt.Points, Closed=False)
ln_5 = Line(StartPoint=item_18.Item1, EndPoint=item_18.Item)
merge_30 = Merge(Data1=pline_2, Data2=ln_5)
join_3 = JoinCurves(Curves=merge_30, Preserve=False)
xz_3 = XZPlane(Origin=Point(0, 0, 0))
vec_4 = VectorXYZ(XComponent=0, YComponent=armmaterialthickness_7, ZComponent=0)  # -> Vector, Length
offset = OffsetCurve(Curve=join_3, Distance=division_7, Plane=xz_3, Corners="2")
extr_3 = Extrude(Base=offset, Direction=vec_4.Vector)
cap_3 = CapHoles(Brep=extr_3)
D_3 = Data(cap_3)
tstat_2 = TreeStatistics(Tree=D_3)  # -> Paths, Length, Count
flatten_2 = FlattenTree(Tree=D_3, Path="{0}")
larger_2 = LargerThan(FirstNumber=tstat_2.Count, SecondNumber="1")  # -> LargerThan, OrEqualTo
simplify_2 = SimplifyTree(Tree=D_3, Front=False)
filter_4 = StreamFilter(Gate=larger_2.LargerThan, Stream0=flatten_2, Stream1=simplify_2)
mirrorplane_4 = Plane(mirrorplane)
D_4 = Data(filter_4)
mirror_3 = Mirror(Geometry=D_4, Plane=mirrorplane_4)  # -> Geometry, Transform
merge_31 = Merge(Data1=D_4, Data2=mirror_3.Geometry)

# ---- group: 3D Shelves on XZ
xz_curves_for_math_model_6 = Curve(xz_curves_for_math_model)
platformmaterialthickness_3 = Number(platformmaterialthickness)
panel_12 = Panel("""13
14
15""")
item_19 = ListItem(List=xz_curves_for_math_model_6, Index=panel_12, Wrap=True)
Z_2 = UnitZ(Factor=platformmaterialthickness_3)
end_12 = EndPoints(Curve=item_19)  # -> Start, End
rev_6 = Reverse(Vector=Z_2)
shelflength_3 = Number(shelflength)
xz_4 = XZPlane(Origin=Point(0, 0, 0))
move_8 = Move(Geometry=end_12.End, Motion=rev_6)  # -> Geometry, Transform
rec_2pt = Rectangle2Pt(Plane=xz_4, PointA=end_12.Start, PointB=move_8.Geometry, Radius=0)  # -> Rectangle, Length
Y_6 = UnitY(Factor=shelflength_3)
extr_4 = Extrude(Base=rec_2pt.Rectangle, Direction=Y_6)
cap_4 = CapHoles(Brep=extr_4)

# ---- group: Beams on XZ plane
platforms_real_top_surfaces_3 = Curve(crv_7)
platformmaterialthickness_4 = Number(platformmaterialthickness)
armmaterialthickness_8 = Number(armmaterialthickness)
l_points_width_3 = Number(l_points_width)
ls_3 = Curve(merge_23)
arm_width_11 = Number(arm_width_5)
shelflength_4 = Number(shelflength)
l_beam_rects = CSharpScript(
    Platform=platforms_real_top_surfaces_3,
    L=ls_3,
    L_Width=l_points_width_3,
    BeamHeight="60",
    MaterialThickness=platformmaterialthickness_4,
    ArmWidth=arm_width_11)  # -> out, Rects; inputs Platform: Curve, L: Curve, L_Width: Double, BeamHeight: Double, MaterialThickness: Double, ArmWidth: Double
# ---------- l_beam_rects: C# ----------
    PolylineCurve l = (PolylineCurve) L;

    double minX = Math.Min(l.PointAtStart.X, l.PointAtEnd.X) - ArmWidth / 2;
    double maxX = Math.Max(l.PointAtStart.X, l.PointAtEnd.X) + ArmWidth / 2;
    double minZ = Platform.PointAtStart.Z - BeamHeight - MaterialThickness;
    double maxZ = Platform.PointAtStart.Z - MaterialThickness;

    double t = MaterialThickness / 2;
    double d = (L_Width + ArmWidth) / 3;

    double[] xs = new double[4] { minX + d - t, minX + d + t, maxX - MaterialThickness, maxX};

    Point3d[][] rectPts = new Point3d[2][];

    rectPts[0] = new Point3d[5]
      {
      Pt(xs[0], minZ), Pt(xs[0], maxZ), Pt(xs[1], maxZ), Pt(xs[1], minZ), Pt(xs[0], minZ)
      };

    rectPts[1] = new Point3d[5]
      {
      Pt(xs[2], minZ), Pt(xs[2], maxZ), Pt(xs[3], maxZ), Pt(xs[3], minZ), Pt(xs[2], minZ)
      };

    Rects = rectPts.Select(pl => Rectangle3d.CreateFromPolyline(pl)).ToList();
# ---------- l_beam_rects: C# additional code ----------
  public Point3d Pt(double x, double z)
  {
    return new Point3d(x, 0, z);
  }
# ---------- end l_beam_rects ----------
expression_9 = Expression(t=armmaterialthickness_8, sl=shelflength_4, Expression="(sl-2*t)")
vec_5 = VectorXYZ(XComponent=0, YComponent=armmaterialthickness_8, ZComponent=0)  # -> Vector, Length
move_9 = Move(Geometry=l_beam_rects.Rects, Motion=vec_5.Vector)  # -> Geometry, Transform
Y_7 = UnitY(Factor=expression_9)
extr_5 = Extrude(Base=move_9.Geometry, Direction=Y_7)  # -> flatten(Extrusion)
cap_5 = CapHoles(Brep=extr_5)

# ---- group: New mid section connector beams
fingergap_6 = Number(fingergap)
final_middle_l_2 = Curve(final_middle_l)
arm_width_12 = Number(arm_width_5)
final_rotating_arms_4 = Curve(final_rotating_arms_3)
armmaterialthickness_9 = Number(armmaterialthickness)
supportbeamheights_3 = Number(supportbeamheights)
end_13 = EndPoints(Curve=final_middle_l_2)  # -> Start, End
expression_10 = Expression(aw=arm_width_12, g=fingergap_6, Expression="aw/2+g")
panel_13 = Panel("""-1
1""")
ln_6 = Line(StartPoint=end_13.Start, EndPoint=end_13.End)
expression_11 = Expression(g=fingergap_6, t=armmaterialthickness_9, Expression="-1*(4 * (g + t))")
multiplication_7 = Multiplication(A=expression_10, B=panel_13)
xz_5 = XZPlane(Origin=Point(0, 0, 0))
multiplication_8 = Multiplication(A=supportbeamheights_3, B=-1)
divide_2 = DivideCurve(Curve=ln_6, Count="3", Kinks=False)  # -> Points, Tangents, Parameters
panel_14 = Panel("""1
2""")
expression_12 = Expression(t=armmaterialthickness_9, Expression="-t/2")
offset_2 = OffsetCurve(Curve=final_rotating_arms_4, Distance=multiplication_7, Plane=xz_5, Corners=1)  # -> flatten(Curve)
item_20 = ListItem(List=divide_2.Points, Index=panel_14, Wrap=True)
item_21 = ListItem(List=offset_2, Index=0, Wrap=True)
yz = YZPlane(Origin=item_20)
pcx = CurvePlane(Curve=item_21, Plane=yz)  # -> flatten(Points), ParamsC, ParamsP
vec_6 = VectorXYZ(XComponent=expression_12, YComponent=armmaterialthickness_9, ZComponent=0)  # -> Vector, Length
move_10 = Move(Geometry=pcx.Points, Motion=vec_6.Vector)  # -> Geometry, Transform
xz_6 = XZPlane(Origin=move_10.Geometry)
vec_7 = VectorXYZ(XComponent=0, YComponent=expression_11, ZComponent=0)  # -> Vector, Length
rectangle = Rectangle(Plane=xz_6, XSize=armmaterialthickness_9, YSize=multiplication_8, Radius=0)  # -> Rectangle, Length
extr_6 = Extrude(Base=rectangle.Rectangle, Direction=vec_7.Vector)
mirrorplane_5 = Plane(mirrorplane)
cap_6 = CapHoles(Brep=extr_6)
mirror_4 = Mirror(Geometry=cap_6, Plane=mirrorplane_5)  # -> Geometry, Transform
merge_32 = Merge(Data1=cap_6, Data2=mirror_4.Geometry)
brep = Brep(merge_32)

# ----
platformmaterialthickness_5 = Number(platformmaterialthickness)
armmaterialthickness_10 = Number(armmaterialthickness)
shelflength_5 = Number(shelflength)
arm_width_13 = Number(arm_width_5)
fingergap_7 = Number(fingergap)
rotating_arms_stabiliser_outline = CSharpScript(
    RotatingArms=merge_22,
    TopPlatformLine=crv_8,
    TopL=crv_9,
    HeightAlongArm="300",
    ShelfLength=shelflength_5,
    ArmWidth=arm_width_13,
    PlatformMaterialThickness=platformmaterialthickness_5,
    FingerGap=fingergap_7,
    ArmMaterialThickness=armmaterialthickness_10,
    n="1")  # -> out, StartPt, ZigZags, ArmUnitVector, ArmUnitPerpVector, n_out; inputs RotatingArms: list of Curve, TopPlatformLine: Curve, TopL: Curve, HeightAlongArm: Double, ShelfLength: Double, ArmWidth: Double, PlatformMaterialThickness: Double, FingerGap: Double, ArmMaterialThickness: Double, n: Int32
# ---------- rotating_arms_stabiliser_outline: C# ----------
    try
    {
      Point3d[] lPts = (new [] { TopL.PointAtStart, TopL.PointAtEnd }).OrderBy(p => p.X).ToArray();
      double tol = 0.01;

      double pivotToTopUnderside = TopPlatformLine.PointAtStart.Z + ArmWidth / 2 - PlatformMaterialThickness
        - lPts[1].Z - FingerGap;

      double startDistanceBelowPivot = (HeightAlongArm == 0 ? 200 : HeightAlongArm) - pivotToTopUnderside;

      Vector3d vArm = (RotatingArms[0].PointAtEnd.DistanceTo(lPts[0]) < tol)
        ? RotatingArms[0].PointAtEnd - RotatingArms[0].PointAtStart
        : RotatingArms[0].PointAtStart - RotatingArms[0].PointAtEnd;
      vArm.Unitize();
      Vector3d vArmPerp = new Vector3d(vArm.Z, 0, -vArm.X);

      Point3d startPt = lPts[1] + vArmPerp * ArmWidth / 2 - startDistanceBelowPivot * vArm;

      double pieceLength = ShelfLength + 2 * (ArmMaterialThickness + FingerGap);

      List<double> zigZags = new List<double>()
        {
          startDistanceBelowPivot + pivotToTopUnderside,  //Yes could just use HeightAlongArm here
          pieceLength,
          -(startDistanceBelowPivot + pivotToTopUnderside),
          -ArmWidth,
          startDistanceBelowPivot + pivotToTopUnderside - ArmWidth,
          -(pieceLength - 2 * ArmWidth),
          -(startDistanceBelowPivot + pivotToTopUnderside - ArmWidth)
          };

      ArmUnitVector = vArm;
      ArmUnitPerpVector = vArmPerp;
      ZigZags = zigZags;
      StartPt = startPt;
      n_out = n;
    }
    catch (Exception ex)
    {
      Print(ex.Message);
      Print(ex.StackTrace);
    }
# ---------- end rotating_arms_stabiliser_outline ----------
multiplication_9 = Multiplication(A=rotating_arms_stabiliser_outline.ArmUnitPerpVector, B=armmaterialthickness_10)

platformmaterialthickness_6 = Number(platformmaterialthickness)
drawerslidemidlineelevations_4 = Number(drawerslidemidlineelevations)
armmaterialthickness_11 = Number(armmaterialthickness)
shelflength_6 = Number(shelflength)
arm_width_14 = Number(arm_width_5)
fingergap_8 = Number(fingergap)
middle_unit_horizontal_stabiliser_outlin = CSharpScript(
    MiddleSectionOutline=crv_16,
    DrawerSliderMidLineElevations=drawerslidemidlineelevations_4,
    SlideLengths=slidelengths_2,
    ShelfLength=shelflength_6,
    ArmWidth=arm_width_14,
    PlatformMaterialThickness=platformmaterialthickness_6,
    FingerGap=fingergap_8,
    ArmMaterialThickness=armmaterialthickness_11,
    ExperimentalMiddleSection=experimental_middle_section_3)  # -> out, StartPt, ZigZags, n_out; "Middle unit-horizontal-stabiliser-outline"; inputs MiddleSectionOutline: Curve, DrawerSliderMidLineElevations: list of Double, SlideLengths: list of Double, ShelfLength: Double, ArmWidth: Double, PlatformMaterialThickness: Double, FingerGap: Double, ArmMaterialThickness: Double, ExperimentalMiddleSection: Boolean
# ---------- middle_unit_horizontal_stabiliser_outlin: C# ----------
    int n = ExperimentalMiddleSection ? 1 : 3;

    double pieceLength = 2 * (n * ArmMaterialThickness + (n + 1) * FingerGap) + ShelfLength;

    Point3d startPt = default(Point3d);
    List<double> zigZags = null;
    if (ExperimentalMiddleSection)
    {
      double lengthAlongMiddleSection = 180;

      int si = SlideLengths.IndexOf(SlideLengths.Max());
      double se = DrawerSliderMidLineElevations[si];

      double topZ = se + ArmWidth / 2;

      double minX = MiddleSectionOutline.DuplicateSegments().SelectMany(s => new List<double>() { s.PointAtStart.X, s.PointAtEnd.X }).Min()
        + ArmMaterialThickness + FingerGap;

      double maxX = minX + lengthAlongMiddleSection;

      startPt = new Point3d(maxX, -FingerGap, topZ);
      zigZags = new List<double>()
        {
          -lengthAlongMiddleSection,
          pieceLength,
          lengthAlongMiddleSection,
          -ArmWidth,
          -(lengthAlongMiddleSection - ArmWidth),
          -(pieceLength - 2 * ArmWidth),
          (lengthAlongMiddleSection - ArmWidth)
          };
    }
    else
    {
      double[] xs = MiddleSectionOutline.DuplicateSegments()
        .SelectMany(s => new [] { s.PointAtStart.X, s.PointAtEnd.X }).Distinct().OrderBy(x => x).ToArray();
      double[] zs = MiddleSectionOutline.DuplicateSegments()
        .SelectMany(s => new [] { s.PointAtStart.Z, s.PointAtEnd.Z }).Distinct().OrderBy(z => z).ToArray();

      double topZ = DrawerSliderMidLineElevations.Min() - ArmWidth / 2 - FingerGap;


      // The ArmMaterialThickness is there because the piece will extruded towards the front
      double frontX = xs[1] - ArmWidth - FingerGap - ArmMaterialThickness;

      startPt = new Point3d(frontX + ArmWidth, -FingerGap, zs[0]);

      double lengthAlongCentralUnit = 300;

      zigZags = new List<double>()
        {
          -lengthAlongCentralUnit,
          ArmWidth,
          lengthAlongCentralUnit - ArmWidth,
          (pieceLength - ArmWidth * 2),
          -(lengthAlongCentralUnit - ArmWidth),
          ArmWidth,
          lengthAlongCentralUnit
          };
    }

    ZigZags = zigZags;
    StartPt = startPt;
    n_out = n;
# ---------- end middle_unit_horizontal_stabiliser_outlin ----------
Z_3 = UnitZ(Factor=armmaterialthickness_11)
rev_7 = Reverse(Vector=Z_3)
X_3 = UnitX(Factor=1)

platformmaterialthickness_7 = Number(platformmaterialthickness)
drawerslidemidlineelevations_5 = Number(drawerslidemidlineelevations)
armmaterialthickness_12 = Number(armmaterialthickness)
shelflength_7 = Number(shelflength)
fingergap_9 = Number(fingergap)
arm_width_15 = Number(arm_width_5)
middle_unit_vertical_stabiliser_outline = CSharpScript(
    MiddleSectionOutline=crv_16,
    DrawerSliderMidLineElevations=drawerslidemidlineelevations_5,
    ShelfLength=shelflength_7,
    ArmWidth=arm_width_15,
    PlatformMaterialThickness=platformmaterialthickness_7,
    FingerGap=fingergap_9,
    ArmMaterialThickness=armmaterialthickness_12,
    ExperimentalMiddleSection=experimental_middle_section_4)  # -> out, StartPt, ZigZags, n_out; inputs MiddleSectionOutline: Curve, DrawerSliderMidLineElevations: list of Double, ShelfLength: Double, ArmWidth: Double, PlatformMaterialThickness: Double, FingerGap: Double, ArmMaterialThickness: Double, ExperimentalMiddleSection: Boolean
# ---------- middle_unit_vertical_stabiliser_outline: C# ----------
    double tol = 0.01;
    Curve[] segments = MiddleSectionOutline.DuplicateSegments();
    List<Curve> verticals = segments.Where(s => s.GetLength() > (ArmWidth + tol) && Math.Abs((new Line(s.PointAtStart, s.PointAtEnd)).Direction.X) < tol)
      .OrderBy(s => s.PointAtStart.X).ToList();
    int n = ExperimentalMiddleSection ? 2 : 3;

    double maxX = verticals.Last().PointAtStart.X;
    double minZ = segments.Min(s => Math.Min(s.PointAtStart.Z, s.PointAtEnd.Z));

    double topZ = ExperimentalMiddleSection
      ? Math.Max(verticals.Last().PointAtStart.Z, verticals.Last().PointAtEnd.Z)
      : DrawerSliderMidLineElevations.Min() - ArmWidth / 2 - FingerGap; //Will need carve out for slider
    double pieceLength = 2 * (n * ArmMaterialThickness + n * FingerGap) + ShelfLength;

    // The ArmMaterialThickness is there because the piece will extruded towards the front
    double frontX = ExperimentalMiddleSection
      ? maxX - ArmMaterialThickness
      : maxX - ArmWidth - FingerGap - ArmMaterialThickness;

    Point3d startPt = new Point3d(frontX, 0, minZ);

    Print("TopZ = " + topZ);

    List<double> zigZags = new List<double>()
      {
        (topZ - minZ),
        ArmWidth,
        -(topZ - minZ - ArmWidth),
        (pieceLength - ArmWidth * 2),
        (topZ - minZ - ArmWidth),
        ArmWidth,
        -(topZ - minZ)
        };

    ZigZags = zigZags;
    StartPt = startPt;
    n_out = n;
# ---------- end middle_unit_vertical_stabiliser_outline ----------

platformmaterialthickness_8 = Number(platformmaterialthickness)
armmaterialthickness_13 = Number(armmaterialthickness)
shelflength_8 = Number(shelflength)
arm_width_16 = Number(arm_width_5)
fingergap_10 = Number(fingergap)
back_trolley_stabiliser_outline = CSharpScript(
    VerticalLine=crv_15,
    PusherLine=crv_14,
    MiddlePlatformLine=crv_10,
    ShelfLength=shelflength_8,
    ArmWidth=arm_width_16,
    PlatformMaterialThickness=platformmaterialthickness_8,
    FingerGap=fingergap_10,
    ArmMaterialThickness=armmaterialthickness_13,
    n="3")  # -> out, StartPt, ZigZags, n_out; inputs VerticalLine: Curve, PusherLine: Curve, MiddlePlatformLine: Curve, ShelfLength: Double, ArmWidth: Double, PlatformMaterialThickness: Double, FingerGap: Double, ArmMaterialThickness: Double, n: Int32
# ---------- back_trolley_stabiliser_outline: C# ----------
    double[] zs = (new [] { VerticalLine.PointAtStart.Z, VerticalLine.PointAtEnd.Z }).OrderBy(z => z).ToArray();

    Point3d pusherPivotPt = (new [] { PusherLine.PointAtStart, PusherLine.PointAtEnd }).OrderBy(p => p.X).First();

    double topZ = pusherPivotPt.Z - 80;
    double bottomZ = zs[0];
    Point3d startPt = new Point3d(VerticalLine.PointAtStart.X - ArmWidth / 2, 0, zs[0]);
    double pieceLength = 2 * (n * ArmMaterialThickness + n * FingerGap) + ShelfLength;

    List < double > zigZags = new List<double>()
      {
        (topZ - startPt.Z),
        ArmWidth,
        -(topZ - startPt.Z - ArmWidth),
        pieceLength - 2 * ArmWidth,
        (topZ - startPt.Z - ArmWidth),
        ArmWidth,
        -(topZ - startPt.Z)
        };

    ZigZags = zigZags;
    StartPt = startPt;
    n_out = n;
# ---------- end back_trolley_stabiliser_outline ----------

platformmaterialthickness_9 = Number(platformmaterialthickness)
armmaterialthickness_14 = Number(armmaterialthickness)
shelflength_9 = Number(shelflength)
arm_width_17 = Number(arm_width_5)
fingergap_11 = Number(fingergap)
front_trolley_stabiliser_outline = CSharpScript(
    VerticalLine=crv_12,
    PusherLine=crv_17,
    MiddlePlatformLine=crv_10,
    ShelfLength=shelflength_9,
    ArmWidth=arm_width_17,
    PlatformMaterialThickness=platformmaterialthickness_9,
    FingerGap=fingergap_11,
    ArmMaterialThickness=armmaterialthickness_14,
    n="3")  # -> out, StartPt, ZigZags, n_out; inputs VerticalLine: Curve, PusherLine: Curve, MiddlePlatformLine: Curve, ShelfLength: Double, ArmWidth: Double, PlatformMaterialThickness: Double, FingerGap: Double, ArmMaterialThickness: Double, n: Int32
# ---------- front_trolley_stabiliser_outline: C# ----------
    // Using X and Y values to be more readable than Dir1 and Dir2, but also because the stick model the numbers
    // below are calculated from are assumed to be in the XY plane

    Point3d lowerVerticalPt = (new Point3d[] { VerticalLine.PointAtStart, VerticalLine.PointAtEnd }).OrderBy(p => p.Z).First();

    Point3d startPt = new Point3d(lowerVerticalPt.X + ArmWidth / 2, 0, lowerVerticalPt.Z);

    Point3d[] pusherEdgePts = (new Point3d[] { PusherLine.PointAtStart, PusherLine.PointAtEnd }).OrderBy(p => p.X).ToArray();

    //double topY = MiddlePlatformLine.PointAtStart.Y + ArmWidth / 2 - PlatformMaterialThickness;
    double topZ = pusherEdgePts.Last().Z - ArmWidth / 2 - FingerGap;
    double topVerticalLineY = pusherEdgePts.Last().Y;

    double pieceLength = ShelfLength + 2 * n * (ArmMaterialThickness + FingerGap);

    double inwardXOffset = n * (ArmMaterialThickness + FingerGap);

    List<double> zigZags = new List<double>()
      {
        topZ - startPt.Z,
        ArmWidth,
        -(topZ - startPt.Z - ArmWidth),
        pieceLength - 2 * ArmWidth,
        (topZ - startPt.Z - ArmWidth),
        ArmWidth,
        -(topZ - startPt.Z)};


    ZigZags = zigZags;
    StartPt = startPt;
    n_out = n;
# ---------- end front_trolley_stabiliser_outline ----------

panel_15 = Panel(rotax_2.Geometry)
mesh = MeshBrep(Brep=merge_26, Settings=jagged)
mesh_2 = MeshBrep(Brep=cap_4, Settings=jagged_2)
mesh_3 = MeshBrep(Brep=cap_5, Settings=jagged_3)
brep_2 = Brep(flatten(merge_25))
mesh_4 = MeshBrep(Brep=brep_2, Settings=jagged_5)
mesh_5 = MeshBrep(
    Brep=brep,
    Settings={GridMaxCount=0, GridMinCount=16, JaggedSeams=False, MaxEdgeLength=0, MinEdgeLength=0.0001, MinTolerance=0, Refine=True, RefineAngle=0, RelativeTolerance=0.65, SimplePlanes=True, Tolerance=0})
mesh_6 = MeshBrep(
    Brep=merge_31,
    Settings={GridMaxCount=0, GridMinCount=16, JaggedSeams=False, MaxEdgeLength=0, MinEdgeLength=0.0001, MinTolerance=0, Refine=True, RefineAngle=0, RelativeTolerance=0.65, SimplePlanes=True, Tolerance=0})
mcol = MeshColours(Mesh=mesh_4, Colours=ColourSwatch(SwatchColor=RGB(255, 247, 99)))
mcol_2 = MeshColours(Mesh=mesh_6, Colours=swatch_2)  # -> flatten(Mesh)
mcol_3 = MeshColours(Mesh=mesh, Colours=swatch)
mcol_4 = MeshColours(Mesh=mesh_5, Colours=swatch)
mcol_5 = MeshColours(Mesh=mesh_2, Colours=ColourSwatch(SwatchColor=RGB(40, 103, 148)))
mcol_6 = MeshColours(Mesh=mesh_3, Colours=swatch_2)

# ---- group: XZ Breps for rotating arms
xz_curves_for_math_model_7 = Curve(xz_curves_for_math_model)
item_22 = ListItem(List=xz_curves_for_math_model_7, Index="6", Wrap=True)  # -> Item, Item1, Item2, Item3, Item4, Item5
front_trolley_pusher_4 = Curve(item_22.Item2)
back_trolley_pusher_4 = Curve(item_22.Item4)
front_arm_midpoint_2 = Point(front_arm_midpoint)
back_arm_midpoint_2 = Point(back_arm_midpoint)
rotating_arms_3 = Curve(graft([item_22.Item, item_22.Item1]))
merge_33 = Merge(Data1=front_trolley_pusher_4, Data2=back_trolley_pusher_4)
trolley_arms = Curve(graft(merge_33))
armpivotholediameter_5 = Number(armpivotholediameter)
armmaterialthickness_15 = Number(armmaterialthickness)
end_14 = EndPoints(Curve=trolley_arms)  # -> Start, End
merge_34 = Merge(Data1=back_arm_midpoint_2, Data2=front_arm_midpoint_2)  # -> graft(Result)
arm_width_18 = Number(arm_width_5)
end_15 = EndPoints(Curve=rotating_arms_3)  # -> Start, End
merge_35 = Merge(Data1=end_14.Start, Data2=end_14.End)
pt_15 = Point(end_14.Start)
merge_36 = Merge(Data1=end_15.Start, Data2=end_15.End, Data3=merge_34, Data4=pt_15)  # -> simplify(Result)
crv_18 = Curve(simplify(rotating_arms_3))
crv_19 = Curve(simplify(trolley_arms))
pt_16 = Point(simplify(merge_35))
entwine_6 = Entwine(Branch0X=crv_18, Branch1X=crv_19, FlattenInputs=False)
entwine_7 = Entwine(Branch0X=merge_36, Branch1X=pt_16, FlattenInputs=False)
xz_7 = XZPlane(Origin=Point(0, 0, 0))
armmaterialthickness_16 = Number(armmaterialthickness)
panel_16 = Panel("""1
1
2
2""")
vec_8 = Vector(xz_7)
fingergap_12 = Number(fingergap)
expression_13 = Expression(n=panel_16, t=armmaterialthickness_16, g=fingergap_12, Expression="n*g+(n-1)*t")
multiplication_10 = Multiplication(A=expression_13, B=vec_8)
mirrorplane_6 = Plane(mirrorplane)

# ----
division_8 = Division(A=arm_width_18, B=2)
multiplication_11 = Multiplication(A=division_8, B=-1)
end_16 = EndPoints(Curve=entwine_6)  # -> Start, End
merge_37 = Merge(Data1=division_8, Data2=multiplication_11)
xz_8 = XZPlane(Origin=end_16.End)
xz_9 = XZPlane(Origin=end_16.Start)
cir = Circle(Plane=xz_8, Radius=division_8)
cir_2 = Circle(Plane=xz_9, Radius=division_8)
offset_3 = OffsetCurve(Curve=entwine_6, Distance=merge_37, Plane=xz_2, Corners=1)
merge_38 = Merge(Data1=cir_2, Data2=cir)
pshift = ShiftPaths(Data=offset_3, Offset=-1)
end_17 = EndPoints(Curve=pshift)  # -> Start, End
item_23 = ListItem(List=end_17.End, Index=0, Wrap=True)  # -> Item, Item1
item_24 = ListItem(List=end_17.Start, Index=0, Wrap=True)  # -> Item, Item1
division_9 = Division(A=armpivotholediameter_5, B=2)
ln_7 = Line(StartPoint=item_24.Item, EndPoint=item_24.Item1)
ln_8 = Line(StartPoint=item_23.Item, EndPoint=item_23.Item1)
xz_10 = XZPlane(Origin=entwine_7)
merge_39 = Merge(Data1=ln_7, Data2=ln_8, Data3=pshift)
cir_3 = Circle(Plane=xz_10, Radius=division_9)
join_4 = JoinCurves(Curves=merge_39, Preserve=False)  # -> simplify(Curves)
merge_40 = Merge(Data1=cir_2, Data2=cir, Data3=join_4)
multiplication_12 = Multiplication(A=armmaterialthickness_15, B=-1)
runion = RegionUnion(Curves=merge_40)  # -> simplify(Result)
vec_9 = VectorXYZ(XComponent=0, YComponent=multiplication_12, ZComponent=0)  # -> Vector, Length
merge_41 = Merge(Data1=runion, Data2=cir_3)
extr_7 = Extrude(Base=runion, Direction=vec_9.Vector)
extr_8 = Extrude(Base=cir_3, Direction=vec_9.Vector)
cap_7 = CapHoles(Brep=extr_7)
cap_8 = CapHoles(Brep=extr_8)
sdiff = SolidDifference(BrepsA=cap_7, BrepsB=cap_8)

# ---- group: XZ Breps for rotating arms (continued)
brep_3 = Brep(flatten(sdiff))
move_11 = Move(Geometry=brep_3, Motion=multiplication_10)  # -> Geometry, Transform
mirror_5 = Mirror(Geometry=move_11.Geometry, Plane=mirrorplane_6)  # -> Geometry, Transform
merge_42 = Merge(Data1=move_11.Geometry, Data2=mirror_5.Geometry)

# ----
mesh_7 = MeshBrep(Brep=merge_42, Settings=jagged_4)
mcol_7 = MeshColours(Mesh=mesh_7, Colours=ColourSwatch(SwatchColor=RGB(186, 237, 255)))

armmaterialthickness_17 = Number(armmaterialthickness)
X_4 = UnitX(Factor=armmaterialthickness_17)
Z_4 = UnitZ(Factor=1)
Y_8 = UnitY(Factor=1)
startpts = Entwine(
    Branch00=front_trolley_stabiliser_outline.StartPt,
    Branch01=back_trolley_stabiliser_outline.StartPt,
    Branch02=middle_unit_vertical_stabiliser_outline.StartPt,
    Branch03=middle_unit_horizontal_stabiliser_outlin.StartPt,
    Branch04=rotating_arms_stabiliser_outline.StartPt,
    FlattenInputs=True)
zigzags = Entwine(
    Branch00=front_trolley_stabiliser_outline.ZigZags,
    Branch01=back_trolley_stabiliser_outline.ZigZags,
    Branch02=middle_unit_vertical_stabiliser_outline.ZigZags,
    Branch03=middle_unit_horizontal_stabiliser_outlin.ZigZags,
    Branch04=rotating_arms_stabiliser_outline.ZigZags,
    FlattenInputs=True)
ns = Entwine(
    Branch00=front_trolley_stabiliser_outline.n_out,
    Branch01=back_trolley_stabiliser_outline.n_out,
    Branch02=middle_unit_vertical_stabiliser_outline.n_out,
    Branch03=middle_unit_horizontal_stabiliser_outlin.n_out,
    Branch04=rotating_arms_stabiliser_outline.n_out,
    FlattenInputs=True)
dir1s = Entwine(
    Branch00=Z_4,
    Branch01=Z_4,
    Branch02=Z_4,
    Branch03=X_3,
    Branch04=rotating_arms_stabiliser_outline.ArmUnitVector,
    FlattenInputs=True)
dir2s = Entwine(Branch00=Y_8, Branch01=Y_8, Branch02=Y_8, Branch03=Y_8, Branch04=Y_8, FlattenInputs=True)
fingergap_13 = Number(fingergap)
armmaterialthickness_18 = Number(armmaterialthickness)
zigzag_polyline_2 = CSharpScript(StartPt=startpts, ZigZags=zigzags, Dir1=dir1s, Dir2=dir2s, Close="True")  # -> out, Pl; inputs StartPt: Point3d, ZigZags: list of Double, Dir1: Vector3d, Dir2: Vector3d, Mirror: Boolean, Close: Boolean; same code as zigzag_polyline
expression_14 = Expression(t=armmaterialthickness_18, n=ns, g=fingergap_13, Expression="n*(t + g)")
vec_10 = VectorXYZ(XComponent=0, YComponent=expression_14, ZComponent=0)  # -> Vector, Length
rev_8 = Reverse(Vector=vec_10.Vector)
crv_20 = Curve(zigzag_polyline_2.Pl)
move_12 = Move(Geometry=crv_20, Motion=rev_8)  # -> Geometry, Transform

rev_9 = Reverse(Vector=X_4)

extrudedirs = Entwine(Branch00=rev_9, Branch01=X_4, Branch02=X_4, Branch03=Z_3, Branch04=multiplication_9, FlattenInputs=True)
extr_9 = Extrude(Base=move_12.Geometry, Direction=extrudedirs)
cap_9 = CapHoles(Brep=extr_9)

panel_17 = Panel(zigzag_polyline_2.out)
panel_18 = Panel(cap_9)
branch = TreeBranch(Tree=move_12.Geometry, Path="{0;3}", MaintainPaths=True)
mesh_8 = MeshBrep(
    Brep=cap_9,
    Settings={GridMaxCount=0, GridMinCount=16, JaggedSeams=False, MaxEdgeLength=0, MinEdgeLength=0.0001, MinTolerance=0, Refine=True, RefineAngle=0, RelativeTolerance=0.65, SimplePlanes=True, Tolerance=0})
mcol_8 = MeshColours(Mesh=mesh_8, Colours=ColourSwatch(SwatchColor=RGB(209, 56, 166)))
merge_43 = Merge(Data1=mesh_7, Data2=mesh_4, Data3=mesh_6, Data4=mesh, Data5=mesh_2, Data6=mesh_3, Data7=mesh_5, Data8=mesh_8)  # -> flatten(Result); disabled
merge_44 = Merge(Data1=mcol_7, Data2=mcol, Data3=mcol_2, Data4=mcol_3, Data5=mcol_5, Data6=mcol_6, Data7=mcol_4, Data8=mcol_8)  # -> flatten(Result)

# ---- group: RH_OUT:Meshes
mesh_9 = Mesh(merge_44)

# ----
panel_19 = Panel(mesh_9)
