# Grasshopper definition cube.gh (Grasshopper 1.0.8)

width = Slider(3, range=0.1..10)
length = Slider(4, range=0.1..10)
height = Slider(5, range=0.1..10)
width_2 = GetNumber(width, AtLeast=1, AtMost=1, Maximum=1.797693135e+308, Minimum=-1.797693135e+308, TreeAccess=False)
length_2 = GetNumber(length, AtLeast=1, AtMost=1, Maximum=1.797693135e+308, Minimum=-1.797693135e+308, TreeAccess=False)
height_2 = GetNumber(height, AtLeast=1, AtMost=1, Maximum=1.797693135e+308, Minimum=-1.797693135e+308, TreeAccess=False)
vec = VectorXYZ(XComponent=0, YComponent=0, ZComponent=height_2)  # -> Vector, Length
rectangle = Rectangle(Plane=PlaneXY(0, 0, 0), XSize=width_2, YSize=length_2, Radius=0)  # -> Rectangle, Length
extr = Extrude(Base=rectangle.Rectangle, Direction=vec.Vector)
cap = CapHoles(Brep=extr)
edges = BrepEdges(Brep=cap)  # -> Naked, Interior, NonManifold
mesh = MeshBrep(
    Brep=cap,
    Settings={GridMaxCount=0, GridMinCount=16, JaggedSeams=False, MaxEdgeLength=0, MinEdgeLength=0.0001, MinTolerance=0, Refine=True, RefineAngle=0, RelativeTolerance=0.65, SimplePlanes=True, Tolerance=0})

# ---- group: RH_OUT:Cube
mesh_2 = Mesh(mesh)

# ---- group: RH_OUT:CubeEdges
crv = Curve(edges.Interior)
