# Grasshopper definition cube_box.gh (Grasshopper 1.0.8)

length = GetNumber(Slider(279.8, range=1..1000), AtLeast=1, AtMost=1, Maximum=1.797693135e+308, Minimum=-1.797693135e+308, TreeAccess=False)
height = GetNumber(Slider(289, range=1..1000), AtLeast=1, AtMost=1, Maximum=1.797693135e+308, Minimum=-1.797693135e+308, TreeAccess=False)
wall_thickness = GetNumber(Slider(34.8, range=0..250), AtLeast=1, AtMost=1, Maximum=1.797693135e+308, Minimum=-1.797693135e+308, TreeAccess=False)
num = Number(height)
num_2 = Number(wall_thickness)
pt = ConstructPoint(XCoordinate=0, YCoordinate=0, ZCoordinate=0)
pt_2 = ConstructPoint(XCoordinate=length, YCoordinate=length, ZCoordinate=0)
vec = VectorXYZ(XComponent=0, YComponent=0, ZComponent=num)  # -> Vector, Length
subtraction = Subtraction(A=num, B=num_2)
subtraction_2 = Subtraction(A=length, B=num_2)
pt_3 = ConstructPoint(XCoordinate=num_2, YCoordinate=num_2, ZCoordinate=num_2)
pt_4 = ConstructPoint(XCoordinate=subtraction_2, YCoordinate=subtraction_2, ZCoordinate=0)
vec_2 = VectorXYZ(XComponent=0, YComponent=0, ZComponent=subtraction)  # -> Vector, Length
xy = XYPlane(Origin=pt_3)
rec_2pt = Rectangle2Pt(Plane=PlaneXY(0, 0, 0), PointA=pt, PointB=pt_2, Radius=0)  # -> Rectangle, Length
rec_2pt_2 = Rectangle2Pt(Plane=xy, PointA=pt_3, PointB=pt_4, Radius=0)  # -> Rectangle, Length
extr = Extrude(Base=rec_2pt.Rectangle, Direction=vec.Vector)
extr_2 = Extrude(Base=rec_2pt_2.Rectangle, Direction=vec_2.Vector)
cap = CapHoles(Brep=extr)
cap_2 = CapHoles(Brep=extr_2)
sdiff = SolidDifference(BrepsA=cap, BrepsB=cap_2)
mesh = MeshBrep(
    Brep=sdiff,
    Settings={GridMaxCount=0, GridMinCount=16, JaggedSeams=False, MaxEdgeLength=0, MinEdgeLength=0.0001, MinTolerance=0, Refine=True, RefineAngle=0, RelativeTolerance=0.65, SimplePlanes=True, Tolerance=0})

# ---- group: RH_OUT:Mesh
mesh_2 = Mesh(mesh)
