# Grasshopper definition cylinder_inside_cylinder.gh (Grasshopper 1.0.7)

radius = GetNumber(Slider(100, range=1..1000), AtLeast=1, AtMost=1, Maximum=1.797693135e+308, Minimum=-1.797693135e+308, TreeAccess=False)
height = GetNumber(Slider(100, range=1..1000), AtLeast=1, AtMost=1, Maximum=1.797693135e+308, Minimum=-1.797693135e+308, TreeAccess=False)
pt = ConstructPoint(XCoordinate=0, YCoordinate=0, ZCoordinate=0)
division = Division(A=height, B="2")
division_2 = Division(A=radius, B="2")
create_cylinder = CreateCylinder(O=pt, R=radius, Z=height)
create_cylinder_2 = CreateCylinder(O=pt, R=division_2, Z=division)
sdiff = SolidDifference(BrepsA=create_cylinder, BrepsB=create_cylinder_2)
mesh = MeshBrep(
    Brep=sdiff,
    Settings={GridMaxCount=0, GridMinCount=16, JaggedSeams=False, MaxEdgeLength=0, MinEdgeLength=0.0001, MinTolerance=0, Refine=True, RefineAngle=0, RelativeTolerance=0.65, SimplePlanes=True, Tolerance=0})

# ---- group: RH_OUT:Mesh
mesh_2 = Mesh(mesh)

# ==== cluster CreateCylinder
O = ClusterInput()
R = ClusterInput()
xy = XYPlane(Origin=O)
Z = ClusterInput()
cir = Circle(Plane=xy, Radius=R)
vec = VectorXYZ(XComponent=0, YComponent=0, ZComponent=Z)  # -> Vector, Length
extr = Extrude(Base=cir, Direction=vec.Vector)
cap = CapHoles(Brep=extr)
B = ClusterOutput(cap)
