# Grasshopper definition extruded_polygon_public.gh (Grasshopper 1.0.8)

show_fillets = GetBoolean("true", AtLeast=1, AtMost=1, FalseValue="False", TreeAccess=False, TrueValue="True")
get_number = GetNumber(Slider(5, range=1..10), AtLeast=1, AtMost=1, Maximum=1.797693135e+308, Minimum=-1.797693135e+308, TreeAccess=False)
radius = GetNumber(Slider(50, range=1..100), AtLeast=1, AtMost=1, Maximum=1.797693135e+308, Minimum=-1.797693135e+308, TreeAccess=False)
fillet_radius = GetNumber(Slider(5, range=0..10), AtLeast=1, AtMost=1, Maximum=1.797693135e+308, Minimum=-1.797693135e+308, TreeAccess=False)
length = GetNumber(Slider(100, range=0.1..1000), AtLeast=1, AtMost=1, Maximum=1.797693135e+308, Minimum=-1.797693135e+308, TreeAccess=False)
bool = Boolean(show_fillets)
int = Integer(get_number)
xz = XZPlane(Origin=Point(0, 0, 0))
num = Number(length)
filter = StreamFilter(Gate=bool, Stream0="0", Stream1=fillet_radius)
polygon = Polygon(Plane=xz, Radius=radius, Segments=int, FilletRadius=filter)  # -> Polygon, Length
vec = VectorXYZ(XComponent=0, YComponent=0, ZComponent=radius)  # -> Vector, Length
vec_2 = VectorXYZ(XComponent=0, YComponent=num, ZComponent=0)  # -> Vector, Length
move = Move(Geometry=polygon.Polygon, Motion=vec.Vector)  # -> Geometry, Transform
extr = Extrude(Base=move.Geometry, Direction=vec_2.Vector)
mesh = MeshBrep(
    Brep=extr,
    Settings={GridMaxCount=0, GridMinCount=16, JaggedSeams=False, MaxEdgeLength=0, MinEdgeLength=0.0001, MinTolerance=0, Refine=True, RefineAngle=0, RelativeTolerance=0.65, SimplePlanes=True, Tolerance=0})

# ---- group: RH_OUT:Mesh
mesh_2 = Mesh(mesh)
