# Grasshopper definition kitchen_nietecht.gh (Grasshopper 1.0.7)
# ### Summary
# 
# Working model for the kitchenette for the Nietecht family in Armevoort, East Brabant.
# 
# ### Inputs
# - Length - overall length
# - Depth
# 
# Currently set to the dimensions in the architect's plans with settings and configuration loaded from data from the interior designer.

length = GetNumber(
    Slider(2000, range=1500..2500),
    AtLeast=1,
    AtMost=1,
    Maximum=1.797693135e+308,
    Minimum=-1.797693135e+308,
    TreeAccess=False)
depth = GetNumber(Slider(600, range=300..900), AtLeast=1, AtMost=1, Maximum=1.797693135e+308, Minimum=-1.797693135e+308, TreeAccess=False)
cluster = BasicKitchenetteModel(depth=depth, length=length)  # -> disassembled, tx, assembled
to_plywood_coloured_meshes = CSharpScript(B=graft(cluster.disassembled), Tx=graft(cluster.tx))  # -> out, G, Painted, Exposed; inputs B: list of Brep, Tx: Transform
# ---------- to_plywood_coloured_meshes: C# usings ----------
using System.IO;
using System.Linq;
using System.Data;
using System.Drawing;
using System.Reflection;
using System.Windows.Forms;
using System.Xml;
using System.Xml.Linq;
using System.Runtime.InteropServices;

using Rhino.DocObjects;
using Rhino.Collections;
using GH_IO;
using GH_IO.Serialization;
# ---------- to_plywood_coloured_meshes: C# ----------
    var arranged = new List<Brep>();
    var tol = 0.01;

    List<Brep> exposed = new List<Brep>();
    List<Brep> painted = new List<Brep>();

    int groupCounter = 1;

    foreach (Brep b in B)
    {
      var horizontals = new Dictionary<double, List<Brep>>();
      var others = new List<Brep>();

      var exploded = NbExplode(b);
      foreach (var e in exploded)
      {
        Point3d p;
        var normal = Normal(e, out p);
        if (Math.Abs(normal.IsParallelTo(Vector3d.ZAxis, tol)) != 0)
        {
          var rounded = Math.Round(p.Z, 2);
          if (!horizontals.ContainsKey(rounded))
          {
            horizontals.Add(rounded, new List<Brep> { e });
          }
          else
          {
            horizontals[rounded].Add(e);
          }
        }
        else
        {
          others.Add(e);
        }
      }
      var minZ = horizontals.Keys.Min();
      var maxZ = horizontals.Keys.Max();
      var notFaces = horizontals.Keys.Where(k => !(EpsilonEquals(k, minZ, tol) || EpsilonEquals(k, maxZ, tol)))
        .SelectMany(k => horizontals[k]);
      others = others.Concat(notFaces).ToList();
      var faces = horizontals.Keys.SelectMany(k => horizontals[k]).Except(notFaces).ToList();

      foreach (Brep f in faces)
      {
        f.Transform(Tx);
        painted.Add(f);
      }

      foreach (Brep o in others)
      {
        o.Transform(Tx);
        exposed.Add(o);
      }
      groupCounter++;
    }
    G = arranged;
    Painted = painted;
    Exposed = exposed;
# ---------- to_plywood_coloured_meshes: C# additional code ----------
  public bool EpsilonEquals(double d1, double d2, double tolerance)
  {
    return (Math.Abs(d1 - d2) < tolerance);
  }

  public static Brep[] NbExplode(Brep brep)
  {
    var explodedBreps = new List<Brep>();
    for (var i = 0; i < brep.Faces.Count; i++)
    {
      var faceBrep = brep.Faces[i].DuplicateFace(false);
      if (faceBrep.IsValid && faceBrep.GetArea() > 0.01)
      {
        explodedBreps.Add(faceBrep);
      }
    }

    return explodedBreps.ToArray();
  }
  
  public static Vector3d Normal(Brep b, out Point3d surfacePointUsed)
  {
    var uDomain = b.Faces[0].Domain(0);
    var vDomain = b.Faces[0].Domain(1);
    var u = uDomain.Mid;
    var v = vDomain.Mid;
    surfacePointUsed = b.Faces[0].PointAt(u, v);
    return b.Faces[0].NormalAt(u, v);
  }
# ---------- end to_plywood_coloured_meshes ----------
brep = Brep(flatten(to_plywood_coloured_meshes.Painted))
brep_2 = Brep(flatten(to_plywood_coloured_meshes.Exposed))
mesh = MeshBrep(
    Brep=brep_2,
    Settings={GridMaxCount=0, GridMinCount=16, JaggedSeams=False, MaxEdgeLength=0, MinEdgeLength=0.0001, MinTolerance=0, Refine=True, RefineAngle=0, RelativeTolerance=0.65, SimplePlanes=True, Tolerance=0})
mesh_2 = MeshBrep(
    Brep=brep,
    Settings={GridMaxCount=0, GridMinCount=16, JaggedSeams=False, MaxEdgeLength=0, MinEdgeLength=0.0001, MinTolerance=0, Refine=True, RefineAngle=0, RelativeTolerance=0.65, SimplePlanes=True, Tolerance=0})
mcol = MeshColours(Mesh=mesh_2, Colours=ColourSwatch(SwatchColor=RGB(255, 209, 241)))
mcol_2 = MeshColours(Mesh=mesh, Colours=ColourSwatch(SwatchColor=RGB(156, 100, 51)))
merge = Merge(Data1=mcol, Data2=mcol_2)

# ---- group: RH_OUT:Meshes
mesh_3 = Mesh(merge)

# ==== cluster BasicKitchenetteModel: ### Summary Standard 3-cabinet base kitchenette model, including pantry, sink unit and space for a microwave. ### Inputs - Depth (mm) - overall depth - Length (mm) - overall length - Settings (JSON string) - hardware and joint - Config (JSON string) - drawer, shelf and door configuration Comes with default settings and configuration.
length = ClusterInput()
depth = ClusterInput()
settings = ClusterInput()
config = ClusterInput()
length_2 = GetNumber(
    Slider(2000, range=1500..2500),
    AtLeast=1,
    AtMost=1,
    Maximum=1.797693135e+308,
    Minimum=-1.797693135e+308,
    TreeAccess=False)
depth_2 = GetNumber(Slider(600, range=300..900), AtLeast=1, AtMost=1, Maximum=1.797693135e+308, Minimum=-1.797693135e+308, TreeAccess=False)
length_3 = Number(length)
depth_3 = Number(depth)
length_4 = Number(length_2)
settings_2 = Text(settings)
config_2 = Text(config)
null = NullItem(Item=depth_3)  # -> NullFlags, InvalidFlags, Description
null_2 = NullItem(Item=length_3)  # -> NullFlags, InvalidFlags, Description
depth_4 = Number(depth_2)
filter = StreamFilter(Gate=null.NullFlags, Stream0=depth_3, Stream1=depth_4)
filter_2 = StreamFilter(Gate=null_2.NullFlags, Stream0=length_3, Stream1=length_4)

# ---- group: Disassembled 3D
_1 = Brep(flatten(Tree({0}: [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], {1}: [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], {2}: [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], {3}: [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], {4}: [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], {5}: [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]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)))
_2 = Brep(flatten(Tree({0}: [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], {1}: [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], {2}: [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], {3}: [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], {4}: [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], {5}: [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]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)))
_3 = Brep(flatten(Tree({0}: [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], {1}: [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], {2}: [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], {3}: [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], {4}: [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], {5}: [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]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)))

# ----
transform = Transform(flatten(Tree({0}: [{TransformCount=1, Name="Generic", m00=0, m01=0, m02=1, m03=0, m10=1, m11=0, m12=0, m13=0, m20=0, m21=1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}], {1}: [{TransformCount=1, Name="Generic", m00=1, m01=0, m02=0, m03=-612, m10=0, m11=1, m12=0, m13=-3200, m20=0, m21=0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}], {2}: [{TransformCount=1, Name="Generic", m00=0, m01=0, m02=-1, m03=600, m10=-1, m11=0, m12=0, m13=1860, m20=0, m21=1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}], {3}: [{TransformCount=1, Name="Generic", m00=1, m01=0, m02=0, m03=-612, m10=0, m11=-1, m12=0, m13=6260, m20=0, m21=0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}], {4}: [{TransformCount=1, Name="Generic", m00=1, m01=0, m02=0, m03=18, m10=0, m11=1, m12=0, m13=-6290, m20=0, m21=0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}], {5}: [{TransformCount=1, Name="Generic", m00=1, m01=0, m02=0, m03=-594, m10=0, m11=1, m12=0, m13=-6290, m20=0, m21=0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}]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)))
transform_2 = Transform(flatten(Tree({0}: [{TransformCount=1, Name="Generic", m00=0, m01=0, m02=1, m03=0, m10=1, m11=0, m12=0, m13=0, m20=0, m21=1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}], {1}: [{TransformCount=1, Name="Generic", m00=1, m01=0, m02=0, m03=-762, m10=0, m11=1, m12=0, m13=-3200, m20=0, m21=0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}], {2}: [{TransformCount=1, Name="Generic", m00=0, m01=0, m02=-1, m03=600, m10=-1, m11=0, m12=0, m13=2160, m20=0, m21=1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}], {3}: [{TransformCount=1, Name="Generic", m00=1, m01=0, m02=0, m03=-762, m10=0, m11=-1, m12=0, m13=6560, m20=0, m21=0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}], {4}: [{TransformCount=1, Name="Generic", m00=1, m01=0, m02=0, m03=18, m10=0, m11=1, m12=0, m13=-6590, m20=0, m21=0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}], {5}: [{TransformCount=1, Name="Generic", m00=1, m01=0, m02=0, m03=-594, m10=0, m11=1, m12=0, m13=-6590, m20=0, m21=0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}]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)))
transform_3 = Transform(flatten(Tree({0}: [{TransformCount=1, Name="Generic", m00=0, m01=0, m02=1, m03=0, m10=1, m11=0, m12=0, m13=0, m20=0, m21=1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}], {1}: [{TransformCount=1, Name="Generic", m00=1, m01=0, m02=0, m03=-762, m10=0, m11=1, m12=0, m13=-3200, m20=0, m21=0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}], {2}: [{TransformCount=1, Name="Generic", m00=0, m01=0, m02=-1, m03=525, m10=-1, m11=0, m12=0, m13=2085, m20=0, m21=1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}], {3}: [{TransformCount=1, Name="Generic", m00=1, m01=0, m02=0, m03=-762, m10=0, m11=-1, m12=0, m13=6560, m20=0, m21=0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}], {4}: [{TransformCount=1, Name="Generic", m00=1, m01=0, m02=0, m03=18, m10=0, m11=1, m12=0, m13=-6590, m20=0, m21=0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}], {5}: [{TransformCount=1, Name="Generic", m00=1, m01=0, m02=0, m03=-519, m10=0, m11=1, m12=0, m13=-6590, m20=0, m21=0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}]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)))

_3_2 = Brep(flatten(Tree({0}: [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], {1}: [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], {2}: [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], {3}: [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], {4}: [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], {5}: [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]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)))
_2_2 = Brep(flatten(Tree({0}: [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], {1}: [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], {2}: [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], {3}: [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], {4}: [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], {5}: [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]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)))
_1_2 = Brep(flatten(Tree({0}: [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], {1}: [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], {2}: [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], {3}: [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], {4}: [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], {5}: [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]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)))

c_script = CSharpScript(
    Depth=filter,
    Length=filter_2,
    Set1=_1_2,
    Set2=_2_2,
    Set3=_3_2,
    Tx1=transform,
    Tx2=transform_2,
    Tx3=transform_3,
    Flat1=_1,
    Flat2=_2,
    Flat3=_3)  # -> out, Disassembled, Tx, Assembled; inputs Depth: Double, Length: Double, Set1: list of Brep, Set2: list of Brep, Set3: list of Brep, Tx1: list, Tx2: list, Tx3: list, Flat1: list, Flat2: list, Flat3: list
# ---------- c_script: C# ----------
    if (Depth > 650 && Length > 1900 && Length < 2100)
    {
      Print("Two");
      Assembled = Set2;
      Tx = Tx2;
      Disassembled = Flat2;
    }
    else if (Depth > 650 && Length < 1900)
    {
      Print("Three");
      Assembled = Set3;
      Tx = Tx3;
      Disassembled = Flat3;
    }
    else
    {
      Print("One");
      Assembled = Set1;
      Tx = Tx1;
      Disassembled = Flat1;
    }
# ---------- end c_script ----------
disassembled = ClusterOutput(c_script.Disassembled)
assembled = ClusterOutput(c_script.Assembled)
tx = ClusterOutput(c_script.Tx)
