# Grasshopper definition my_published_file.gh (Grasshopper 1.0.8)

cluster = Cluster()  # -> X_2, Y_2

# ==== cluster Cluster
C = ClusterInput()
B = ClusterInput()
A = ClusterInput()
A_2 = Number(A)
C_2 = Number(C)
B_2 = Number(B)
addition = Addition(A=A_2, B=B_2)
subtraction = Subtraction(A=B_2, B=C_2)
multiplication = Multiplication(A=addition, B=subtraction)
division = Division(A=addition, B=subtraction)
Y = Number(division)
X = Number(multiplication)
X_2 = ClusterOutput(X)
Y_2 = ClusterOutput(Y)
