# Grasshopper definition nb_compound_5_240506.gh (Grasshopper 1.0.8)

C = Number()
B = B()
A = A()
C_2 = Number(C)
cluster = Cluster(A=A, B=B)
addition = Addition(A=cluster, B=C_2)
R = Result(addition)

# ==== cluster Cluster
B = ClusterInput()
A = ClusterInput()
subtraction = Subtraction(A=A, B=B)
R = ClusterOutput(subtraction)
