# Grasshopper definition nb_compound_four_240506.gh (Grasshopper 1.0.7)

C = Number()
B = B()
A = A()
C_2 = Number(C)
cluster = Cluster(A=A, B=B)
multiplication = Multiplication(A=cluster, B=C_2)
R = Result(multiplication)

# ==== cluster Cluster
B = ClusterInput()
A = ClusterInput()
addition = Addition(A=A, B=B)
R = ClusterOutput(addition)
