# Grasshopper definition nb_compound_three_240506.gh (Grasshopper 1.0.8)

B = B()
C = Number()
A = A()
cluster = Cluster(A=A, B=B)
C_2 = Number(C)
multiplication = Multiplication(A=cluster, B=C_2)
R = Result(multiplication)

# ==== cluster Cluster
A = ClusterInput()
B = ClusterInput()
multiplication = Multiplication(A=A, B=B)
R = ClusterOutput(multiplication)
