# Grasshopper definition pyramind.gh (Grasshopper 1.0.7)

side_length = GetNumber(Slider(5, range=0.1..10), AtLeast=1, AtMost=1, Maximum=1.797693135e+308, Minimum=-1.797693135e+308, TreeAccess=False)
height = GetNumber(Slider(5, range=0.1..10), AtLeast=1, AtMost=1, Maximum=1.797693135e+308, Minimum=-1.797693135e+308, TreeAccess=False)
num = Number(side_length)
pt = ConstructPoint(XCoordinate=num, YCoordinate=num, ZCoordinate=0)
pt_2 = ConstructPoint(XCoordinate=0, YCoordinate=0, ZCoordinate=0)
rec_2pt = Rectangle2Pt(Plane=PlaneXY(0, 0, 0), PointA=Point(0, 0, 0), PointB=pt, Radius=0)  # -> Rectangle, Length
ln = Line(StartPoint=pt, EndPoint=pt_2)
midpt = CurveMiddle(Curve=ln)
vec = VectorXYZ(XComponent=0, YComponent=0, ZComponent=height)  # -> Vector, Length
move = Move(Geometry=midpt, Motion=vec.Vector)  # -> Geometry, Transform
box_corners = BoxCorners(Box=rec_2pt.Rectangle)  # -> CornerA, CornerB, CornerC, CornerD, CornerE, CornerF, CornerG, CornerH
ln_2 = Line(StartPoint=box_corners.CornerA, EndPoint=move.Geometry)
ln_3 = Line(StartPoint=box_corners.CornerA, EndPoint=box_corners.CornerD)
ln_4 = Line(StartPoint=box_corners.CornerD, EndPoint=move.Geometry)
ln_5 = Line(StartPoint=box_corners.CornerD, EndPoint=move.Geometry)
ln_6 = Line(StartPoint=box_corners.CornerC, EndPoint=box_corners.CornerD)
ln_7 = Line(StartPoint=box_corners.CornerC, EndPoint=move.Geometry)
boundary = BoundarySurfaces(Edges=rec_2pt.Rectangle)
ln_8 = Line(StartPoint=box_corners.CornerB, EndPoint=move.Geometry)
ln_9 = Line(StartPoint=box_corners.CornerA, EndPoint=box_corners.CornerB)
ln_10 = Line(StartPoint=box_corners.CornerC, EndPoint=move.Geometry)
ln_11 = Line(StartPoint=box_corners.CornerB, EndPoint=box_corners.CornerC)
ln_12 = Line(StartPoint=box_corners.CornerA, EndPoint=move.Geometry)
ln_13 = Line(StartPoint=box_corners.CornerB, EndPoint=move.Geometry)
edgesrf = EdgeSurface(CurveA=ln_2, CurveB=ln_3, CurveC=ln_4)
edgesrf_2 = EdgeSurface(CurveA=ln_5, CurveB=ln_6, CurveC=ln_7)
edgesrf_3 = EdgeSurface(CurveA=ln_10, CurveB=ln_11, CurveC=ln_13)
edgesrf_4 = EdgeSurface(CurveA=ln_8, CurveB=ln_9, CurveC=ln_12)
merge = Merge(Data1=edgesrf, Data2=edgesrf_2, Data3=edgesrf_3, Data4=edgesrf_4, Data5=boundary)
join = BrepJoin(Breps=merge)  # -> Breps, Closed
mesh = MeshBrep(
    Brep=join.Breps,
    Settings={GridMaxCount=0, GridMinCount=16, JaggedSeams=False, MaxEdgeLength=0, MinEdgeLength=0.0001, MinTolerance=0, Refine=True, RefineAngle=0, RelativeTolerance=0.65, SimplePlanes=True, Tolerance=0})

# ---- group: RH_OUT:Mesh
mesh_2 = Mesh(mesh)
