# Grasshopper definition python_addition_on_test09.gh (Grasshopper 1.0.7)

x = X()
y = Y()
python = GhPythonScript(x=x, y=y)  # -> out, r
# ---------- python: Python ----------
__author__ = "nicol"
__version__ = "2024.02.23"

import rhinoscriptsyntax as rs

if x is not None and y is not None:
    r = x + y
else:
    # Handle the case where either x or y is None
    r = None  # Or any other appropriate action you want to take
# ---------- end python ----------
r = R(python.r)
