# Grasshopper definition side_table.gh (Grasshopper 1.0.7)

# ---- group: 3D model parameters
experimental_middle_section = BooleanToggle(False)
panel = Panel("""0.67
0.33""")
panel_2 = Panel("""300
406""")
panel_3 = Panel("""236.73
411.741""")
panel_4 = Panel("""65
67""")
multiplication = Multiplication(A="48", B="3")
drawerslidemidlineelevations = Number(panel_3)
fronttrolleypushershapedeviationparallel = Number(Slider(283, range=0..800))  # "FrontTrolleyPusherShapeDeviationParallelDistance"
fronttrolleypushershapedeviationperpdist = Number(Slider(0, range=0..400))  # "FrontTrolleyPusherShapeDeviationPerpDistance"
cluster = Cluster(numstuds=multiplication, theoretical=Toggle(True))
backtrolleypushershapedeviationparalleld = Number(Slider(157, range=0..800))  # "BackTrolleyPusherShapeDeviationParallelDistance"
fronttrolleydrawerslidelength = Number("300")
backtrolleydrawerslidelength = Number("406")
backtrolleypushershapedeviationperpdista = Number(Slider(86, range=0..400))  # "BackTrolleyPusherShapeDeviationPerpDistance"
slidelengths = Number(panel_2)
supportbeamheights = Number(panel_4)
fingergap = Number(Slider(15, range=0..50))
wheelheight = Number(Slider(50, range=20..100))
supportbeamsnormalisedxsalongl = Number(panel)
experimental_middle_section_2 = Boolean(experimental_middle_section)
platformmaterialthickness = Number(Slider(12, range=10..30))
armpivotholediameter = Number(Slider(10, range=3..30))
armmaterialthickness = Number(Slider(18, range=10..30))
shelflength = Number(cluster)
max = Maximum(A=fronttrolleydrawerslidelength, B=backtrolleydrawerslidelength)
min = Minimum(A=Slider(250, range=0..500), B=fronttrolleydrawerslidelength)

# ----
number_slider = Slider(50, range=20..80)
cluster_2 = Cluster(numstuds="48", theoretical=Toggle(True))
expression = Expression(aw=number_slider, t=armmaterialthickness, fg=fingergap, sl=max, w=cluster_2, Expression="w-(sl-aw-fg-(t+fg)-aw/2)")
expression_2 = Expression(aw=number_slider, t=armmaterialthickness, fg=fingergap, Expression="t + fg + aw/2")
division = Division(A=number_slider, B="2")
number_slider_2 = Slider(25, range=0..100)
addition = Addition(A=cluster_2, B=cluster_2, C=min)
pt = ConstructPoint(XCoordinate=0, YCoordinate=0, ZCoordinate=0)
# Adjustment to account for angle.  Remember to check the gap between the rear arm and the rear-most vertical U stabiliser (but just the horizontal part of that)
addition_2 = Addition(A=expression_2, B=Slider(-15, range=-100..0))
k_add_front = Number(expression)
subtraction = Subtraction(A=addition, B=division)
subtraction_2 = Subtraction(A=backtrolleydrawerslidelength, B=division)

# ----
# Currently the trolley
# offset start/end are how far the centre linse are away from the wall (x=0)
# Currently the diffs are vertical distances from the relative L points
backtrolley_bottom_vertical_diff = Number(Slider(-60, range=-400..200))
fronttrolley_offset_end = Number(subtraction)
fronttrolley_offset_start = Number(subtraction_2)
floor_wall_corner_point = Point(pt)
shelf_vertical_clearance = Number(Slider(33.5, range=0..200))
arm_floor_clearance = Number(Slider(10, range=0..100))
fronttrolley_top_diff = Number(Slider(-8.3, range=-300..200))
shelf_width = Number(cluster_2)
arm_start_degrees = Number(Slider(-2, range=-25..25))
arm_width = Number(number_slider)
k_add_front_2 = Number(Slider(137.1, range=0..200))
arm_gap = Number(Slider(15, range=5..50))
k_add_back = Number(addition_2)

backtrolley_offset_start = Number(division)
backtrolley_offset_end = Number(division)
rad = Radians(Degrees=arm_start_degrees)
backtrolley_bottom_diff = Number(backtrolley_bottom_vertical_diff)
fronttrolley_top_diff_2 = Number(fronttrolley_top_diff)
division_2 = Division(A=shelf_vertical_clearance, B="2")
multiplication_2 = Multiplication(A=backtrolley_bottom_vertical_diff, B=-1)
# This assumes the arms rotate from top towards the RIGHT.
# 
# Angles in inputs are relative to VERTICAL.
# 
# Also these inputs are don't refer to the centre points or lines; they refer to the measurements based on edges of physical pieces.  e.g. the minimum arm height is not the height of the arm's extreme rotation point but the lower edge of the physical arm (with its width etc).
number_slider_3 = Slider(100, range=0..100)
abs = Absolute(Value=rad)
shelf_width_2 = Number(shelf_width)
k_add_back_2 = Number(k_add_back)
middle_l_to_top_l_drop_down = Number(division_2)
k_add_back_3 = Number(k_add_back_2)
subtraction_3 = Subtraction(A=shelf_width_2, B=backtrolley_offset_start)
k_add_front_3 = Number(k_add_front_2)
merge = Merge(Data1=fronttrolley_top_diff_2, Data2=multiplication_2)
shelf_width_3 = Number(shelf_width)
k_add_front_4 = Number(k_add_front_2)
k_add_back_4 = Number(k_add_back_2)
g_gamma = Number(abs)
arm_width_2 = Number(arm_width)
subtraction_4 = Subtraction(A=fronttrolley_offset_start, B=k_add_back_3)
subtraction_5 = Subtraction(A=subtraction_3, B=k_add_front_3)
multiplication_3 = Multiplication(A=shelf_width_2, B="2")
subtraction_6 = Subtraction(A=fronttrolley_offset_end, B=shelf_width_2)
cluster_3 = Cluster_2(
    s=shelf_width_3,
    h=middle_l_to_top_l_drop_down,
    g=g_gamma,
    w=arm_width_2,
    ag=arm_gap,
    ac=arm_floor_clearance,
    ka_back=k_add_back_4,
    ka_front=k_add_front_4)  # -> A, R, K, J, l_height, l_width, topshelf_height, middleshelf_height, bottomshelf_height
merge_2 = Merge(Data1=subtraction_4, Data2=subtraction_5)
k_add_front_5 = Number(k_add_front_2)
k_add_back_5 = Number(k_add_back_2)
subtraction_7 = Subtraction(A=multiplication_3, B=backtrolley_offset_end)
num = Number(arm_gap)
rotation = GetNumber(number_slider_3, AtLeast=1, AtMost=1, Maximum=1.797693135e+308, Minimum=-1.797693135e+308, TreeAccess=False)
floor_wall_corner_point_2 = Point(floor_wall_corner_point)
subtraction_8 = Subtraction(A=subtraction_6, B=k_add_back_5)
subtraction_9 = Subtraction(A=subtraction_7, B=k_add_front_5)
arm_angle_x_component = Number(cluster_3.K)
middle_l_to_top_l_drop_down_2 = Number(middle_l_to_top_l_drop_down)
deg = Degrees(Radians=cluster_3.A)
merge_3 = Merge(Data1=subtraction_8, Data2=subtraction_9)
arm_final_angle = Number(cluster_3.A)
arm_final_angle_alpha = Number(arm_final_angle)
arm_length = Number(cluster_3.R)
arm_angle_x_component_2 = Number(cluster_3.K)
arm_angle_x_component_k = Number(arm_angle_x_component_2)
middle_to_top_rotation_vertical = Number(cluster_3.J)
l_height = Number(cluster_3.l_height)
l_width = Number(cluster_3.l_width)
top_shelf_height = Number(cluster_3.topshelf_height)
table_height = Number(cluster_3.middleshelf_height)
bottom_shelf_height = Number(cluster_3.bottomshelf_height)
g_gamma_2 = Number(g_gamma)
table_height_2 = Number(table_height)
pdecon = Deconstruct(Point=floor_wall_corner_point_2)  # -> XComponent, YComponent, ZComponent
cluster_4 = Cluster_3(x1=merge_2, x2=merge_3, d_tr=merge, k=arm_angle_x_component, a=arm_final_angle_alpha, g=g_gamma_2)  # -> armlength, pusherlength
subtraction_10 = Subtraction(A=table_height_2, B=middle_l_to_top_l_drop_down_2)
addition_3 = Addition(A=pdecon.XComponent, B=arm_angle_x_component_k)
addition_4 = Addition(A=deg, B="90")
k_add_back_6 = Number(k_add_back)
pt_2 = ConstructPoint(XCoordinate=addition_3, YCoordinate=subtraction_10, ZCoordinate=0)
vec = VectorXYZ(XComponent=k_add_back_6, YComponent=0, ZComponent=0)  # -> Vector, Length
arm_angle_x_component_k_2 = Number(arm_angle_x_component_2)
k_add_back_7 = Number(k_add_back_2)
addition_5 = Addition(A=vec.Vector, B=pt_2)
item = ListItem(List=cluster_4.armlength, Index=0, Wrap=True)  # -> Item, Item1
item_2 = ListItem(List=cluster_4.pusherlength, Index=0, Wrap=True)  # -> Item, Item1
multiplication_4 = Multiplication(A=arm_angle_x_component_k_2, B="2")
pdecon_2 = Deconstruct(Point=addition_5)  # -> XComponent, YComponent, ZComponent
l_width_2 = Number(l_width)
l_height_2 = Number(l_height)
l_width_3 = Number(l_width)
arm_angle_x_component_k_3 = Number(arm_angle_x_component_2)
middle_l_to_top_l_drop_down_3 = Number(middle_l_to_top_l_drop_down)
top_shelf_height_2 = Number(top_shelf_height)
multiplication_5 = Multiplication(A=middle_l_to_top_l_drop_down_2, B="2")
bottom_shelf_height_2 = Number(bottom_shelf_height)
addition_6 = Addition(A=k_add_back_7, B=arm_angle_x_component_k_2)
addition_7 = Addition(A=k_add_back_7, B=multiplication_4)
arm_length_2 = Number(arm_length)
table_height_3 = Number(table_height)
backtrolley_bottom_diff_2 = Number(backtrolley_bottom_diff)
fronttrolley_top_diff_3 = Number(fronttrolley_top_diff_2)
addition_8 = Addition(A=l_width_3, B=pdecon_2.XComponent)
subtraction_11 = Subtraction(A=pdecon_2.YComponent, B=l_height_2)
floor_wall_corner_point_3 = Point(floor_wall_corner_point)
shelf_width_4 = Number(shelf_width)
arm_start_degrees_2 = Number(arm_start_degrees)
arm_width_3 = Number(arm_width)
pt_3 = ConstructPoint(XCoordinate=addition_8, YCoordinate=subtraction_11, ZCoordinate=0)
middle_platform_vertical_offset = Number(middle_l_to_top_l_drop_down_3)

fronttrolley_arm_length = Number(item.Item)
fronttrolley_pusher_length = Number(item_2.Item)
backtrolley_arm_length = Number(item.Item1)
backtrolley_pusher_length = Number(item_2.Item1)
floor_wall_corner_point_4 = Point(floor_wall_corner_point_3)
fronttrolley_top_diff_4 = Number(fronttrolley_top_diff_3)
backtrolley_bottom_diff_3 = Number(backtrolley_bottom_diff_2)
arm_start_degrees_3 = Number(arm_start_degrees_2)
bottom_shelf_height_3 = Number(bottom_shelf_height_2)
middle_l_left_point = Point(addition_5)
arm_end_degrees = Number(addition_4)
shelf_width_5 = Number(shelf_width_4)
middle_l_right_point = Point(pt_3)
l_points_height = Number(l_height_2)
arm_width_4 = Number(arm_width_3)
xoffsetpershelf = Number(arm_angle_x_component_k_3)
l_points_width = Number(l_width_2)
top_shelf_height_3 = Number(top_shelf_height_2)
arm_length_3 = Number(arm_length_2)

bottom_platform_x_offset = Number(addition_7)
top_platform_vertical_offset = Number(multiplication_5)
middle_platform_x_offset = Number(addition_6)
top_platform_x_offset = Number(k_add_back_7)
middle_shelf_height = Number(table_height_3)
arm_gap_2 = Number(num)
entwine = Entwine(Branch00=rotation, Branch01="0", Branch02="100", FlattenInputs=True)  # -> simplify(Result)

# ----
# These offsets include both k and k_add
# This script is run twice, for front and back trolleys
floor_wall_corner_point_5 = Point(floor_wall_corner_point_4)
slidelengths_2 = Number(slidelengths)
fronttrolleypushershapedeviationparallel_2 = Number(fronttrolleypushershapedeviationparallel)  # "FrontTrolleyPusherShapeDeviationParallelDistance"
fronttrolleypushershapedeviationperpdist_2 = Number(fronttrolleypushershapedeviationperpdist)  # "FrontTrolleyPusherShapeDeviationPerpDistance"
middle_l_left_point_2 = Point(middle_l_left_point)
middle_l_right_point_2 = Point(middle_l_right_point)
fronttrolley_arm_length_2 = Number(fronttrolley_arm_length)
backtrolley_arm_length_2 = Number(backtrolley_arm_length)
fronttrolley_top_diff_5 = Number(fronttrolley_top_diff_4)
backtrolley_bottom_diff_4 = Number(backtrolley_bottom_diff_3)
fronttrolley_pusher_length_2 = Number(fronttrolley_pusher_length)
backtrolley_pusher_length_2 = Number(backtrolley_pusher_length)
backtrolleypushershapedeviationparalleld_2 = Number(backtrolleypushershapedeviationparalleld)  # "BackTrolleyPusherShapeDeviationParallelDistance"
backtrolleypushershapedeviationperpdista_2 = Number(backtrolleypushershapedeviationperpdista)  # "BackTrolleyPusherShapeDeviationPerpDistance"
top_platform_x_offset_2 = Number(top_platform_x_offset)
middle_platform_x_offset_2 = Number(middle_platform_x_offset)
bottom_platform_x_offset_2 = Number(bottom_platform_x_offset)
l_points_height_2 = Number(l_points_height)
top_platform_offset = Number(top_platform_vertical_offset)
middle_platform_vertical_offset_2 = Number(middle_l_to_top_l_drop_down)
rotationpercentage = Number(entwine)
arm_start_degrees_4 = Number(arm_start_degrees_3)
arm_end_degrees_2 = Number(arm_end_degrees)
arm_length_4 = Number(arm_length_3)
l_points_width_2 = Number(l_points_width)
shelf_width_6 = Number(shelf_width_5)
wheelheight_2 = Number(wheelheight)
arm_width_5 = Number(arm_width_4)
bottom_platform_vertical_offset = Number("0")
create_ls_rotating_arms = CSharpScript(
    RotationPercentage=rotationpercentage,
    ArmStartDegrees=arm_start_degrees_4,
    ArmEndDegrees=arm_end_degrees_2,
    ArmLength=arm_length_4,
    LPointsHeight=l_points_height_2,
    LPointsWidth=l_points_width_2,
    MiddleLPointLeft=middle_l_left_point_2,
    MiddleLPointRight=middle_l_right_point_2)  # -> out, TopL, MiddleL, BottomL, RotatingArmLeft, RotatingArmRight, CurrentAngleRadians, RotationAxisLeft, RotationAxisRight; inputs RotationPercentage: Double, ArmStartDegrees: Double, ArmEndDegrees: Double, ArmLength: Double, LPointsHeight: Double, LPointsWidth: Double, MiddleLPointLeft: Point3d, MiddleLPointRight: Point3d
# ---------- create_ls_rotating_arms: C# ----------
    double degrees = ArmStartDegrees + (ArmEndDegrees - ArmStartDegrees) / 100 * RotationPercentage;
    double radians = degrees * Math.PI / 180;
    Vector3d vInitialMiddlePointToEdge = new Vector3d(0, ArmLength, 0);
    Vector3d vLeftToRightForL_X = new Vector3d(MiddleLPointRight.X - MiddleLPointLeft.X, 0, 0);
    Vector3d vLeftToRightForL = new Vector3d(MiddleLPointRight.X - MiddleLPointLeft.X, MiddleLPointRight.Y - MiddleLPointLeft.Y, 0);

    LineCurve armLeft = new LineCurve(MiddleLPointLeft + vInitialMiddlePointToEdge, MiddleLPointLeft - vInitialMiddlePointToEdge);
    armLeft.Rotate(radians, Vector3d.ZAxis * -1, MiddleLPointLeft);
    LineCurve armRight = new LineCurve(MiddleLPointRight + vInitialMiddlePointToEdge, MiddleLPointRight - vInitialMiddlePointToEdge);
    armRight.Rotate(radians, Vector3d.ZAxis * -1, MiddleLPointRight);

    TopL = new PolylineCurve(new List<Point3d> { armLeft.PointAtStart, armLeft.PointAtStart + vLeftToRightForL_X, armLeft.PointAtStart + vLeftToRightForL });
    MiddleL = new PolylineCurve(new List<Point3d> { MiddleLPointLeft, MiddleLPointLeft + vLeftToRightForL_X, MiddleLPointLeft + vLeftToRightForL });
    BottomL = new PolylineCurve(new List<Point3d> { armLeft.PointAtEnd, armLeft.PointAtEnd + vLeftToRightForL_X, armLeft.PointAtEnd + vLeftToRightForL });

    RotatingArmLeft = armLeft;
    RotatingArmRight = armRight;
    CurrentAngleRadians = radians;
    RotationAxisLeft = new Line(MiddleLPointLeft, MiddleLPointLeft + Vector3d.ZAxis * -1);
    RotationAxisRight = new Line(MiddleLPointRight, MiddleLPointRight + Vector3d.ZAxis * -1);
# ---------- end create_ls_rotating_arms ----------
merge_4 = Merge(Data1=top_platform_x_offset_2, Data2=middle_platform_x_offset_2, Data3=bottom_platform_x_offset_2)
merge_5 = Merge(Data1=top_platform_offset, Data2=middle_platform_vertical_offset_2, Data3=bottom_platform_vertical_offset)
panel_5 = Panel("""1
-1""")
platform_width = Number(shelf_width_6)
merge_6 = Merge(Data1=create_ls_rotating_arms.RotationAxisLeft, Data2=create_ls_rotating_arms.RotationAxisRight)
merge_7 = Merge(Data1=middle_l_left_point_2, Data2=middle_l_right_point_2)
merge_8 = Merge(Data1=fronttrolley_arm_length_2, Data2=backtrolley_arm_length_2)
merge_9 = Merge(Data1=fronttrolley_top_diff_5, Data2=backtrolley_bottom_diff_4)
merge_10 = Merge(Data1=fronttrolley_pusher_length_2, Data2=backtrolley_pusher_length_2)
merge_11 = Merge(Data1=fronttrolleypushershapedeviationparallel_2, Data2=backtrolleypushershapedeviationparalleld_2)
merge_12 = Merge(Data1=fronttrolleypushershapedeviationperpdist_2, Data2=backtrolleypushershapedeviationperpdista_2)
division_3 = Division(A=arm_width_5, B="2")
bottom_l = Curve(create_ls_rotating_arms.BottomL)
mid_l = Curve(create_ls_rotating_arms.MiddleL)
top_l = Curve(create_ls_rotating_arms.TopL)
Y = UnitY(Factor=division_3)
merge_13 = Merge(Data1=top_l, Data2=mid_l, Data3=bottom_l)
merge_14 = Merge(Data1=create_ls_rotating_arms.RotatingArmLeft, Data2=create_ls_rotating_arms.RotatingArmRight)
create_trolley_lines = CSharpScript(
    CurrentAngleRadians=create_ls_rotating_arms.CurrentAngleRadians,
    RotationAxis=merge_6,
    MiddleLPoint=merge_7,
    LengthAlongArmToPusher=merge_8,
    TopDiff=merge_9,
    PusherLength=merge_10,
    DeviationParallelDistance=merge_11,
    DeviationPerpDistance=merge_12,
    Direction=panel_5,
    FloorWallCornerPoint=floor_wall_corner_point_5,
    WheelHeight=wheelheight_2)  # -> out, TrolleyPusher, TrolleyVertical, Test; inputs CurrentAngleRadians: Double, RotationAxis: Line, MiddleLPoint: Point3d, LengthAlongArmToPusher: Double, TopDiff: Double, PusherLength: Double, DeviationParallelDistance: Double, DeviationPerpDistance: Double, Direction: Int32, FloorWallCornerPoint: Point3d, WheelHeight: Double
# ---------- create_trolley_lines: C# ----------
    Point3d leftPtL = MiddleLPoint;
    int dir = Direction / Math.Abs(Direction);

    LineCurve centreToPusherStart = new LineCurve(leftPtL, leftPtL + Vector3d.YAxis * LengthAlongArmToPusher * dir);
    centreToPusherStart.Rotate(CurrentAngleRadians, RotationAxis.Direction, leftPtL);

    double lowY = WheelHeight;

    //    int longestSlideIndex = SlideLengths.IndexOf(SlideLengths.Max());
    //    int shortestSlideIndex = (longestSlideIndex == 0) ? 1 : 0;
    //    bool widerSlideBelow = (DrawerSlideMidLineElevations[longestSlideIndex] < DrawerSlideMidLineElevations[shortestSlideIndex]);
    //
    //    if (widerSlideBelow)
    //    {
    //      lowY = DrawerSlideMidLineElevations[longestSlideIndex] + ArmWidth / 2 + FingerGap;
    //    }

    double pusherEndY = leftPtL.Y + TopDiff;
    Line horizontalLineForIntersection = new Line(Pt(leftPtL.X, pusherEndY), Pt(centreToPusherStart.PointAtEnd.X + PusherLength * dir, pusherEndY));
    Circle circleForIntersection = new Circle(Plane.WorldXY, centreToPusherStart.PointAtEnd, PusherLength);
    Point3d[] horizontalLineForIntersectionEndPts = (new [] { horizontalLineForIntersection.From, horizontalLineForIntersection.To }).OrderBy(p => p.X).ToArray();

    Point3d intPt1, intPt2;
    double t1, t2;
    Rhino.Geometry.Intersect.Intersection.LineCircle(horizontalLineForIntersection, circleForIntersection, out t1, out intPt1, out t2, out intPt2);
    Point3d pusherVerticalPivotPoint;

    if (intPt1 != null && intPt2 == null) pusherVerticalPivotPoint = intPt1;
    else if (intPt1 == null && intPt2 != null) pusherVerticalPivotPoint = intPt2;
    else
    {
      var eligible = (new [] { intPt1, intPt2 })
        .Where(p => p.X >= horizontalLineForIntersectionEndPts[0].X && p.X <= horizontalLineForIntersectionEndPts[1].X).ToList();

      pusherVerticalPivotPoint = (dir == 1) ? eligible.First() : eligible.Last();
    }

    Line pusherLine = new Line(centreToPusherStart.PointAtEnd, pusherVerticalPivotPoint);
    Vector3d vPusher = new Vector3d(pusherLine.Direction);
    vPusher.Unitize();
    Vector3d vPusherPerp = new Vector3d(-vPusher.Y, vPusher.X, 0);

    Point3d[] pusherPts = new Point3d[] {
      centreToPusherStart.PointAtEnd,
      centreToPusherStart.PointAtEnd + vPusher * DeviationParallelDistance + vPusherPerp * DeviationPerpDistance,
      pusherVerticalPivotPoint
      };

    TrolleyPusher = new PolylineCurve(pusherPts);
    TrolleyVertical = new LineCurve(pusherVerticalPivotPoint, Pt(pusherVerticalPivotPoint.X, lowY));

    Test = new List<object>() { horizontalLineForIntersection, circleForIntersection };
# ---------- create_trolley_lines: C# additional code ----------
  private Point3d Pt(double x, double y)
  {
    return new Point3d(x, y, 0);
  }
# ---------- end create_trolley_lines ----------
create_shelf_platform = CSharpScript(xOffset=merge_4, Width=platform_width, Height=merge_5, L=merge_13)  # -> out, Platform, PlatformRiser; inputs xOffset: Double, Width: Double, Height: Double, L: Curve
# ---------- create_shelf_platform: C# ----------
    var ptStartL = L.PointAtStart;
    var ptEndL = L.PointAtEnd;

    var startX = Math.Min(ptStartL.X, ptEndL.X) - xOffset;
    var endX = startX + Width;
    var midX = startX + (Width / 2);
    var startY = Math.Max(ptStartL.Y, ptEndL.Y);
    var endY = startY + Height;

    List<LineCurve> platformCurves = new List<LineCurve>();

    if (Height > 0)
    {
      PlatformRiser = new LineCurve(new Point3d(midX, startY, 0), new Point3d(midX, endY, 0));
    }

    Platform = new LineCurve(new Point3d(startX, endY, 0), new Point3d(endX, endY, 0));
# ---------- end create_shelf_platform ----------
median_index = MedianIndex(L=merge_13)
move = Move(Geometry=create_shelf_platform.Platform, Motion=Y)  # -> Geometry, Transform
item_3 = ListItem(List=move.Geometry, Index=median_index, Wrap=True)
middle_section = CSharpScript(MiddlePlatform=item_3, WheelHeight=wheelheight_2, SlideLengths=slidelengths_2)  # -> out, Pl; inputs MiddlePlatform: Curve, WheelHeight: Double, SlideLengths: list of Double
# ---------- middle_section: C# ----------
    double minX = Math.Min(MiddlePlatform.PointAtStart.X, MiddlePlatform.PointAtEnd.X);
    double[] xs = new double[2] { minX, minX + SlideLengths.Max() };
    double[] ys = new double[2] { WheelHeight, MiddlePlatform.PointAtStart.Y};    
    
    List<Point3d> pts = new List<Point3d>()
      { Pt(xs[0], ys[0]), Pt(xs[0], ys[1]), Pt(xs[1], ys[1]), Pt(xs[1], ys[0]), Pt(xs[0], ys[0]) };
    
    Pl = new PolylineCurve(pts);
# ---------- middle_section: C# additional code ----------
  Point3d Pt(double x, double y)
  {
    return new Point3d(x, y, 0);
  }
# ---------- end middle_section ----------
item_4 = ListItem(List=create_trolley_lines.TrolleyVertical, Index=0, Wrap=True)  # -> Item, Item1
item_5 = ListItem(List=create_trolley_lines.TrolleyPusher, Index=0, Wrap=True)  # -> Item, Item1
bang = ExplodeTree(Data=create_shelf_platform.Platform)  # -> Branch0, Branch1, Branch2
bang_2 = ExplodeTree(Data=move.Geometry)  # -> Branch0, Branch1, Branch2
bang_3 = ExplodeTree(Data=item_5.Item)  # -> Branch0, Branch1, Branch2
bang_4 = ExplodeTree(Data=item_5.Item1)  # -> Branch0, Branch1, Branch2
bang_5 = ExplodeTree(Data=item_4.Item)  # -> Branch0, Branch1, Branch2
bang_6 = ExplodeTree(Data=item_4.Item1)  # -> Branch0, Branch1, Branch2
bang_7 = ExplodeTree(Data=merge_13)  # -> Branch0, Branch1, Branch2
bang_8 = ExplodeTree(Data=merge_14)  # -> Branch0, Branch1, Branch2
bang_9 = ExplodeTree(Data=middle_section.Pl)  # -> Branch0, Branch1, Branch2
platforms_real_top_surfaces = Curve(bang_2.Branch0)
initial_front_trolley_pusher = Curve(bang_3.Branch1)
initial_front_trolley_vertical = Curve(bang_5.Branch1)
initial_middle_section_outline = Curve(bang_9.Branch1)
initial_back_trolley_vertical = Curve(bang_6.Branch1)
initial_back_trolley_pusher = Curve(bang_4.Branch1)
final_back_trolley_pusher = Curve(bang_4.Branch2)
initial_rotating_arms = Curve(bang_8.Branch1)
front_trolley_pusher = Curve(bang_3.Branch0)
final_rotating_arms = Curve(bang_8.Branch2)
front_trolley_vertical = Curve(bang_5.Branch0)
middle_section_outline = Curve(bang_9.Branch0)
back_trolley_vertical = Curve(bang_6.Branch0)
back_trolley_pusher = Curve(bang_4.Branch0)
rotating_arms = Curve(bang_8.Branch0)
platformlines = Curve(bang.Branch0)
ls = Curve(bang_7.Branch0)
initial_ls = Curve(bang_7.Branch1)
final_ls = Curve(bang_7.Branch2)

# ---- group: Mirror plane
shelflength_2 = Number(shelflength)
division_4 = Division(A=shelflength_2, B="2")
floor_wall_corner_point_6 = Point(floor_wall_corner_point_4)
Y_2 = UnitY(Factor=division_4)
addition_9 = Addition(A=Y_2, B=floor_wall_corner_point_6)
xz = XZPlane(Origin=addition_9)
mirrorplane = Plane(xz)

# ----
item_6 = ListItem(List=rotating_arms, Index=0, Wrap=True)  # -> Item, Item1

initial_back_trolley_pusher_2 = Curve(initial_back_trolley_pusher)
initial_middle_section_outline_2 = Curve(initial_middle_section_outline)
initial_ls_2 = Curve(initial_ls)
initial_rotating_arms_2 = Curve(initial_rotating_arms)
initial_front_trolley_pusher_2 = Curve(initial_front_trolley_pusher)
initial_front_trolley_vertical_2 = Curve(initial_front_trolley_vertical)
initial_back_trolley_vertical_2 = Curve(initial_back_trolley_vertical)
armpivotholediameter_2 = Number(armpivotholediameter)
drawerslidemidlineelevations_2 = Number(drawerslidemidlineelevations)
slidelengths_3 = Number(slidelengths)
supportbeamsnormalisedxsalongl_2 = Number(supportbeamsnormalisedxsalongl)
supportbeamheights_2 = Number(supportbeamheights)
arm_width_6 = Number(arm_width_4)
platformmaterialthickness_2 = Number(platformmaterialthickness)
fingergap_2 = Number(fingergap)
armmaterialthickness_2 = Number(armmaterialthickness)
new_middle_unit = CSharpScript(
    MiddleSectionOutline=initial_middle_section_outline_2,
    Ls=initial_ls_2,
    RotatingArms=initial_rotating_arms_2,
    FrontTrolleyPusher=initial_front_trolley_pusher_2,
    BackTrolleyPusher=initial_back_trolley_pusher_2,
    FrontTrolleyVertical=initial_front_trolley_vertical_2,
    BackTrolleyVertical=initial_back_trolley_vertical_2,
    ArmPivotHoleDiameter=armpivotholediameter_2,
    DrawerSlideMidLineElevations=drawerslidemidlineelevations_2,
    SlideLengths=slidelengths_3,
    SupportBeamsNormalisedXsAlongL=supportbeamsnormalisedxsalongl_2,
    SupportBeamHeights=supportbeamheights_2,
    ArmWidth=arm_width_6,
    PlatformMaterialThickness=platformmaterialthickness_2,
    FingerGap=fingergap_2,
    ArmMaterialThickness=armmaterialthickness_2,
    n="2")  # -> out, Outline, Test, n_out; inputs MiddleSectionOutline: Polyline, Ls: list of Curve, RotatingArms: list of Curve, FrontTrolleyPusher: Curve, BackTrolleyPusher: Curve, FrontTrolleyVertical: Curve, BackTrolleyVertical: Curve, ArmPivotHoleDiameter: Double, DrawerSlideMidLineElevations: list of Double, SlideLengths: list of Double, SupportBeamsNormalisedXsAlongL: list of Double, SupportBeamHeights: list of Double, ArmWidth: Double, PlatformMaterialThickness: Double, FingerGap: Double, ArmMaterialThickness: Double, n: Int32
# ---------- new_middle_unit: C# ----------
    double tol = 0.01;

    Point3d[] backVerticalPts = (new [] { BackTrolleyVertical.PointAtStart, BackTrolleyVertical.PointAtEnd }).OrderBy(p => p.X).ToArray();
    Point3d[] frontVerticalPts = (new [] { FrontTrolleyVertical.PointAtStart, FrontTrolleyVertical.PointAtEnd }).OrderBy(p => p.X).ToArray();
    Point3d[] backPusherPts = (new [] { BackTrolleyPusher.PointAtStart, BackTrolleyPusher.PointAtEnd }).OrderBy(p => p.X).ToArray();
    Point3d[] frontPusherPts = (new [] { FrontTrolleyPusher.PointAtStart, FrontTrolleyPusher.PointAtEnd }).OrderBy(p => p.X).ToArray();

    double columnLeftX = backPusherPts[1].X + FingerGap + ArmWidth / 2;
    double columnRightX = MiddleSectionOutline.Max(p => p.X) - ArmMaterialThickness - FingerGap;
    double topY = MiddleSectionOutline.Max(p => p.Y);
    double lowerY = MiddleSectionOutline.Min(p => p.Y);
    double minX = MiddleSectionOutline.Min(p => p.X);

    Vector3d vFrontPusher = (new Line(frontPusherPts[0], frontPusherPts[1])).Direction;
    vFrontPusher.Unitize();

    Vector3d vFrontPusherPerp = new Vector3d(vFrontPusher.Y, -vFrontPusher.X, 0);
    Point3d frontPusherParallelStart = frontPusherPts[0] + (FingerGap + (ArmWidth / 2)) * vFrontPusherPerp;

    Vector3d vBackPusher = (new Line(backPusherPts[0], backPusherPts[1])).Direction;
    vBackPusher.Unitize();

    Vector3d vBackPusherPerp = new Vector3d(-vBackPusher.Y, vBackPusher.X, 0);
    Point3d backPusherParallelStart = backPusherPts[0] + (FingerGap + (ArmWidth / 2)) * vBackPusherPerp;

    Print("backPusherPts[0] = " + backPusherPts[0].ToString());
    Print("vBackPusher = " + vBackPusher.ToString());
    Print("vBackPusherPerp = " + vBackPusherPerp.ToString());

    Test = new Line(frontPusherPts[0], frontPusherPts[0] + vFrontPusherPerp);

    List<Point3d> pts = new List<Point3d>()
      {
        GetIntersectingPoint(new Line(backPusherParallelStart, vBackPusher), new Line(Pt(minX, lowerY), Pt(minX, topY)), tol),
        Pt(minX, topY),
        GetIntersectingPoint(new Line(frontPusherParallelStart, vFrontPusher), new Line(Pt(minX, topY), Pt(columnRightX, topY)), tol),
        GetIntersectingPoint(new Line(frontPusherParallelStart, vFrontPusher), new Line(Pt(columnRightX, topY), Pt(columnRightX, lowerY)), tol),
        Pt(columnRightX, lowerY),
        Pt(columnLeftX, lowerY),
        GetIntersectingPoint(new Line(backPusherParallelStart, vBackPusher), new Line(Pt(columnLeftX, lowerY), Pt(columnLeftX, topY)), tol)
        };
    pts.Add(pts.First());

    int backSlideIndex = SlideLengths.IndexOf(SlideLengths.Max());
    int frontSlideIndex = SlideLengths.IndexOf(SlideLengths.Min());
    Polyline backSlideRect = (new Rhino.Geometry.Rectangle3d(
      new Plane(Pt(minX, Math.Max(lowerY, DrawerSlideMidLineElevations[backSlideIndex] - ArmWidth / 2)), Vector3d.ZAxis),
      SlideLengths[backSlideIndex], ArmWidth)).ToPolyline();
    Polyline frontSlideRect = (new Rhino.Geometry.Rectangle3d(
      new Plane(Pt(columnRightX, Math.Max(lowerY, DrawerSlideMidLineElevations[frontSlideIndex] - ArmWidth / 2)), Vector3d.ZAxis),
      -SlideLengths[frontSlideIndex], ArmWidth)).ToPolyline();

    Outline = Curve.CreateBooleanUnion(new [] { new PolylineCurve(pts), backSlideRect.ToPolylineCurve(), frontSlideRect.ToPolylineCurve()}, tol);
# ---------- new_middle_unit: C# additional code ----------
  private Point3d Pt(double x, double y)
  {
    return new Point3d(x, y, 0);
  }

  private Point3d GetIntersectingPoint(Line l1, Line l2, double tol, bool finiteOnly = false)
  {
    double a, b;
    Rhino.Geometry.Intersect.Intersection.LineLine(l1, l2, out a, out b, tol, finiteOnly);
    return l1.PointAt(a);
  }
# ---------- end new_middle_unit ----------
expression_3 = Expression(t=armmaterialthickness_2, n="2", g=fingergap_2, Expression="n*(t + g)")
Y_3 = UnitY(Factor=armmaterialthickness_2)
X = UnitX(Factor=1)
Z = UnitZ(Factor=1)
vec_2 = VectorXYZ(XComponent=0, YComponent=expression_3, ZComponent=0)  # -> Vector, Length
rev = Reverse(Vector=Y_3)
cluster_5 = Cluster_5(dir1=X, dir2=Z, close="True")
rev_2 = Reverse(Vector=vec_2.Vector)
crv = Curve(cluster_5)
move_2 = Move(Geometry=cluster_5, Motion=rev_2)  # -> Geometry, Transform
extr = Extrude(Base=move_2.Geometry, Direction=rev)
cap = CapHoles(Brep=extr)

# ---- group: Swerving front rotating arm
back_trolley_pusher_2 = Curve(back_trolley_pusher)
item_7 = ListItem(List=final_ls, Index="1", Wrap=True)
end = EndPoints(Curve=back_trolley_pusher_2)  # -> Start, End
end_2 = EndPoints(Curve=item_7)  # -> Start, End
pt_4 = Point(end.Start)
ln = Line(StartPoint=end_2.Start, EndPoint=end_2.End)
divide = DivideCurve(Curve=ln, Count="3", Kinks=False)  # -> Points, Tangents, Parameters
number_slider_4 = Slider(90, range=0..100)
item_8 = ListItem(List=divide.Points, Index=0, Wrap=True)  # -> Item, Item1, Item2
armmaterialthickness_3 = Number(armmaterialthickness)
fingergap_3 = Number(fingergap)
arm_width_7 = Number(arm_width_4)
crv_2 = Curve(item_6.Item1)
dist = Distance(PointA=item_8.Item1, PointB=item_8.Item2)
arm_start_degrees_5 = Number(arm_start_degrees_3)
end_3 = EndPoints(Curve=crv_2)  # -> Start, End
len = Length(Curve=crv_2)
expression_4 = Expression(d=dist, t=armmaterialthickness_3, g=fingergap_3, aw=arm_width_7, Expression="d+t+2*g+aw")
panel_6 = Panel("200")
expression_5 = Expression(a=number_slider_4, sd=arm_start_degrees_5, Expression="360-a+sd")
division_5 = Division(A=len, B=2)
vec2pt = Vector2Pt(PointA=end_3.Start, PointB=end_3.End, Unitize=True)  # -> Vector, Length
pt_5 = Point(end_3.Start)
entwine_2 = Entwine(Branch00="82", Branch01=expression_4, Branch02="82", FlattenInputs=True)  # -> flatten(Result)
merge_15 = Merge(Data1=number_slider_4, Data2=expression_5)
cluster_6 = Cluster_6(startpt=pt_5, startdir=vec2pt.Vector, startlength=division_5, rotationdegrees=merge_15, remaininglengths=entwine_2)  # -> out, out_2, polyline
end_4 = EndPoints(Curve=cluster_6.polyline)  # -> Start, End
merge_16 = Merge(Data1=end_4.End, Data2=pt_4, Data3=end_3.End)
pline = PolyLine(Vertices=merge_16, Closed=False)
merge_17 = Merge(Data1=pline, Data2=cluster_6.polyline)
join = JoinCurves(Curves=merge_17, Preserve=False)
crv_3 = Curve(join)

# ---- group: Swerving back rotating arm
front_trolley_pusher_2 = Curve(front_trolley_pusher)
end_5 = EndPoints(Curve=front_trolley_pusher_2)  # -> Start, End
crv_4 = Curve(item_6.Item)
arm_end_degrees_3 = Number(arm_end_degrees)
pt_6 = Point(end_5.Start)
pt_7 = Point(end_5.End)
end_6 = EndPoints(Curve=crv_4)  # -> Start, End
subtraction_12 = Subtraction(A=arm_end_degrees_3, B="90")
expression_6 = Expression(d=subtraction_12, Expression="90 + d")
vec2pt_2 = Vector2Pt(PointA=end_6.Start, PointB=end_6.End, Unitize=True)  # -> Vector, Length
entwine_3 = Entwine(Branch00=Slider(24.8, range=0..30), Branch01=expression_4, FlattenInputs=True)  # -> flatten(Result)
dist_2 = Distance(PointA=end_6.Start, PointB=pt_6)
merge_18 = Merge(Data1="-90", Data2=expression_6)
cluster_7 = Cluster_6(startpt=end_6.Start, startdir=vec2pt_2.Vector, startlength=dist_2, rotationdegrees=merge_18, remaininglengths=entwine_3)  # -> out, out_2, polyline
middle_l_left_point_3 = Point(middle_l_left_point)
end_7 = EndPoints(Curve=cluster_7.polyline)  # -> Start, End
ln_2 = Line(StartPoint=end_7.End, EndPoint=middle_l_left_point_3)
ln_3 = Line(StartPoint=middle_l_left_point_3, EndPoint=end_6.End)
merge_19 = Merge(Data1=cluster_7.polyline, Data2=ln_2, Data3=ln_3)
join_2 = JoinCurves(Curves=merge_19, Preserve=False)

# ----
panel_7 = Panel(new_middle_unit.out)
middle_section_outline_2 = Curve(new_middle_unit.Outline)
panel_8 = Panel(cluster_7.out)
entwine_4 = Entwine(Branch00=join_2, Branch01=crv_3, FlattenInputs=True)  # -> flatten(Result)
number_slider_5 = Slider(12, range=0..20)
panel_9 = Panel("""4
1""")
experimental_middle_section_3 = Boolean(experimental_middle_section_2)
experimental_middle_section_4 = Boolean(experimental_middle_section_2)
slidelengths_4 = Number(slidelengths)
mirrorplane_2 = Plane(mirrorplane)
swatch = ColourSwatch(SwatchColor=RGB(207, 225, 255))
swatch_2 = ColourSwatch(SwatchColor=RGB(116, 191, 247))

middlesectionoutline = Curve(middle_section_outline_2)
middlesectionoutline_2 = Curve(middle_section_outline)
experimental_middle_section_5 = Boolean(experimental_middle_section_2)
back_trolley_vertical_2 = Curve(back_trolley_vertical)
floor_wall_corner_point_7 = Point(floor_wall_corner_point_4)
rotating_arms_2 = Curve(rotating_arms)
end_8 = EndPoints(Curve=back_trolley_vertical_2)  # -> Start, End
filter = StreamFilter(Gate=experimental_middle_section_5, Stream0=middlesectionoutline_2, Stream1=middlesectionoutline)
pdecon_3 = Deconstruct(Point=end_8.End)  # -> XComponent, YComponent, ZComponent
pdecon_4 = Deconstruct(Point=floor_wall_corner_point_7)  # -> XComponent, YComponent, ZComponent
middle_l_right_point_3 = Point(middle_l_right_point)
middle_l_left_point_4 = Point(middle_l_left_point)
platforms_real_top_surfaces_2 = Curve(platforms_real_top_surfaces)
front_trolley_vertical_2 = Curve(front_trolley_vertical)
front_trolley_pusher_3 = Curve(front_trolley_pusher)
back_trolley_pusher_3 = Curve(back_trolley_pusher)
platformlines_2 = Curve(platformlines)
pt_8 = ConstructPoint(XCoordinate=pdecon_3.XComponent, YCoordinate=pdecon_4.YComponent, ZCoordinate=0)
ls_2 = Curve(ls)
merge_20 = Merge(Data1=middle_l_left_point_4, Data2=middle_l_right_point_3)
entwine_5 = Entwine(
    Branch00=platformlines_2,
    Branch01=ls_2,
    Branch02=entwine_4,
    Branch03=front_trolley_pusher_3,
    Branch04=front_trolley_vertical_2,
    Branch05=back_trolley_pusher_3,
    Branch06=back_trolley_vertical_2,
    Branch07=filter,
    Branch08=platforms_real_top_surfaces_2,
    FlattenInputs=True)  # -> flatten(Result)
X_2 = UnitX(Factor=1)
subtraction_13 = Subtraction(A=floor_wall_corner_point_7, B=pt_8)
addition_10 = Addition(A=floor_wall_corner_point_7, B=X_2)
move_3 = Move(Geometry=entwine_5, Motion=subtraction_13)  # -> Geometry, Transform
move_4 = Move(Geometry=merge_20, Motion=subtraction_13)  # -> Geometry, Transform
ln_4 = Line(StartPoint=floor_wall_corner_point_7, EndPoint=addition_10)
rotax = RotateAxis(Geometry=move_3.Geometry, Angle=1.570796327, Axis=ln_4)  # -> flatten(Geometry), Transform
rotax_2 = RotateAxis(Geometry=move_4.Geometry, Angle=1.570796327, Axis=ln_4)  # -> flatten(Geometry), Transform
xz_curves_for_math_model = Curve(rotax.Geometry)

final_ls_2 = Curve(final_ls)
final_rotating_arms_2 = Curve(final_rotating_arms)
item_9 = ListItem(List=final_ls_2, Index="1", Wrap=True)
merge_21 = Merge(Data1=final_rotating_arms_2, Data2=item_9)
move_5 = Move(Geometry=merge_21, Motion=subtraction_13)  # -> Geometry, Transform
rotax_3 = RotateAxis(Geometry=move_5.Geometry, Angle=1.570796327, Axis=ln_4)  # -> flatten(Geometry), Transform
item_10 = ListItem(List=rotax_3.Geometry, Index=0, Wrap=True)  # -> Item, Item1, Item2
final_rotating_arms_3 = Curve([item_10.Item, item_10.Item1])
final_middle_l = Curve(item_10.Item2)

item_11 = ListItem(List=rotax_2.Geometry, Index=0, Wrap=True)  # -> Item, Item1
back_arm_midpoint = Point(item_11.Item)
xz_curves_for_math_model_2 = Curve(xz_curves_for_math_model)

front_arm_midpoint = Point(item_11.Item1)

item_12 = ListItem(List=xz_curves_for_math_model_2, Index=0, Wrap=True)  # -> Item, Item1, Item2, Item3, Item4, Item5, Item6, Item7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

crv_5 = Curve(item_12.Item6)
crv_6 = Curve(item_12.Item7)
crv_7 = Curve([item_12.Item13, item_12.Item14, item_12.Item15])
crv_8 = Curve(item_12.Item)
crv_9 = Curve(item_12.Item3)
crv_10 = Curve(item_12.Item1)
crv_11 = Curve(item_12.Item5)
crv_12 = Curve(item_12.Item9)
crv_13 = Curve(item_12.Item4)
crv_14 = Curve(item_12.Item10)
crv_15 = Curve(item_12.Item11)
crv_16 = Curve(item_12.Item12)
crv_17 = Curve(item_12.Item8)
merge_22 = Merge(Data1=crv_5, Data2=crv_6)
merge_23 = Merge(Data1=crv_9, Data2=crv_13, Data3=crv_11)

# ---- group: XZ Breps for rotating arms
xz_curves_for_math_model_3 = Curve(xz_curves_for_math_model)
item_13 = ListItem(List=xz_curves_for_math_model_3, Index="6", Wrap=True)  # -> Item, Item1, Item2, Item3, Item4, Item5
front_trolley_pusher_4 = Curve(item_13.Item2)
back_trolley_pusher_4 = Curve(item_13.Item4)
front_arm_midpoint_2 = Point(front_arm_midpoint)
back_arm_midpoint_2 = Point(back_arm_midpoint)
rotating_arms_3 = Curve(graft([item_13.Item, item_13.Item1]))
merge_24 = Merge(Data1=front_trolley_pusher_4, Data2=back_trolley_pusher_4)
trolley_arms = Curve(graft(merge_24))
armpivotholediameter_3 = Number(armpivotholediameter)
armmaterialthickness_4 = Number(armmaterialthickness)
end_9 = EndPoints(Curve=trolley_arms)  # -> Start, End
merge_25 = Merge(Data1=back_arm_midpoint_2, Data2=front_arm_midpoint_2)  # -> graft(Result)
end_10 = EndPoints(Curve=rotating_arms_3)  # -> Start, End
arm_width_8 = Number(arm_width_4)
merge_26 = Merge(Data1=end_9.Start, Data2=end_9.End)
pt_9 = Point(end_9.Start)
merge_27 = Merge(Data1=end_10.Start, Data2=end_10.End, Data3=merge_25, Data4=pt_9)  # -> simplify(Result)
crv_18 = Curve(simplify(rotating_arms_3))
crv_19 = Curve(simplify(trolley_arms))
pt_10 = Point(simplify(merge_26))
entwine_6 = Entwine(Branch0X=crv_18, Branch1X=crv_19, FlattenInputs=False)
entwine_7 = Entwine(Branch0X=merge_27, Branch1X=pt_10, FlattenInputs=False)
xz_2 = XZPlane(Origin=Point(0, 0, 0))
armmaterialthickness_5 = Number(armmaterialthickness)
create_xz_arm_breps = CSharpScript(
    ArmWidth=arm_width_8,
    MaterialThickness=armmaterialthickness_4,
    PivotHoleDiameter=armpivotholediameter_3,
    CentreLine=entwine_6,
    PivotPoints=entwine_7,
    Plane=xz_2)  # -> out, Brep, Test; inputs ArmWidth: Double, MaterialThickness: Double, PivotHoleDiameter: Double, CentreLine: Curve, PivotPoints: list of Point3d, Plane: Plane
# ---------- create_xz_arm_breps: C# ----------
    try
    {
      List<Surface> extruded = new List<Surface>();
      List<Curve> outlines = new List<Curve>();
      Vector3d normal = Plane.Normal;
      if (normal.Length != 1)
      {
        normal.Unitize();
      }
      Vector3d extrudeDir = normal * MaterialThickness;

      Curve[] joined;
      double tol = 0.01;
      List<Curve> testCurves;
      if (CreateOffsetOutline(CentreLine, ArmWidth / 2, Plane, tol, out joined, out testCurves))
      {
        Curve closed = joined.FirstOrDefault(jc => jc.IsClosed);
        if (closed != null)
        {
          outlines.Add(closed);
          extruded.Add(Surface.CreateExtrusion(closed, extrudeDir));
        }
      }
      if (outlines.Count == 0)
      {
        //TODO
        Print("Failed");
      }

      if (PivotPoints != null && PivotPoints.Any())
      {
        foreach (Point3d pp in PivotPoints)
        {
          var c = new ArcCurve(new Circle(Plane, pp, PivotHoleDiameter / 2));
          outlines.Add(c);
          extruded.Add(Surface.CreateExtrusion(c, extrudeDir));
        }
      }

      Brep bottomFace = Rhino.Geometry.Brep.CreatePlanarBreps(outlines, tol).First();
      Brep topFace = bottomFace.DuplicateBrep();
      topFace.Translate(extrudeDir);

      List<Brep> toJoin = extruded.Select(e => e.ToBrep()).ToList();
      toJoin.Add(bottomFace);
      toJoin.Add(topFace);

      var breps = Rhino.Geometry.Brep.JoinBreps(toJoin, tol);
      Brep solid = breps.FirstOrDefault(b => ((Brep) b).IsSolid);
      if (solid.SolidOrientation == Rhino.Geometry.BrepSolidOrientation.Inward)
      {
        solid.Flip();
      }
      Brep = solid;
      Test = toJoin;
    }
    catch(Exception ex)
    {
      Print(ex.Message);
      Print(ex.StackTrace);
    }
# ---------- create_xz_arm_breps: C# additional code ----------
  private bool CreateOffsetOutline(Curve c, double maxOffset, Plane plane, double tol, out Curve[] joined, out List<Curve> test)
  {
    Curve movedC = Curve.ProjectToPlane(c, plane);
    joined = null;
    try
    {
      var offsets = new List<Curve>();

      offsets.AddRange(movedC.Offset(plane, maxOffset, tol, CurveOffsetCornerStyle.Round));
      offsets.AddRange(movedC.Offset(plane, -maxOffset, tol, CurveOffsetCornerStyle.Round));

      var selfIntersections = Rhino.Geometry.Intersect.Intersection.CurveSelf(c, tol);

      if (c.IsClosed && (selfIntersections == null || selfIntersections.Count() == 0))
      {
        offsets = offsets.Where(o => !Rhino.Geometry.NurbsCurve.PlanarCurveCollision(o, c, plane, tol)
          && ClosestDistanceTo(o, movedC) > (maxOffset - tol)).ToList();

        var tempJoined = new List<Curve>();
        foreach (var fj in offsets)
        {
          if (fj.IsClosed || fj.MakeClosed(tol))
          {
            tempJoined.Add(fj);
          }
        }
        joined = tempJoined.ToArray();
      }
      else
      {
        offsets.Add(endCurve(movedC.PointAtStart, Reversed(movedC.TangentAtStart), maxOffset, plane));
        offsets.Add(endCurve(movedC.PointAtEnd, movedC.TangentAtEnd, maxOffset, plane));

        if (!c.IsClosed)
        {
          var startPts = PerpendicularVectors(movedC.TangentAtStart, plane, true).Select(v => movedC.PointAtStart + maxOffset * v).ToArray();
          var endPts = PerpendicularVectors(movedC.TangentAtEnd, plane, true).Select(v => movedC.PointAtEnd + maxOffset * v).ToArray();

          //offsets.Clear();
          offsets.AddRange(movedC.Offset(startPts[0], plane.Normal, maxOffset, tol, CurveOffsetCornerStyle.Round));
          offsets.AddRange(movedC.Offset(startPts[1], plane.Normal, maxOffset, tol, CurveOffsetCornerStyle.Round));
          offsets.AddRange(movedC.Offset(endPts[0], plane.Normal, maxOffset, tol, CurveOffsetCornerStyle.Round));
          offsets.AddRange(movedC.Offset(endPts[1], plane.Normal, maxOffset, tol, CurveOffsetCornerStyle.Round));
        }
        var allSplitCurves = RemoveDuplicates(offsets, tol);
        allSplitCurves = MassCrossSplitCurves(allSplitCurves, tol).Where(sc => ClosestDistanceTo(((Curve) sc), movedC) > (maxOffset - tol)).ToList();

        var firstJoined = Curve.JoinCurves(allSplitCurves).Where(jc => jc != null).ToList();
        var finalJoined = new List<Curve>();
        foreach (var fj in firstJoined)
        {
          if (fj.IsClosed || fj.MakeClosed(tol))
          {
            finalJoined.Add(fj);
          }
        }

        joined = finalJoined.ToArray();

      }
      //test = new List<Curve>() { movedC };
      test = offsets;
      return true;
    }
    catch (Exception ex)
    {
      Print(ex.Message);
      Print(ex.StackTrace);
    }
    test = null;
    return false;
  }

  private Curve endCurve(Point3d pt, Vector3d vOutwards, double radius, Plane plane)
  {
    var vStart = RightPerpendicular(vOutwards, plane, true);
    //Print("vOutwards = " + vOutwards.ToString());
    var vOutwardsUnitised = new Vector3d(vOutwards);
    vOutwardsUnitised.Unitize();
    return new ArcCurve(new Arc(pt + vStart * radius, vOutwardsUnitised, pt - vStart * radius));
  }

  public Vector3d LeftPerpendicular(Vector3d v, Plane customPlane, bool unitize = false)
  {
    var returnVector = new Vector3d(v);
    returnVector.Rotate(Math.PI / 2, customPlane.Normal);

    // Optionally unitize the vector
    if (unitize)
    {
      returnVector.Unitize();
    }

    return returnVector;
  }

  public Vector3d RightPerpendicular(Vector3d v, Plane customPlane, bool unitize = false)
  {
    var returnVector = new Vector3d(v);
    returnVector.Rotate(-Math.PI / 2, customPlane.Normal);

    // Optionally unitize the vector
    if (unitize)
    {
      returnVector.Unitize();
    }

    return returnVector;
  }

  public Vector3d[] PerpendicularVectors(Vector3d v, Plane customPlane, bool unitise = false)
  {
    return new[] { LeftPerpendicular(v, customPlane, unitise), RightPerpendicular(v, customPlane, unitise) };
  }


  public double? ClosestDistanceTo(Curve fr, Curve to)
  {
    Point3d fromPt;
    Point3d toPt;
    if (fr.ClosestPoints(to, out fromPt, out toPt))
    {
      return fromPt.DistanceTo(toPt);
    }
    return null;
  }

  public List<Curve> RemoveDuplicates(IEnumerable<Curve> curves, double tol)
  {
    var cList = curves.ToList();
    var num = curves.Count();
    var isDup = new bool[num];
    for (int i = 0; i < num; i++)
    {
      isDup[i] = false;
    }

    for (int i = 0; i < num; i++)
    {
      if (isDup[i]) continue;
      for (int j = 0; j < num; j++)
      {
        if ((i == j) || (isDup[j])) continue;

        if (IsOverlapDuplicateOf(cList[i], cList[j], tol))
        {
          isDup[j] = true;
        }
      }
    }

    var retList = new List<Curve>();
    for (int i = 0; i < num; i++)
    {
      if (!isDup[i])
      {
        retList.Add(cList[i]);
      }
    }
    return retList;
  }


  public bool IsOverlapDuplicateOf(Curve a, Curve b, double tol)
  {
    //First test is whether the end points are the same
    if (!EndPointsMatch(a, b, tol))
    {
      return false;
    }

    if (a.IsLinear() && b.IsLinear())
    {
      return true;
    }

    Rhino.Geometry.Intersect.CurveIntersections crvInts = Rhino.Geometry.Intersect.Intersection.CurveCurve(a, b, tol, tol);
    //The endpoints of a and b have already proven to be the same so just need to compare the overlap with one of them
    if (crvInts != null && crvInts.Count == 1 && crvInts[0].IsOverlap && EndPointsMatch(crvInts[0].PointA, crvInts[0].PointA2, b, tol))
    {
      return true;
    }

    var joined = Curve.JoinCurves(new[] { a, b }, tol);
    if (joined == null || joined.Length == 0)
    {
      //If these can't be joined then, for now, do a simplistic check: check for the same length and the same midpoint
      return (EqualsWithinTolerance(a.GetLength(), b.GetLength(), tol) && MidPoint(a).EpsilonEquals(MidPoint(b), tol));
    }
    else if (joined.Length > 1)
    {
      return false;
    }

    var amProps = AreaMassProperties.Compute(joined[0], tol);
    //Handle one case where the amProps was null but it was definitely overlapping
    return ((joined[0].IsClosed && !joined[0].IsPeriodic && amProps == null)
      || (amProps != null && amProps.Area < tol));
  }

  public bool EndPointsMatch(Curve a, Curve b, double tol)
  {
    return ((a.PointAtStart.EpsilonEquals(b.PointAtStart, tol) || a.PointAtStart.EpsilonEquals(b.PointAtEnd, tol))
      && (a.PointAtEnd.EpsilonEquals(b.PointAtEnd, tol) || a.PointAtEnd.EpsilonEquals(b.PointAtStart, tol)));
  }

  public bool EndPointsMatch(Point3d ptA1, Point3d ptA2, Curve b, double tol)
  {
    return ((ptA1.EpsilonEquals(b.PointAtStart, tol) || ptA1.EpsilonEquals(b.PointAtEnd, tol))
      && (ptA2.EpsilonEquals(b.PointAtEnd, tol) || ptA2.EpsilonEquals(b.PointAtStart, tol)));
  }

  public Point3d MidPoint(Curve c)
  {
    return c.PointAtNormalizedLength(0.5);
  }

  public bool EqualsWithinTolerance(double d1, double d2, double tol)
  {
    return (Math.Abs(d1 - d2) < tol);
  }

  public List<Curve> MassCrossSplitCurves(List<Curve> curves, double tol)
  {
    var splitCurves = new List<Curve>();
    for (var i = 0; i < curves.Count(); i++)
    {
      var ts = new List<double>();
      for (var j = 0; j < curves.Count(); j++)
      {
        if (i == j) continue;

        ts.AddRange(GetSplitParameters(curves[i], curves[j], tol));
      }
      splitCurves.AddRange(curves[i].Split(ts));
    }
    return splitCurves;
  }

  private List<double> GetSplitParameters(Curve forCurve, Curve byCurve, double tol)
  {
    var ts = new List<double>();
    var splitCurves = new List<Curve>();

    var intersections = Rhino.Geometry.Intersect.Intersection.CurveCurve(forCurve, byCurve, tol, tol);
    if (intersections.Count() == 0)
    {
      List <double> touchParams;
      if (NbTouchParametersForSplitting(forCurve, byCurve, tol, out touchParams))
      {
        ts.AddRange(touchParams);
      }
    }
    else
    {
      ts.AddRange(intersections.Select(i => i.ParameterA));
    }
    return ts.ToList();
  }

  public bool NbTouchParametersForSplitting(Curve forCurve, Curve byCurve, double tolerance, out List<double> parameters)
  {
    parameters = new List<double>();

    var byCurvePts = EdgePoints(byCurve);

    foreach (var pt in byCurvePts)
    {
      double t;
      if (forCurve.ClosestPoint(pt, out t, tolerance))
      {
        parameters.Add(t);
      }
    }

    return (parameters.Count() > 0);
  }

  public Point3d[] EdgePoints(Curve c)
  {
    return new[] { c.PointAtStart, c.PointAtEnd };
  }

  public Vector3d Reversed(Vector3d v)
  {
    var vNew = new Vector3d(v);
    vNew.Reverse();
    return vNew;
  }
# ---------- end create_xz_arm_breps ----------
panel_10 = Panel("""1
1
2
2""")
vec_3 = Vector(xz_2)
fingergap_4 = Number(fingergap)
expression_7 = Expression(n=panel_10, t=armmaterialthickness_5, g=fingergap_4, Expression="n*g+(n-1)*t")
brep = Brep(flatten(create_xz_arm_breps.Brep))
multiplication_6 = Multiplication(A=expression_7, B=vec_3)
move_6 = Move(Geometry=brep, Motion=multiplication_6)  # -> Geometry, Transform
mirrorplane_3 = Plane(mirrorplane)
mirror = Mirror(Geometry=move_6.Geometry, Plane=mirrorplane_3)  # -> Geometry, Transform
merge_28 = Merge(Data1=move_6.Geometry, Data2=mirror.Geometry)

# ---- group: XZ Trolley vertical breps
xz_curves_for_math_model_4 = Curve(xz_curves_for_math_model)
panel_11 = Panel("""9
11
12""")
panel_12 = Panel("""-1
1""")
drawerslidemidlineelevations_3 = Number(drawerslidemidlineelevations)
item_14 = ListItem(List=xz_curves_for_math_model_4, Index=panel_11, Wrap=True)
armpivotholediameter_4 = Number(armpivotholediameter)
armmaterialthickness_6 = Number(armmaterialthickness)
slidelengths_5 = Number(slidelengths)
arm_width_9 = Number(arm_width_4)
item_15 = ListItem(List=item_14, Index=0, Wrap=True)  # -> Item, Item1, Item2
merge_29 = Merge(Data1=item_15.Item, Data2=item_15.Item1)
trolley_vertical_xz_brep = CSharpScript(
    ArmWidth=arm_width_9,
    MaterialThickness=armmaterialthickness_6,
    PivotHoleDiameter=armpivotholediameter_4,
    DrawerSlideLength=slidelengths_5,
    DrawerSlideHeight="40",
    DrawerSlideMidLineElevation=drawerslidemidlineelevations_3,
    DrawerSlideXDirection=panel_12,
    TrolleyVerticalCurve=merge_29,
    MiddleSectionOutline=item_15.Item2)  # -> out, L_Brep; inputs ArmWidth: Double, MaterialThickness: Double, PivotHoleDiameter: Double, DrawerSlideLength: Double, DrawerSlideHeight: Double, DrawerSlideMidLineElevation: Double, DrawerSlideXDirection: Int32, TrolleyVerticalCurve: Curve, MiddleSectionOutline: Curve
# ---------- trolley_vertical_xz_brep: C# ----------
    double tol = 0.01;

    Curve[] segments = MiddleSectionOutline.DuplicateSegments();
    List<Curve> verticals = segments.Where(s => s.GetLength() > (ArmWidth + tol) && Math.Abs((new Line(s.PointAtStart, s.PointAtEnd)).Direction.X) < tol)
      .OrderBy(s => s.PointAtStart.X).ToList();

    double sliderIndentX = segments.SelectMany(s => new List<double>() { s.PointAtStart.X, s.PointAtEnd.X }).Max() - verticals.Last().PointAtStart.X;

    var vertical = TrolleyVerticalCurve.DuplicateCurve();
    if (vertical.PointAtStart.Z > vertical.PointAtEnd.Z)
    {
      vertical.Reverse();
    }
    Point3d pivotPt = vertical.PointAtEnd;
    if ((vertical.PointAtEnd.Z - vertical.PointAtStart.Z) < DrawerSlideMidLineElevation)
    {
      vertical = new LineCurve(vertical.PointAtStart,
        Pt(vertical.PointAtStart, 0, DrawerSlideMidLineElevation));
    }
    double sliderArmWidth = Math.Max(ArmWidth, DrawerSlideHeight);
    List<Curve> curves = new List<Curve>();
    List<Point3d> pts = new List<Point3d>();

    //Starting top left, going anti-clockwise
    double centreX = vertical.PointAtEnd.X;
    double mainLeftEdgeX = centreX - ArmWidth / 2;
    double mainRightEdgeX = centreX + ArmWidth / 2;
    double extremeX = centreX + (DrawerSlideLength - ArmWidth / 2) * DrawerSlideXDirection
      - ((DrawerSlideXDirection < 0 ) ? sliderIndentX : 0);

    Print(DrawerSlideLength.ToString());
    var rectMain = new Rhino.Geometry.Rectangle3d(Plane.WorldZX, Pt(mainLeftEdgeX, 0, vertical.PointAtStart.Z),
      Pt(mainRightEdgeX, 0, vertical.PointAtEnd.Z + ArmWidth / 2));

    Curve hole = new ArcCurve(new Circle(pivotPt, PivotHoleDiameter / 2));
    PolylineCurve outline = new PolylineCurve(rectMain.ToPolyline());
    Brep lowerFace = Brep.CreatePlanarBreps(new [] { outline, hole }, tol).FirstOrDefault(b => b != null);
    Brep post = lowerFace.Faces[0].CreateExtrusion(new LineCurve(Pt(0, 0, 0), Pt(0, -MaterialThickness, 0)), true);

    var rectSlide = new Rhino.Geometry.Rectangle3d(Plane.WorldZX, Pt(extremeX, 0, DrawerSlideMidLineElevation - ArmWidth / 2),
      Pt(centreX + (ArmWidth / 2) * DrawerSlideXDirection, 0, DrawerSlideMidLineElevation + ArmWidth / 2));
    Brep slide = Extrusion.CreateExtrusion(new PolylineCurve(rectSlide.ToPolyline()),
      new Vector3d(0, -MaterialThickness, 0)).ToBrep();
    slide = slide.CapPlanarHoles(tol);

    L_Brep = new [] { post, slide };
# ---------- trolley_vertical_xz_brep: C# additional code ----------
  Point3d SecondLast(List<Point3d> pts)
  {
    return pts[pts.Count - 2];
  }

  Point3d Pt(double x, double y, double z)
  {
    return new Point3d(x, y, z);
  }

  Point3d Pt(Point3d refPt, double xDiff, double zDiff)
  {
    return new Point3d(refPt.X + xDiff, refPt.Y, refPt.Z + zDiff);
  }
# ---------- end trolley_vertical_xz_brep ----------
armmaterialthickness_7 = Number(armmaterialthickness)
fingergap_5 = Number(fingergap)
Y_4 = UnitY(Factor=1)
expression_8 = Expression(n="3", t=armmaterialthickness_7, g=fingergap_5, Expression="n*g+(n-1)*t")
cluster_8 = Cluster_4(D=trolley_vertical_xz_brep.L_Brep)  # -> flatten(D_4)
rev_3 = Reverse(Vector=Y_4)
multiplication_7 = Multiplication(A=expression_8, B=rev_3)
mirrorplane_4 = Plane(mirrorplane)
move_7 = Move(Geometry=cluster_8, Motion=multiplication_7)  # -> Geometry, Transform
mirror_2 = Mirror(Geometry=move_7.Geometry, Plane=mirrorplane_4)  # -> Geometry, Transform
merge_30 = Merge(Data1=move_7.Geometry, Data2=mirror_2.Geometry)

# ----
xz_curves_for_math_model_5 = Curve(xz_curves_for_math_model)
shelflength_3 = Number(shelflength)
supportbeamsnormalisedxsalongl_3 = Number(supportbeamsnormalisedxsalongl)
experimental_middle_section_6 = Boolean(experimental_middle_section_2)
platformmaterialthickness_3 = Number(platformmaterialthickness)
armmaterialthickness_8 = Number(armmaterialthickness)
supportbeamheights_3 = Number(supportbeamheights)
arm_end_degrees_4 = Number(arm_end_degrees)
item_16 = ListItem(List=xz_curves_for_math_model_5, Index=panel_9, Wrap=True)  # -> Item, Item1
fingergap_6 = Number(fingergap)
arm_width_10 = Number(arm_width_4)
middle_fore_beam_outline = CSharpScript(
    L=item_16.Item,
    PlatformLine=item_16.Item1,
    ArmEndDegrees=arm_end_degrees_4,
    XNormalisedAlongL=supportbeamsnormalisedxsalongl_3,
    BeamHeight=supportbeamheights_3,
    ArmWidth=arm_width_10,
    PlatformMaterialThickness=platformmaterialthickness_3,
    FingerGap=fingergap_6,
    ArmMaterialThickness=armmaterialthickness_8,
    ExperimentalMiddleSection=experimental_middle_section_6)  # -> out, StartPt, ZigZags, n_out; inputs L: Curve, PlatformLine: Curve, ArmEndDegrees: Double, XNormalisedAlongL: Double, BeamHeight: Double, ArmWidth: Double, PlatformMaterialThickness: Double, FingerGap: Double, ArmMaterialThickness: Double, ExperimentalMiddleSection: Boolean
# ---------- middle_fore_beam_outline: C# ----------
    double topZ = PlatformLine.PointAtStart.Z + ArmWidth / 2 - PlatformMaterialThickness;

    double[] lXs = (new [] { L.PointAtStart.X, L.PointAtEnd.X }).OrderBy(x => x).ToArray();
    double[] lZs = (new [] { L.PointAtStart.Z, L.PointAtEnd.Z }).OrderBy(z => z).ToArray();

    double aRadians = (ArmEndDegrees - 90) * Math.PI / 180;
    int n = ExperimentalMiddleSection ? 2 : 4;

    // Find how far down you need to go to protrude out under the top rotating arm + finger gap
    double zForArmAndFingerGap = (FingerGap + ArmWidth / 2) / Math.Cos(aRadians);
    double zAtBeamRightmostSurface = (lXs[1] - lXs[0] + ArmMaterialThickness) * Math.Tan(aRadians);  //Relate to pure top of L

    double middlePieceOffsetFromShelfEdge = (ArmMaterialThickness + FingerGap) * n + ArmMaterialThickness;
    double dropZ = (topZ - lZs[1] + zAtBeamRightmostSurface + zForArmAndFingerGap);

    Point3d startPt = new Point3d(lXs[0] + XNormalisedAlongL * (lXs[1] - lXs[0]), 0, topZ - dropZ);

    List < double > zigZags = new List<double>()
      {
        -BeamHeight,
        middlePieceOffsetFromShelfEdge,
        BeamHeight,
        -middlePieceOffsetFromShelfEdge,
        };

    ZigZags = zigZags;
    StartPt = startPt;
    n_out = n;
# ---------- end middle_fore_beam_outline ----------

# ---- group: 3D Shelves on XZ
xz_curves_for_math_model_6 = Curve(xz_curves_for_math_model)
platformmaterialthickness_4 = Number(platformmaterialthickness)
panel_13 = Panel("""13
14
15""")
item_17 = ListItem(List=xz_curves_for_math_model_6, Index=panel_13, Wrap=True)
Z_2 = UnitZ(Factor=platformmaterialthickness_4)
end_11 = EndPoints(Curve=item_17)  # -> Start, End
rev_4 = Reverse(Vector=Z_2)
shelflength_4 = Number(shelflength)
xz_3 = XZPlane(Origin=Point(0, 0, 0))
move_8 = Move(Geometry=end_11.End, Motion=rev_4)  # -> Geometry, Transform
rec_2pt = Rectangle2Pt(Plane=xz_3, PointA=end_11.Start, PointB=move_8.Geometry, Radius=0)  # -> Rectangle, Length
Y_5 = UnitY(Factor=shelflength_4)
extr_2 = Extrude(Base=rec_2pt.Rectangle, Direction=Y_5)
cap_2 = CapHoles(Brep=extr_2)

# ---- group: Beams on XZ plane
platforms_real_top_surfaces_3 = Curve(crv_7)
platformmaterialthickness_5 = Number(platformmaterialthickness)
armmaterialthickness_9 = Number(armmaterialthickness)
l_points_width_3 = Number(l_points_width)
ls_3 = Curve(merge_23)
arm_width_11 = Number(arm_width_4)
shelflength_5 = Number(shelflength)
l_beam_rects = CSharpScript(
    Platform=platforms_real_top_surfaces_3,
    L=ls_3,
    L_Width=l_points_width_3,
    BeamHeight="60",
    MaterialThickness=platformmaterialthickness_5,
    ArmWidth=arm_width_11)  # -> out, Rects; inputs Platform: Curve, L: Curve, L_Width: Double, BeamHeight: Double, MaterialThickness: Double, ArmWidth: Double
# ---------- l_beam_rects: C# ----------
    PolylineCurve l = (PolylineCurve) L;

    double minX = Math.Min(l.PointAtStart.X, l.PointAtEnd.X) - ArmWidth / 2;
    double maxX = Math.Max(l.PointAtStart.X, l.PointAtEnd.X) + ArmWidth / 2;
    double minZ = Platform.PointAtStart.Z - BeamHeight - MaterialThickness;
    double maxZ = Platform.PointAtStart.Z - MaterialThickness;

    double t = MaterialThickness / 2;
    double d = (L_Width + ArmWidth) / 3;

    double[] xs = new double[4] { minX + d - t, minX + d + t, maxX - MaterialThickness, maxX};

    Point3d[][] rectPts = new Point3d[2][];

    rectPts[0] = new Point3d[5]
      {
      Pt(xs[0], minZ), Pt(xs[0], maxZ), Pt(xs[1], maxZ), Pt(xs[1], minZ), Pt(xs[0], minZ)
      };

    rectPts[1] = new Point3d[5]
      {
      Pt(xs[2], minZ), Pt(xs[2], maxZ), Pt(xs[3], maxZ), Pt(xs[3], minZ), Pt(xs[2], minZ)
      };

    Rects = rectPts.Select(pl => Rectangle3d.CreateFromPolyline(pl)).ToList();
# ---------- l_beam_rects: C# additional code ----------
  public Point3d Pt(double x, double z)
  {
    return new Point3d(x, 0, z);
  }
# ---------- end l_beam_rects ----------
expression_9 = Expression(t=armmaterialthickness_9, sl=shelflength_5, Expression="(sl-2*t)")
vec_4 = VectorXYZ(XComponent=0, YComponent=armmaterialthickness_9, ZComponent=0)  # -> Vector, Length
move_9 = Move(Geometry=l_beam_rects.Rects, Motion=vec_4.Vector)  # -> Geometry, Transform
Y_6 = UnitY(Factor=expression_9)
extr_3 = Extrude(Base=move_9.Geometry, Direction=Y_6)  # -> flatten(Extrusion)
cap_3 = CapHoles(Brep=extr_3)

# ---- group: New mid section connector beams
fingergap_7 = Number(fingergap)
final_middle_l_2 = Curve(final_middle_l)
arm_width_12 = Number(arm_width_4)
final_rotating_arms_4 = Curve(final_rotating_arms_3)
armmaterialthickness_10 = Number(armmaterialthickness)
supportbeamheights_4 = Number(supportbeamheights)
end_12 = EndPoints(Curve=final_middle_l_2)  # -> Start, End
expression_10 = Expression(aw=arm_width_12, g=fingergap_7, Expression="aw/2+g")
panel_14 = Panel("""-1
1""")
ln_5 = Line(StartPoint=end_12.Start, EndPoint=end_12.End)
expression_11 = Expression(g=fingergap_7, t=armmaterialthickness_10, Expression="-1*(4 * (g + t))")
multiplication_8 = Multiplication(A=expression_10, B=panel_14)
xz_4 = XZPlane(Origin=Point(0, 0, 0))
multiplication_9 = Multiplication(A=supportbeamheights_4, B=-1)
divide_2 = DivideCurve(Curve=ln_5, Count="3", Kinks=False)  # -> Points, Tangents, Parameters
panel_15 = Panel("""1
2""")
expression_12 = Expression(t=armmaterialthickness_10, Expression="-t/2")
offset = OffsetCurve(Curve=final_rotating_arms_4, Distance=multiplication_8, Plane=xz_4, Corners=1)  # -> flatten(Curve)
item_18 = ListItem(List=divide_2.Points, Index=panel_15, Wrap=True)
item_19 = ListItem(List=offset, Index=0, Wrap=True)
yz = YZPlane(Origin=item_18)
pcx = CurvePlane(Curve=item_19, Plane=yz)  # -> flatten(Points), ParamsC, ParamsP
vec_5 = VectorXYZ(XComponent=expression_12, YComponent=armmaterialthickness_10, ZComponent=0)  # -> Vector, Length
move_10 = Move(Geometry=pcx.Points, Motion=vec_5.Vector)  # -> Geometry, Transform
xz_5 = XZPlane(Origin=move_10.Geometry)
vec_6 = VectorXYZ(XComponent=0, YComponent=expression_11, ZComponent=0)  # -> Vector, Length
rectangle = Rectangle(Plane=xz_5, XSize=armmaterialthickness_10, YSize=multiplication_9, Radius=0)  # -> Rectangle, Length
extr_4 = Extrude(Base=rectangle.Rectangle, Direction=vec_6.Vector)
mirrorplane_5 = Plane(mirrorplane)
cap_4 = CapHoles(Brep=extr_4)
mirror_3 = Mirror(Geometry=cap_4, Plane=mirrorplane_5)  # -> Geometry, Transform
merge_31 = Merge(Data1=cap_4, Data2=mirror_3.Geometry)
brep_2 = Brep(merge_31)

# ----
crv_20 = Curve(item_16.Item1)

platformmaterialthickness_6 = Number(platformmaterialthickness)
armmaterialthickness_11 = Number(armmaterialthickness)
shelflength_6 = Number(shelflength)
arm_width_13 = Number(arm_width_4)
fingergap_8 = Number(fingergap)
rotating_arms_stabiliser_outline = CSharpScript(
    RotatingArms=merge_22,
    TopPlatformLine=crv_8,
    TopL=crv_9,
    HeightAlongArm="300",
    ShelfLength=shelflength_6,
    ArmWidth=arm_width_13,
    PlatformMaterialThickness=platformmaterialthickness_6,
    FingerGap=fingergap_8,
    ArmMaterialThickness=armmaterialthickness_11,
    n="1")  # -> out, StartPt, ZigZags, ArmUnitVector, ArmUnitPerpVector, n_out; inputs RotatingArms: list of Curve, TopPlatformLine: Curve, TopL: Curve, HeightAlongArm: Double, ShelfLength: Double, ArmWidth: Double, PlatformMaterialThickness: Double, FingerGap: Double, ArmMaterialThickness: Double, n: Int32
# ---------- rotating_arms_stabiliser_outline: C# ----------
    try
    {
      Point3d[] lPts = (new [] { TopL.PointAtStart, TopL.PointAtEnd }).OrderBy(p => p.X).ToArray();
      double tol = 0.01;

      double pivotToTopUnderside = TopPlatformLine.PointAtStart.Z + ArmWidth / 2 - PlatformMaterialThickness
        - lPts[1].Z - FingerGap;

      double startDistanceBelowPivot = (HeightAlongArm == 0 ? 200 : HeightAlongArm) - pivotToTopUnderside;

      Vector3d vArm = (RotatingArms[0].PointAtEnd.DistanceTo(lPts[0]) < tol)
        ? RotatingArms[0].PointAtEnd - RotatingArms[0].PointAtStart
        : RotatingArms[0].PointAtStart - RotatingArms[0].PointAtEnd;
      vArm.Unitize();
      Vector3d vArmPerp = new Vector3d(vArm.Z, 0, -vArm.X);

      Point3d startPt = lPts[1] + vArmPerp * ArmWidth / 2 - startDistanceBelowPivot * vArm;

      double pieceLength = ShelfLength + 2 * (ArmMaterialThickness + FingerGap);

      List<double> zigZags = new List<double>()
        {
          startDistanceBelowPivot + pivotToTopUnderside,  //Yes could just use HeightAlongArm here
          pieceLength,
          -(startDistanceBelowPivot + pivotToTopUnderside),
          -ArmWidth,
          startDistanceBelowPivot + pivotToTopUnderside - ArmWidth,
          -(pieceLength - 2 * ArmWidth),
          -(startDistanceBelowPivot + pivotToTopUnderside - ArmWidth)
          };

      ArmUnitVector = vArm;
      ArmUnitPerpVector = vArmPerp;
      ZigZags = zigZags;
      StartPt = startPt;
      n_out = n;
    }
    catch (Exception ex)
    {
      Print(ex.Message);
      Print(ex.StackTrace);
    }
# ---------- end rotating_arms_stabiliser_outline ----------
multiplication_10 = Multiplication(A=rotating_arms_stabiliser_outline.ArmUnitPerpVector, B=armmaterialthickness_11)

platformmaterialthickness_7 = Number(platformmaterialthickness)
drawerslidemidlineelevations_4 = Number(drawerslidemidlineelevations)
armmaterialthickness_12 = Number(armmaterialthickness)
shelflength_7 = Number(shelflength)
arm_width_14 = Number(arm_width_4)
fingergap_9 = Number(fingergap)
middle_unit_horizontal_stabiliser_outlin = CSharpScript(
    MiddleSectionOutline=crv_16,
    DrawerSliderMidLineElevations=drawerslidemidlineelevations_4,
    SlideLengths=slidelengths_4,
    ShelfLength=shelflength_7,
    ArmWidth=arm_width_14,
    PlatformMaterialThickness=platformmaterialthickness_7,
    FingerGap=fingergap_9,
    ArmMaterialThickness=armmaterialthickness_12,
    ExperimentalMiddleSection=experimental_middle_section_3)  # -> out, StartPt, ZigZags, n_out; "Middle unit-horizontal-stabiliser-outline"; inputs MiddleSectionOutline: Curve, DrawerSliderMidLineElevations: list of Double, SlideLengths: list of Double, ShelfLength: Double, ArmWidth: Double, PlatformMaterialThickness: Double, FingerGap: Double, ArmMaterialThickness: Double, ExperimentalMiddleSection: Boolean
# ---------- middle_unit_horizontal_stabiliser_outlin: C# ----------
    int n = ExperimentalMiddleSection ? 1 : 3;

    double pieceLength = 2 * (n * ArmMaterialThickness + (n + 1) * FingerGap) + ShelfLength;

    Point3d startPt = default(Point3d);
    List<double> zigZags = null;
    if (ExperimentalMiddleSection)
    {
      double lengthAlongMiddleSection = 180;

      int si = SlideLengths.IndexOf(SlideLengths.Max());
      double se = DrawerSliderMidLineElevations[si];

      double topZ = se + ArmWidth / 2;

      double minX = MiddleSectionOutline.DuplicateSegments().SelectMany(s => new List<double>() { s.PointAtStart.X, s.PointAtEnd.X }).Min()
        + ArmMaterialThickness + FingerGap;

      double maxX = minX + lengthAlongMiddleSection;

      startPt = new Point3d(maxX, -FingerGap, topZ);
      zigZags = new List<double>()
        {
          -lengthAlongMiddleSection,
          pieceLength,
          lengthAlongMiddleSection,
          -ArmWidth,
          -(lengthAlongMiddleSection - ArmWidth),
          -(pieceLength - 2 * ArmWidth),
          (lengthAlongMiddleSection - ArmWidth)
          };
    }
    else
    {
      double[] xs = MiddleSectionOutline.DuplicateSegments()
        .SelectMany(s => new [] { s.PointAtStart.X, s.PointAtEnd.X }).Distinct().OrderBy(x => x).ToArray();
      double[] zs = MiddleSectionOutline.DuplicateSegments()
        .SelectMany(s => new [] { s.PointAtStart.Z, s.PointAtEnd.Z }).Distinct().OrderBy(z => z).ToArray();

      double topZ = DrawerSliderMidLineElevations.Min() - ArmWidth / 2 - FingerGap;


      // The ArmMaterialThickness is there because the piece will extruded towards the front
      double frontX = xs[1] - ArmWidth - FingerGap - ArmMaterialThickness;

      startPt = new Point3d(frontX + ArmWidth, -FingerGap, zs[0]);

      double lengthAlongCentralUnit = 300;

      zigZags = new List<double>()
        {
          -lengthAlongCentralUnit,
          ArmWidth,
          lengthAlongCentralUnit - ArmWidth,
          (pieceLength - ArmWidth * 2),
          -(lengthAlongCentralUnit - ArmWidth),
          ArmWidth,
          lengthAlongCentralUnit
          };
    }

    ZigZags = zigZags;
    StartPt = startPt;
    n_out = n;
# ---------- end middle_unit_horizontal_stabiliser_outlin ----------
Z_3 = UnitZ(Factor=armmaterialthickness_12)
rev_5 = Reverse(Vector=Z_3)
X_3 = UnitX(Factor=1)

platformmaterialthickness_8 = Number(platformmaterialthickness)
drawerslidemidlineelevations_5 = Number(drawerslidemidlineelevations)
armmaterialthickness_13 = Number(armmaterialthickness)
shelflength_8 = Number(shelflength)
fingergap_10 = Number(fingergap)
arm_width_15 = Number(arm_width_4)
middle_unit_vertical_stabiliser_outline = CSharpScript(
    MiddleSectionOutline=crv_16,
    DrawerSliderMidLineElevations=drawerslidemidlineelevations_5,
    ShelfLength=shelflength_8,
    ArmWidth=arm_width_15,
    PlatformMaterialThickness=platformmaterialthickness_8,
    FingerGap=fingergap_10,
    ArmMaterialThickness=armmaterialthickness_13,
    ExperimentalMiddleSection=experimental_middle_section_4)  # -> out, StartPt, ZigZags, n_out; inputs MiddleSectionOutline: Curve, DrawerSliderMidLineElevations: list of Double, ShelfLength: Double, ArmWidth: Double, PlatformMaterialThickness: Double, FingerGap: Double, ArmMaterialThickness: Double, ExperimentalMiddleSection: Boolean
# ---------- middle_unit_vertical_stabiliser_outline: C# ----------
    double tol = 0.01;
    Curve[] segments = MiddleSectionOutline.DuplicateSegments();
    List<Curve> verticals = segments.Where(s => s.GetLength() > (ArmWidth + tol) && Math.Abs((new Line(s.PointAtStart, s.PointAtEnd)).Direction.X) < tol)
      .OrderBy(s => s.PointAtStart.X).ToList();
    int n = ExperimentalMiddleSection ? 2 : 3;

    double maxX = verticals.Last().PointAtStart.X;
    double minZ = segments.Min(s => Math.Min(s.PointAtStart.Z, s.PointAtEnd.Z));

    double topZ = ExperimentalMiddleSection
      ? Math.Max(verticals.Last().PointAtStart.Z, verticals.Last().PointAtEnd.Z)
      : DrawerSliderMidLineElevations.Min() - ArmWidth / 2 - FingerGap; //Will need carve out for slider
    double pieceLength = 2 * (n * ArmMaterialThickness + n * FingerGap) + ShelfLength;

    // The ArmMaterialThickness is there because the piece will extruded towards the front
    double frontX = ExperimentalMiddleSection
      ? maxX - ArmMaterialThickness
      : maxX - ArmWidth - FingerGap - ArmMaterialThickness;

    Point3d startPt = new Point3d(frontX, 0, minZ);

    Print("TopZ = " + topZ);

    List<double> zigZags = new List<double>()
      {
        (topZ - minZ),
        ArmWidth,
        -(topZ - minZ - ArmWidth),
        (pieceLength - ArmWidth * 2),
        (topZ - minZ - ArmWidth),
        ArmWidth,
        -(topZ - minZ)
        };

    ZigZags = zigZags;
    StartPt = startPt;
    n_out = n;
# ---------- end middle_unit_vertical_stabiliser_outline ----------

platformmaterialthickness_9 = Number(platformmaterialthickness)
armmaterialthickness_14 = Number(armmaterialthickness)
shelflength_9 = Number(shelflength)
arm_width_16 = Number(arm_width_4)
fingergap_11 = Number(fingergap)
back_trolley_stabiliser_outline = CSharpScript(
    VerticalLine=crv_15,
    PusherLine=crv_14,
    MiddlePlatformLine=crv_10,
    ShelfLength=shelflength_9,
    ArmWidth=arm_width_16,
    PlatformMaterialThickness=platformmaterialthickness_9,
    FingerGap=fingergap_11,
    ArmMaterialThickness=armmaterialthickness_14,
    n="3")  # -> out, StartPt, ZigZags, n_out; inputs VerticalLine: Curve, PusherLine: Curve, MiddlePlatformLine: Curve, ShelfLength: Double, ArmWidth: Double, PlatformMaterialThickness: Double, FingerGap: Double, ArmMaterialThickness: Double, n: Int32
# ---------- back_trolley_stabiliser_outline: C# ----------
    double[] zs = (new [] { VerticalLine.PointAtStart.Z, VerticalLine.PointAtEnd.Z }).OrderBy(z => z).ToArray();

    Point3d pusherPivotPt = (new [] { PusherLine.PointAtStart, PusherLine.PointAtEnd }).OrderBy(p => p.X).First();

    double topZ = pusherPivotPt.Z - 80;
    double bottomZ = zs[0];
    Point3d startPt = new Point3d(VerticalLine.PointAtStart.X - ArmWidth / 2, 0, zs[0]);
    double pieceLength = 2 * (n * ArmMaterialThickness + n * FingerGap) + ShelfLength;

    List < double > zigZags = new List<double>()
      {
        (topZ - startPt.Z),
        ArmWidth,
        -(topZ - startPt.Z - ArmWidth),
        pieceLength - 2 * ArmWidth,
        (topZ - startPt.Z - ArmWidth),
        ArmWidth,
        -(topZ - startPt.Z)
        };

    ZigZags = zigZags;
    StartPt = startPt;
    n_out = n;
# ---------- end back_trolley_stabiliser_outline ----------

platformmaterialthickness_10 = Number(platformmaterialthickness)
armmaterialthickness_15 = Number(armmaterialthickness)
shelflength_10 = Number(shelflength)
arm_width_17 = Number(arm_width_4)
fingergap_12 = Number(fingergap)
front_trolley_stabiliser_outline = CSharpScript(
    VerticalLine=crv_12,
    PusherLine=crv_17,
    MiddlePlatformLine=crv_10,
    ShelfLength=shelflength_10,
    ArmWidth=arm_width_17,
    PlatformMaterialThickness=platformmaterialthickness_10,
    FingerGap=fingergap_12,
    ArmMaterialThickness=armmaterialthickness_15,
    n="3")  # -> out, StartPt, ZigZags, n_out; inputs VerticalLine: Curve, PusherLine: Curve, MiddlePlatformLine: Curve, ShelfLength: Double, ArmWidth: Double, PlatformMaterialThickness: Double, FingerGap: Double, ArmMaterialThickness: Double, n: Int32
# ---------- front_trolley_stabiliser_outline: C# ----------
    // Using X and Y values to be more readable than Dir1 and Dir2, but also because the stick model the numbers
    // below are calculated from are assumed to be in the XY plane

    Point3d lowerVerticalPt = (new Point3d[] { VerticalLine.PointAtStart, VerticalLine.PointAtEnd }).OrderBy(p => p.Z).First();

    Point3d startPt = new Point3d(lowerVerticalPt.X + ArmWidth / 2, 0, lowerVerticalPt.Z);

    Point3d[] pusherEdgePts = (new Point3d[] { PusherLine.PointAtStart, PusherLine.PointAtEnd }).OrderBy(p => p.X).ToArray();

    //double topY = MiddlePlatformLine.PointAtStart.Y + ArmWidth / 2 - PlatformMaterialThickness;
    double topZ = pusherEdgePts.Last().Z - ArmWidth / 2 - FingerGap;
    double topVerticalLineY = pusherEdgePts.Last().Y;

    double pieceLength = ShelfLength + 2 * n * (ArmMaterialThickness + FingerGap);

    double inwardXOffset = n * (ArmMaterialThickness + FingerGap);

    List<double> zigZags = new List<double>()
      {
        topZ - startPt.Z,
        ArmWidth,
        -(topZ - startPt.Z - ArmWidth),
        pieceLength - 2 * ArmWidth,
        (topZ - startPt.Z - ArmWidth),
        ArmWidth,
        -(topZ - startPt.Z)};


    ZigZags = zigZags;
    StartPt = startPt;
    n_out = n;
# ---------- end front_trolley_stabiliser_outline ----------

panel_16 = Panel(rotax_2.Geometry)

# ---- group: Old mid section connector beams
pt_11 = Point(graft(middle_fore_beam_outline.StartPt))
Z_4 = UnitZ(Factor=1)
Y_7 = UnitY(Factor=1)
armmaterialthickness_16 = Number(armmaterialthickness)
X_4 = UnitX(Factor=1)
cluster_9 = Cluster_5(startpt=pt_11, zigzags=middle_fore_beam_outline.ZigZags, dir1=Z_4, dir2=Y_7, close="True")
fingergap_13 = Number(fingergap)
multiplication_11 = Multiplication(A=X_4, B=armmaterialthickness_16)
expression_13 = Expression(t=armmaterialthickness_16, n=middle_fore_beam_outline.n_out, g=fingergap_13, Expression="n*(t + g)")
crv_21 = Curve(flatten(cluster_9))
extr_5 = Extrude(Base=crv_21, Direction=multiplication_11)
vec_7 = VectorXYZ(XComponent=0, YComponent=expression_13, ZComponent=0)  # -> Vector, Length
cap_5 = CapHoles(Brep=extr_5)
rev_6 = Reverse(Vector=vec_7.Vector)
move_11 = Move(Geometry=cap_5, Motion=rev_6)  # -> flatten(Geometry), Transform
mirror_4 = Mirror(Geometry=move_11.Geometry, Plane=mirrorplane_2)  # -> Geometry, Transform
merge_32 = Merge(Data1=move_11.Geometry, Data2=mirror_4.Geometry)

# ----
txt = Text(flatten(rotating_arms_stabiliser_outline.out))
join_3 = TextJoin(Text=txt, Join=". ")
mesh = MeshBrep(
    Brep=merge_30,
    Settings={GridMaxCount=0, GridMinCount=16, JaggedSeams=False, MaxEdgeLength=0, MinEdgeLength=0.0001, MinTolerance=0, Refine=True, RefineAngle=0, RelativeTolerance=0.65, SimplePlanes=True, Tolerance=0})

# ---- group: RH_OUT:RotatingArmsOut
txt_2 = Text(join_3)

# ----
mesh_2 = MeshBrep(
    Brep=merge_28,
    Settings={GridMaxCount=0, GridMinCount=16, JaggedSeams=False, MaxEdgeLength=0, MinEdgeLength=0.0001, MinTolerance=0, Refine=True, RefineAngle=0, RelativeTolerance=0.65, SimplePlanes=True, Tolerance=0})
mesh_3 = MeshBrep(
    Brep=cap_2,
    Settings={GridMaxCount=0, GridMinCount=16, JaggedSeams=False, MaxEdgeLength=0, MinEdgeLength=0.0001, MinTolerance=0, Refine=True, RefineAngle=0, RelativeTolerance=0.65, SimplePlanes=True, Tolerance=0})
mesh_4 = MeshBrep(
    Brep=cap_3,
    Settings={GridMaxCount=0, GridMinCount=16, JaggedSeams=False, MaxEdgeLength=0, MinEdgeLength=0.0001, MinTolerance=0, Refine=True, RefineAngle=0, RelativeTolerance=0.65, SimplePlanes=True, Tolerance=0})
join_4 = TextJoin(Text=create_xz_arm_breps.out, Join=". ")
mcol = MeshColours(Mesh=mesh, Colours=ColourSwatch(SwatchColor=RGB(255, 247, 99)))
mcol_2 = MeshColours(Mesh=mesh_2, Colours=ColourSwatch(SwatchColor=RGB(143, 225, 255)))
mcol_3 = MeshColours(Mesh=mesh_3, Colours=ColourSwatch(SwatchColor=RGB(40, 103, 148)))
mcol_4 = MeshColours(Mesh=mesh_4, Colours=swatch_2)
mesh_5 = MeshBrep(
    Brep=brep_2,
    Settings={GridMaxCount=0, GridMinCount=16, JaggedSeams=False, MaxEdgeLength=0, MinEdgeLength=0.0001, MinTolerance=0, Refine=True, RefineAngle=0, RelativeTolerance=0.65, SimplePlanes=True, Tolerance=0})

# ---- group: RH_OUT:CreateXZArmBrepsOut
txt_3 = Text(join_4)

# ----
mcol_5 = MeshColours(Mesh=mesh_5, Colours=swatch)

# ---- group: Middle section brep
armmaterialthickness_17 = Number(armmaterialthickness)
experimental_middle_section_7 = Boolean(experimental_middle_section_2)
fingergap_14 = Number(fingergap)
xz_curves_for_math_model_7 = Curve(xz_curves_for_math_model)
filter_2 = StreamFilter(Gate=experimental_middle_section_7, Stream0="4", Stream1="2")
item_20 = ListItem(List=xz_curves_for_math_model_7, Index="12", Wrap=True)
Y_8 = UnitY(Factor=1)
expression_14 = Expression(t=armmaterialthickness_17, n=filter_2, g=fingergap_14, Expression="n*g+(n-1)*t")
vec_8 = VectorXYZ(XComponent=0, YComponent=armmaterialthickness_17, ZComponent=0)  # -> Vector, Length
rev_7 = Reverse(Vector=Y_8)
multiplication_12 = Multiplication(A=expression_14, B=rev_7)
mirrorplane_6 = Plane(mirrorplane)

# ----
rev_8 = Reverse(Vector=vec_8.Vector)

# ---- group: Middle section brep (continued)
extr_6 = Extrude(Base=item_20, Direction=rev_8)  # -> flatten(Extrusion)
cap_6 = CapHoles(Brep=extr_6)
move_12 = Move(Geometry=cap_6, Motion=multiplication_12)  # -> Geometry, Transform
mirror_5 = Mirror(Geometry=move_12.Geometry, Plane=mirrorplane_6)  # -> Geometry, Transform
merge_33 = Merge(Data1=move_12.Geometry, Data2=mirror_5.Geometry)

# ----
mesh_6 = MeshBrep(
    Brep=merge_33,
    Settings={GridMaxCount=0, GridMinCount=16, JaggedSeams=False, MaxEdgeLength=0, MinEdgeLength=0.0001, MinTolerance=0, Refine=True, RefineAngle=0, RelativeTolerance=0.65, SimplePlanes=True, Tolerance=0})
mcol_6 = MeshColours(Mesh=mesh_6, Colours=swatch)

# ---- group: The L breps - should be ordered last
xz_curves_for_math_model_8 = Curve(xz_curves_for_math_model)
armpivotholediameter_5 = Number(armpivotholediameter)
armmaterialthickness_18 = Number(armmaterialthickness)
item_21 = ListItem(List=xz_curves_for_math_model_8, Index=0, Wrap=True)  # -> Item, Item1, Item2, Item3, Item4, Item5
arm_width_18 = Number(arm_width_4)
mirrorplane_7 = Plane(mirrorplane)

# ----
merge_34 = Merge(Data1=item_21.Item3, Data2=item_21.Item4, Data3=item_21.Item5)
merge_35 = Merge(Data1=item_21.Item, Data2=item_21.Item1, Data3=item_21.Item2)

# ---- group: The L breps - should be ordered last (continued)
l_xz_brep = CSharpScript(
    PlatformCurve=merge_35,
    L_Curve=merge_34,
    ArmWidth=arm_width_18,
    MaterialThickness=armmaterialthickness_18,
    PivotHoleDiameter=armpivotholediameter_5)  # -> out, L_Brep; inputs PlatformCurve: Curve, L_Curve: Curve, ArmWidth: Double, MaterialThickness: Double, PivotHoleDiameter: Double
# ---------- l_xz_brep: C# ----------
    double tol = 0.01;

    try
    {
      var raisedPlatform = new LineCurve(PlatformCurve.PointAtStart, PlatformCurve.PointAtEnd);
      if (raisedPlatform.PointAtStart.X > raisedPlatform.PointAtEnd.X)
      {
        raisedPlatform.Reverse();
      }
      raisedPlatform.Translate(new Vector3d(0, 0, ArmWidth / 2));

      if (L_Curve.PointAtStart.X > L_Curve.PointAtEnd.X)
      {
        L_Curve.Reverse();
      }

      List<Curve> curves = new List<Curve>();

      List<Point3d> pts = new List<Point3d>();
      pts.Add(new Point3d(L_Curve.PointAtStart.X - ArmWidth / 2, 0, L_Curve.PointAtStart.Z));
      if (raisedPlatform.PointAtStart.Z > pts.Last().Z)
      {
        pts.Add(new Point3d(pts.Last().X, 0, raisedPlatform.PointAtStart.Z));
        curves.Add(new LineCurve(SecondLast(pts), pts.Last()));
      }
      pts.Add(new Point3d(L_Curve.PointAtEnd.X + ArmWidth / 2, 0, raisedPlatform.PointAtEnd.Z));
      curves.Add(new LineCurve(SecondLast(pts), pts.Last()));
      pts.Add(new Point3d(L_Curve.PointAtEnd.X + ArmWidth / 2, 0, L_Curve.PointAtEnd.Z));
      curves.Add(new LineCurve(SecondLast(pts), pts.Last()));

      Vector3d angled = new Vector3d(L_Curve.PointAtStart.X - L_Curve.PointAtEnd.X, 0, L_Curve.PointAtStart.Z - L_Curve.PointAtEnd.Z);
      Vector3d rotatedUnitAngle = new Vector3d(angled);
      rotatedUnitAngle.Rotate(Math.PI / 2, -1 * Vector3d.YAxis);
      rotatedUnitAngle.Unitize();
      pts.Add(L_Curve.PointAtEnd + rotatedUnitAngle * ArmWidth / 2);

      curves.Add(new ArcCurve(new Arc(SecondLast(pts), Vector3d.ZAxis * -1, pts.Last())));

      pts.Add(pts.Last() + angled);
      curves.Add(new LineCurve(SecondLast(pts), pts.Last()));

      curves.Add(new ArcCurve(new Arc(pts.Last(), angled, pts.First())));

      Curve outline = Curve.JoinCurves(curves).FirstOrDefault(c => c != null && c.IsClosed);

      Curve holeL = new ArcCurve(new Circle(L_Curve.PointAtStart, PivotHoleDiameter / 2));
      Curve holeR = new ArcCurve(new Circle(L_Curve.PointAtEnd, PivotHoleDiameter / 2));


      Brep lowerFace = Brep.CreatePlanarBreps(new [] { outline, holeL, holeR }, tol).FirstOrDefault(b => b != null);
      Brep upperFace = lowerFace.DuplicateBrep();
      upperFace.Translate(0, MaterialThickness, 0);

      List<Brep> breps = new List<Brep>() { lowerFace, upperFace };

      breps.AddRange((new [] { outline, holeL, holeR})
        .Select(c => Surface.CreateExtrusion(c, new Vector3d(0, MaterialThickness, 0)).ToBrep()));

      Brep solid = Brep.JoinBreps(breps, tol).FirstOrDefault(b => b.IsSolid);
      L_Brep = solid;
    }
    catch (Exception ex)
    {
      Print(ex.Message);
      Print(ex.StackTrace);
    }
# ---------- l_xz_brep: C# additional code ----------
  Point3d SecondLast(List<Point3d> pts)
  {
    return pts[pts.Count - 2];
  }
# ---------- end l_xz_brep ----------
cluster_10 = Cluster_4(D=l_xz_brep.L_Brep)
mirror_6 = Mirror(Geometry=cluster_10, Plane=mirrorplane_7)  # -> Geometry, Transform
merge_36 = Merge(Data1=cluster_10, Data2=mirror_6.Geometry)

# ----
join_5 = TextJoin(Text=l_xz_brep.out, Join=". ")

# ---- group: RH_OUT:LXZBrepOut
txt_4 = Text(join_5)

# ----
mesh_7 = MeshBrep(
    Brep=merge_36,
    Settings={GridMaxCount=0, GridMinCount=16, JaggedSeams=False, MaxEdgeLength=0, MinEdgeLength=0.0001, MinTolerance=0, Refine=True, RefineAngle=0, RelativeTolerance=0.65, SimplePlanes=True, Tolerance=0})
mcol_7 = MeshColours(Mesh=mesh_7, Colours=swatch_2)

armmaterialthickness_19 = Number(armmaterialthickness)
X_5 = UnitX(Factor=armmaterialthickness_19)
Z_5 = UnitZ(Factor=1)
Y_9 = UnitY(Factor=1)
startpts = Entwine(
    Branch00=front_trolley_stabiliser_outline.StartPt,
    Branch01=back_trolley_stabiliser_outline.StartPt,
    Branch02=middle_unit_vertical_stabiliser_outline.StartPt,
    Branch03=middle_unit_horizontal_stabiliser_outlin.StartPt,
    Branch04=rotating_arms_stabiliser_outline.StartPt,
    FlattenInputs=True)
zigzags = Entwine(
    Branch00=front_trolley_stabiliser_outline.ZigZags,
    Branch01=back_trolley_stabiliser_outline.ZigZags,
    Branch02=middle_unit_vertical_stabiliser_outline.ZigZags,
    Branch03=middle_unit_horizontal_stabiliser_outlin.ZigZags,
    Branch04=rotating_arms_stabiliser_outline.ZigZags,
    FlattenInputs=True)
ns = Entwine(
    Branch00=front_trolley_stabiliser_outline.n_out,
    Branch01=back_trolley_stabiliser_outline.n_out,
    Branch02=middle_unit_vertical_stabiliser_outline.n_out,
    Branch03=middle_unit_horizontal_stabiliser_outlin.n_out,
    Branch04=rotating_arms_stabiliser_outline.n_out,
    FlattenInputs=True)
dir1s = Entwine(
    Branch00=Z_5,
    Branch01=Z_5,
    Branch02=Z_5,
    Branch03=X_3,
    Branch04=rotating_arms_stabiliser_outline.ArmUnitVector,
    FlattenInputs=True)
dir2s = Entwine(Branch00=Y_9, Branch01=Y_9, Branch02=Y_9, Branch03=Y_9, Branch04=Y_9, FlattenInputs=True)
fingergap_15 = Number(fingergap)
armmaterialthickness_20 = Number(armmaterialthickness)
cluster_11 = Cluster_5(startpt=startpts, zigzags=zigzags, dir1=dir1s, dir2=dir2s, close="True")
expression_15 = Expression(t=armmaterialthickness_20, n=ns, g=fingergap_15, Expression="n*(t + g)")
vec_9 = VectorXYZ(XComponent=0, YComponent=expression_15, ZComponent=0)  # -> Vector, Length
rev_9 = Reverse(Vector=vec_9.Vector)
crv_22 = Curve(cluster_11)
move_13 = Move(Geometry=crv_22, Motion=rev_9)  # -> Geometry, Transform

rev_10 = Reverse(Vector=X_5)

extrudedirs = Entwine(Branch00=rev_10, Branch01=X_5, Branch02=X_5, Branch03=Z_3, Branch04=multiplication_10, FlattenInputs=True)
extr_7 = Extrude(Base=move_13.Geometry, Direction=extrudedirs)
cap_7 = CapHoles(Brep=extr_7)

panel_17 = Panel(cap_7)
branch = TreeBranch(Tree=move_13.Geometry, Path="{0;3}", MaintainPaths=True)
mesh_8 = MeshBrep(
    Brep=cap_7,
    Settings={GridMaxCount=0, GridMinCount=16, JaggedSeams=False, MaxEdgeLength=0, MinEdgeLength=0.0001, MinTolerance=0, Refine=True, RefineAngle=0, RelativeTolerance=0.65, SimplePlanes=True, Tolerance=0})
mcol_8 = MeshColours(Mesh=mesh_8, Colours=ColourSwatch(SwatchColor=RGB(209, 56, 166)))
merge_37 = Merge(Data1=mcol_2, Data2=mcol, Data3=mcol_7, Data4=mcol_6, Data5=mcol_3, Data6=mcol_4, Data7=mcol_5, Data8=mcol_8)  # -> flatten(Result)

# ---- group: RH_OUT:Meshes
mesh_9 = Mesh(merge_37)

# ==== cluster Cluster
numstuds = ClusterInput()
theoretical = ClusterInput()
theoretical_2 = Boolean(theoretical)
numstuds_2 = Integer(numstuds)
or = GateOr(A=theoretical_2, B="false")
null = NullItem(Item=numstuds_2)  # -> NullFlags, InvalidFlags, Description
filter = StreamFilter(Gate=or, Stream0="0.2", Stream1="0")
filter_2 = StreamFilter(Gate=null.NullFlags, Stream0=numstuds_2, Stream1="0")
filter_3 = StreamFilter(Gate=null.NullFlags, Stream0=filter, Stream1="0")
expression = Expression(NumStuds=filter_2, StudWidth="8", Tolerance=filter_3, Expression="NumStuds*StudWidth-(2*Tolerance)")
distance = Number(expression)
distance_2 = ClusterOutput(distance)

# ==== cluster Cluster_2
ka_back = ClusterInput()
s = ClusterInput()
h = ClusterInput()
g = ClusterInput()
w = ClusterInput()
ag = ClusterInput()
ac = ClusterInput()
ka_front = ClusterInput()
arm_calc = CSharpScript(s=s, h=h, g=g, w=w, ag=ag, ac=ac, ka_back=ka_back, ka_front=ka_front)  # -> out, A, R, K, J, L_height, L_width, TopShelf_height, MiddleShelf_height, BottomShelf_height; inputs s: Double, h: Double, g: Double, w: Double, ag: Double, ac: Double, ka_back: Double, ka_front: Double
# ---------- arm_calc: C# ----------
    // Where
    // s = shelf width
    // h = height of top shelf to height of middle shelf, in table position
    // g = starting angle of arms in shelf position

    double a = 0;
    double r = 0;
    if (h == 0)
    {
      r = s / (Math.Sin(g) + 1);
    }
    else
    {
      // https://www.wolframalpha.com/input?i=solve+cos%28a%29%3D%28s*sin%28a%29%29%2Fh+-+sin%28g%29+for+a

      // Copied from Wolfram Alpha with additions to make it valid for an Expression component:
      //2*(atan((s-sqrt(h^2*(-(sin(g)^2))+h^2+s^2))/(h*(sin(g)-1))))
      a = 2 * (Math.Atan((s - Math.Sqrt(Math.Pow(h, 2) * (-(Math.Pow(Math.Sin(g), 2))) + Math.Pow(h, 2) + Math.Pow(s, 2))) / (h * (Math.Sin(g) - 1))));
      r = h / Math.Sin(a);
    }

    // k = X offset from edge of shelf of the middle L's higher point to enable the starting angle of the arm to be g
    // j = vertical height of the arm at starting/rest position (will be equal to r when g = 0
    double k = r * Math.Sin(g);
    double j = r * Math.Cos(g);

    //double lh = (w + ag) / Math.Cos(a) + r * Math.Sin(a);
    double lh = (w + ag) / Math.Cos(a) + (s - (ka_back + ka_front) - k) * Math.Tan(a);
    double th = ac + (w / 2) + lh + r + h;

    TopShelf_height = th - h + j + 2 * h;
    MiddleShelf_height = th;
    BottomShelf_height = th - j;

    L_width = s - 2 * k - (ka_back + ka_front);
    L_height = lh;
    A = a;
    R = r;
    K = k;
    J = j;
# ---------- end arm_calc ----------
bottomshelf_height = ClusterOutput(arm_calc.BottomShelf_height)
A = ClusterOutput(arm_calc.A)
R = ClusterOutput(arm_calc.R)
K = ClusterOutput(arm_calc.K)
J = ClusterOutput(arm_calc.J)
l_height = ClusterOutput(arm_calc.L_height)
l_width = ClusterOutput(arm_calc.L_width)
topshelf_height = ClusterOutput(arm_calc.TopShelf_height)
middleshelf_height = ClusterOutput(arm_calc.MiddleShelf_height)

# ==== cluster Cluster_3
x1 = ClusterInput()
x2 = ClusterInput()
d_tr = ClusterInput()
k = ClusterInput()
a = ClusterInput()
g = ClusterInput()
trolleyarm_calc = CSharpScript(x1=x1, x2=x2, d_tr=d_tr, k=k, a=a, g=g)  # -> out, ArmLength, PusherLength; inputs x1: Double, x2: Double, d_tr: Double, k: Double, a: Double, g: Double
# ---------- trolleyarm_calc: C# ----------
    // Note p = rm, x = x1, y = x2 (renamed when entering into WolframAlpha to avoid possible parsing issues by WA

    // Where
    // x1 = start distance of centre of trolley leg relative to back edge of central unit
    // x2 = end distance of centre of trolley leg relative to back edge of central unit
    // g = angle of starting angle of main (left) arm
    // a = end angle relative to horizontal of arm in table position
    // rm = distance along main arm to position hinge for trolley pusher
    // m = length of trolley pusher

    //https://www.wolframalpha.com/input?i=solve+%28x-k%2Bp*sin%28g%29%29%5E2%2B%28p*cos%28g%29-d%29%5E2%3D%28y-p*cos%28a%29-k%29%5E2%2B%28p*sin%28a%29%2Bd%29%5E2+for+p
    // Plain text from WolframAlpha:
    //p = (-2 k x + 2 k y + x^2 - y^2)/(2 (d sin(a) + k sqrt(-sin^2(a) + sin^2(g) + cos^2(g)) - y sqrt(-sin^2(a) + sin^2(g) + cos^2(g)) + d cos(g) + k sin(g) - x sin(g)))
    double rm = (-2 * k * x1 + 2 * k * x2 + Math.Pow(x1, 2) - Math.Pow(x2, 2))
      / (2 * (d_tr * Math.Sin(a) + k * Math.Sqrt(-Math.Pow(Math.Sin(a), 2) + Math.Pow(Math.Sin(g), 2) + Math.Pow(Math.Cos(g), 2)) 
          - x2 * Math.Sqrt(-Math.Pow(Math.Sin(a), 2) + Math.Pow(Math.Sin(g), 2) + Math.Pow(Math.Cos(g), 2)) 
          + d_tr * Math.Cos(g) + k * Math.Sin(g) - x1 * Math.Sin(g)));
    double m = Math.Sqrt(Math.Pow(x1 - k + rm * Math.Sin(g), 2) + Math.Pow(rm * Math.Cos(g) - d_tr, 2));

    ArmLength = rm;
    PusherLength = m;
# ---------- end trolleyarm_calc ----------
armlength = ClusterOutput(trolleyarm_calc.ArmLength)
pusherlength = ClusterOutput(trolleyarm_calc.PusherLength)

# ==== cluster Cluster_4
D = ClusterInput()
D_2 = Data(D)
tstat = TreeStatistics(Tree=D_2)  # -> Paths, Length, Count
larger = LargerThan(FirstNumber=tstat.Count, SecondNumber="1")  # -> LargerThan, OrEqualTo
flatten = FlattenTree(Tree=D_2, Path="{0}")
simplify = SimplifyTree(Tree=D_2, Front=False)
filter = StreamFilter(Gate=larger.LargerThan, Stream0=flatten, Stream1=simplify)
D_3 = Data(filter)
D_4 = ClusterOutput(D_3)

# ==== cluster Cluster_5
startpt = ClusterInput()
zigzags = ClusterInput()
dir1 = ClusterInput()
dir2 = ClusterInput()
mirror = ClusterInput()
close = ClusterInput()
zigzag_polyline = CSharpScript(StartPt=startpt, ZigZags=zigzags, Dir1=dir1, Dir2=dir2, Mirror=mirror, Close=close)  # -> out, Pl; inputs StartPt: Point3d, ZigZags: list of Double, Dir1: Vector3d, Dir2: Vector3d, Mirror: Boolean, Close: Boolean
# ---------- zigzag_polyline: C# usings ----------
using System.Linq;
# ---------- zigzag_polyline: C# ----------
    if (StartPt == null) return;

    List<Point3d> pts = new List<Point3d>() { StartPt };

    List<double> zigZags = ZigZags.ToList();

    List<double> temp = zigZags.ToList();

    for (int i = 0; i < zigZags.Count; i++)
    {
      pts.Add(pts.Last() + zigZags[i] * (((i % 2) == 0) ? Dir1 : Dir2));
    }

    if (Mirror && ZigZags.Count >= 2)
    {
      int multiplier = -1;
      for (int i = (zigZags.Count - 2); i >= 0; i--)
      {
        pts.Add(pts.Last() + zigZags[i] * multiplier * (((i % 2) == 0) ? Dir1 : Dir2));
        multiplier *= -1;
        temp.Add(zigZags[i] * (((i % 2) == 0) ? 1 : -1));
      }
    }
    if (Close)
    {
      pts.Add(pts.First());
    }

    Print(string.Join(",", temp));
    Pl = new PolylineCurve(pts);
# ---------- end zigzag_polyline ----------
pl = ClusterOutput(zigzag_polyline.Pl)
panel = Panel(zigzag_polyline.out)

# ==== cluster MedianIndex
L = ClusterInput()
lng = ListLength(List=L)
division = Division(A=lng, B="2")
int = Integer(division)
subtraction = Subtraction(A=int, B="1")
I = ClusterOutput(subtraction)

# ==== cluster Cluster_6
startpt = ClusterInput()
startdir = ClusterInput()
startlength = ClusterInput()
rotationdegrees = ClusterInput()
remaininglengths = ClusterInput()
close = ClusterInput()
plane = ClusterInput()
c_script = CSharpScript(
    StartPt=startpt,
    StartDir=startdir,
    Plane=plane,
    StartLength=startlength,
    RotationDegrees=rotationdegrees,
    RemainingLengths=remaininglengths,
    Close=close)  # -> out, Polyline; inputs StartPt: Point3d, StartDir: Vector3d, Plane: Plane, StartLength: Double, RotationDegrees: list of Double, RemainingLengths: list of Double, Close: Boolean
# ---------- c_script: C# ----------
    double tol = RhinoDoc.ActiveDoc.ModelAbsoluteTolerance;

    try
    {
      Plane plane = (Plane == Plane.Unset || Plane.Normal.Length < tol) ? Plane.WorldXY : Plane;

      Vector3d startDir = new Vector3d(StartDir);
      startDir.Unitize();

      // Notes:
      // - the rotation is always in counter-clockwise
      if (StartLength <= tol || StartDir.Length < tol) return;
      else if ((RotationDegrees == null && RemainingLengths == null)
        || (RotationDegrees == null && RemainingLengths != null)
        || (RotationDegrees != null && RemainingLengths == null))
      {
        Polyline = new LineCurve(StartPt, StartPt + startDir * StartLength);
        return;
      }

      var pts = new List<Point3d>() { StartPt, StartPt + (startDir * StartLength) };

      int numRemaining = Math.Min(RotationDegrees.Count, RemainingLengths.Count);

      Point3d prevPt = pts.Last();
      Vector3d prevDir = StartDir;
      for (int i = 0; i < numRemaining; i++)
      {
        var radians = RotationDegrees[i] * Math.PI / 180;
        var newDir = new Vector3d(prevDir);
        newDir.Rotate(radians, plane.Normal);
        newDir.Unitize();

        var newPt = prevPt + newDir * RemainingLengths[i];
        pts.Add(newPt);

        prevDir = newDir;
        prevPt = newPt;
      }

      if (Close)
      {
        pts.Add(pts.First());
      }
      Polyline = new PolylineCurve(pts);
    }
    catch(Exception ex)
    {
      Print(ex.Message);
    }
# ---------- end c_script ----------
out = ClusterOutput(c_script.out)
polyline = ClusterOutput(c_script.Polyline)
out_2 = ClusterOutput(c_script.out)
