# Grasshopper definition sink_cabinet_a.gh (Grasshopper 1.0.7)

depth = Number()
depth_2 = GetNumber(AtLeast=1, AtMost=1, Maximum=1.797693135e+308, Minimum=-1.797693135e+308, TreeAccess=False)
depth_3 = Number(depth)
depth_4 = Number(depth_2)
merge = Merge(Data1=depth_3, Data2="600", Data3=depth_4)
mesh = Mesh([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])
rh_out_meshes = Mesh(mesh)
mesh_2 = Mesh(mesh)
