# Grasshopper definition sphere_array.gh (Grasshopper 1.0.7)
# Copyright: Arup

number_of_dots_per_row = GetInteger(Slider(17, range=2..50), AtLeast=1, AtMost=1, Maximum=2147483647, Minimum=-2147483648, TreeAccess=False)
radius = GetNumber(Slider(2.9, range=0.1..10), AtLeast=1, AtMost=1, Maximum=1.797693135e+308, Minimum=-1.797693135e+308, TreeAccess=False)
area_dimension = GetNumber(Slider(220.8, range=1..1000), AtLeast=1, AtMost=1, Maximum=1.797693135e+308, Minimum=-1.797693135e+308, TreeAccess=False)
int = Integer(number_of_dots_per_row)
num = Number(area_dimension)
pt = ConstructPoint(XCoordinate=0, YCoordinate=0, ZCoordinate=0)
pt_2 = ConstructPoint(XCoordinate=0, YCoordinate=num, ZCoordinate=0)
subtraction = Subtraction(A=int, B="1")
num_2 = Number(radius)
ln = Line(StartPoint=pt, EndPoint=pt_2)
division = Division(A=num, B=subtraction)
vec = VectorXYZ(XComponent=division, YComponent=0, ZComponent=0)  # -> Vector, Length
divide = DivideCurve(Curve=ln, Count=subtraction, Kinks=False)  # -> Points, Tangents, Parameters
arrlinear = LinearArray(Geometry=divide.Points, Direction=vec.Vector, Count=int)  # -> Geometry, Transform
xy = XYPlane(Origin=flatten(arrlinear.Geometry))
sph = Sphere(Base=xy, Radius=num_2)
mesh = MeshBrep(
    Brep=sph,
    Settings={GridMaxCount=0, GridMinCount=16, JaggedSeams=False, MaxEdgeLength=0, MinEdgeLength=0.0001, MinTolerance=0, Refine=True, RefineAngle=0, RelativeTolerance=0.65, SimplePlanes=True, Tolerance=0})

# ---- group: RH_OUT:Meshes
mesh_2 = Mesh(mesh)
