# Grasshopper definition subtract_forked_on_test09.gh (Grasshopper 1.0.7)
# plug-ins: Kangaroo2 Components

B = B()
# Nope need one more
A = A()
subtraction = Subtraction(A=A, B=B)
R = Result(subtraction)
python = GhPythonScript(x=A, y=B)  # -> out, r
# ---------- python: Python ----------
__author__ = "nicol"
__version__ = "2024.02.23"

import rhinoscriptsyntax as rs

if x is not None and y is not None:
    r = x + y
else:
    # Handle the case where either x or y is None
    r = None  # Or any other appropriate action you want to take
# ---------- end python ----------
cluster = Cluster()
coplanar = CoPlanar(Strength=1)
panel = Panel(python.r)

# ==== cluster Cluster
A = ClusterInput()
B = ClusterInput()
addition = Addition(A=A, B=B)
R = ClusterOutput(addition)
