# Grasshopper definition subtract_then_to_the_power_of_10.gh (Grasshopper 1.0.8)

panel = Panel("Another")
B = B()
A = A()
subtraction = Subtraction(A=A, B=B)
_10º = PowerOf10(Value=subtraction)
y = Result(_10º)
