# Grasshopper definition test2403134witholdrevision.gh (Grasshopper 1.0.8)

cluster = Cluster()
cluster_2 = Cluster()

# ==== cluster Cluster
B = ClusterInput()
A = ClusterInput()
subtraction = Subtraction(A=A, B=B)
_10º = PowerOf10(Value=subtraction)
y = ClusterOutput(_10º)
