# Grasshopper definition test_multiplication_2.gh (Grasshopper 1.0.8)

cluster = Cluster()
A = A()
B = B()
multiplication = Multiplication(A=A, B=B)
R = Result(multiplication)

# ==== cluster Cluster
numstuds = ClusterInput()
theoretical = ClusterInput()
theoretical_2 = Boolean(theoretical)
numstuds_2 = Integer(numstuds)
or = GateOr(A=theoretical_2, B="false")
null = NullItem(Item=numstuds_2)  # -> NullFlags, InvalidFlags, Description
filter = StreamFilter(Gate=or, Stream0="0.2", Stream1="0")
filter_2 = StreamFilter(Gate=null.NullFlags, Stream0=numstuds_2, Stream1="0")
filter_3 = StreamFilter(Gate=null.NullFlags, Stream0=filter, Stream1="0")
expression = Expression(NumStuds=filter_2, StudWidth="8", Tolerance=filter_3, Expression="NumStuds*StudWidth-(2*Tolerance)")
distance = Number(expression)
distance_2 = ClusterOutput(distance)
