# Grasshopper definition test_single_cluster_240506.gh (Grasshopper 1.0.8)

cluster = Cluster_2()

# ==== cluster Cluster_2
C = ClusterInput()
B = ClusterInput()
A = ClusterInput()
C_2 = Number(C)
cluster = Cluster(A=A, B=B)
addition = Addition(A=cluster, B=C_2)
R = ClusterOutput(addition)

# ==== cluster Cluster
B = ClusterInput()
A = ClusterInput()
subtraction = Subtraction(A=A, B=B)
R = ClusterOutput(subtraction)
