# Grasshopper definition zigzag_column.gh (Grasshopper 1.0.8)
# plug-ins: RhinoCodePluginGH
# #### Description
# This generates a pipe along a zig zag polyline, where a zig and zag is a pair of lines at 90 degree angles.
# 
# #### Notes
# If the number of zig and zags is 2, then there will be 4 line segments, and if it's 3 then there will be 6 line segments, and so on.

zag_length = GetNumber(Slider(35, range=1..100), AtLeast=1, AtMost=1, Maximum=1.797693135e+308, Minimum=-1.797693135e+308, TreeAccess=False)
zig_length = GetNumber(Slider(33.4, range=1..100), AtLeast=1, AtMost=1, Maximum=1.797693135e+308, Minimum=-1.797693135e+308, TreeAccess=False)
number_of_zig_zags = GetInteger(Slider(2, range=1..10), AtLeast=1, AtMost=10, Maximum=10, Minimum=1, Prompt="Number of Zig and Zags", TreeAccess=False)
radius = GetNumber("10", AtLeast=1, AtMost=1, Maximum=1.797693135e+308, Minimum=-1.797693135e+308, TreeAccess=False)
c_script = CSharpScript(x=number_of_zig_zags)  # -> out, a
# ---------- c_script: C# ----------
// Grasshopper Script Instance
#region Usings
using System;
using System.Linq;
using System.Collections;
using System.Collections.Generic;
using System.Drawing;

using Rhino;
using Rhino.Geometry;

using Grasshopper;
using Grasshopper.Kernel;
using Grasshopper.Kernel.Data;
using Grasshopper.Kernel.Types;
#endregion

public class Script_Instance : GH_ScriptInstance
{
    #region Notes
    /* 
      Members:
        RhinoDoc RhinoDocument
        GH_Document GrasshopperDocument
        IGH_Component Component
        int Iteration

      Methods (Virtual & overridable):
        Print(string text)
        Print(string format, params object[] args)
        Reflect(object obj)
        Reflect(object obj, string method_name)
    */
    #endregion

    private void RunScript(object x, ref object a)
    {
        a = (x == null) ? 0 : 1;
    }
}
# ---------- end c_script ----------
merge = Merge(Data1=zig_length, Data2=zag_length)
filter = StreamFilter(Gate=c_script.a, Stream0="2", Stream1=number_of_zig_zags)
pt = ConstructPoint(XCoordinate="10", YCoordinate="10", ZCoordinate=0)
dup = DuplicateData(Data=merge, Number=filter, Order=True)
X = UnitX(Factor=1)
Y = UnitY(Factor=1)
cluster = ZigZagPolyline(startpt=pt, zigzags=dup, dir1=X, dir2=Y)
yz = YZPlane(Origin=pt)
cir = Circle(Plane=yz, Radius=radius)
swp1 = Sweep1(Rail=cluster, Sections=cir, Miter=1)
edges = BrepEdges(Brep=swp1)  # -> Naked, Interior, NonManifold
mesh = MeshBrep(
    Brep=swp1,
    Settings={GridMaxCount=0, GridMinCount=16, JaggedSeams=False, MaxEdgeLength=0, MinEdgeLength=0.0001, MinTolerance=0, Refine=True, RefineAngle=0, RelativeTolerance=0.65, SimplePlanes=True, Tolerance=0})
area = Area(Geometry=swp1)  # -> Area, Centroid
merge_2 = Merge(Data1=edges.Naked, Data2=edges.Interior)

# ---- group: RH_OUT:SurfaceArea
surface_area = Number(area.Area)

# ---- group: RH_OUT:Curves
edge_curves = Curve(merge_2)

# ---- group: RH_OUT:Mesh
cylinder_mesh = Mesh(mesh)

# ==== cluster ZigZagPolyline
startpt = ClusterInput()
zigzags = ClusterInput()
dir1 = ClusterInput()
dir2 = ClusterInput()
mirror = ClusterInput()
close = ClusterInput()
zigzag_polyline = CSharpScript(StartPt=startpt, ZigZags=zigzags, Dir1=dir1, Dir2=dir2, Mirror=mirror, Close=close)  # -> out, Pl; inputs StartPt: Point3d, ZigZags: list of Double, Dir1: Vector3d, Dir2: Vector3d, Mirror: Boolean, Close: Boolean
# ---------- zigzag_polyline: C# usings ----------
using System.Linq;
# ---------- zigzag_polyline: C# ----------
    if (StartPt == null) return;

    List<Point3d> pts = new List<Point3d>() { StartPt };

    List<double> zigZags = ZigZags.ToList();

    List<double> temp = zigZags.ToList();

    for (int i = 0; i < zigZags.Count; i++)
    {
      pts.Add(pts.Last() + zigZags[i] * (((i % 2) == 0) ? Dir1 : Dir2));
    }

    if (Mirror && ZigZags.Count >= 2)
    {
      int multiplier = -1;
      for (int i = (zigZags.Count - 2); i >= 0; i--)
      {
        pts.Add(pts.Last() + zigZags[i] * multiplier * (((i % 2) == 0) ? Dir1 : Dir2));
        multiplier *= -1;
        temp.Add(zigZags[i] * (((i % 2) == 0) ? 1 : -1));
      }
    }
    if (Close)
    {
      pts.Add(pts.First());
    }

    Print(string.Join(",", temp));
    Pl = new PolylineCurve(pts);
# ---------- end zigzag_polyline ----------
pl = ClusterOutput(zigzag_polyline.Pl)
panel = Panel(zigzag_polyline.out)
